# Grasshopper definition 002-swiftlet-test-movable-target.ghx (Grasshopper 1.0.8)
# plug-ins: Fologram for Grasshopper, Swiftlet

# Interoperate between Rhino simulation space &
# Standardbots REST API over HTTP using JSON
# Packages:
# Swiftlet
# 
# Model Unit: Millimeter
# URDF Unit: Meter
augdoc = AugmentedDocument(augmented_trigger_0_key=boolean_toggle, num_augmented_triggers=1)

# ---- group: TARGET in Rhino
curve = Curve(<curve referenced from the Rhino model>)

# ----
scale = Panel("1000")

# ----
# SET TARGET IN RHINO
control_points = ControlPoints(Curve=curve)  # -> Points, Weights, Knots
list_item = ListItem(List=control_points.Points, Index=0, Wrap=True)  # -> Item, Item1, Item2
area = Area(Geometry=curve)  # -> Area, Centroid
plane_3pt = Plane3Pt(PointA=list_item.Item, PointB=list_item.Item1, PointC=list_item.Item2)
boolean_toggle = BooleanToggle(False)
plane_origin = PlaneOrigin(Base=plane_3pt, Origin=area.Centroid)
multiplication = Multiplication(A=scale, B=Slider(0.25, range=0..1))
deconstruct_plane = DeconstructPlane(Plane=plane_origin)  # -> Origin, XAxis, YAxis, ZAxis
amplitude = Amplitude(Vector=deconstruct_plane.ZAxis, Amplitude=multiplication)
vector_display_ex = VectorDisplayEx(Point=deconstruct_plane.Origin, Vector=amplitude, Colour=ColourSwatch(SwatchColor=RGB(255, 0, 0)), Width=2)

# ---- group: outputs: positions and orientations
ironpython_2_script = IronPython2Script(P=plane_origin, scale=scale, conjugate=boolean_toggle, align_z=Toggle(True), plane_frame="base", reference_frame="base")  # -> flatten(x), flatten(y), flatten(z), flatten(qx), flatten(qy), flatten(qz), flatten(qw); inputs P: Plane, scale: Double, conjugate: Boolean
# ---------- ironpython_2_script: IronPython ----------
"""Convert a Rhino Plane to robot pose fields.

Inputs expected in Grasshopper:
    P          Rhino.Geometry.Plane to convert.
    scale      Optional Rhino-to-robot scale. Use 1000 for mm Rhino models.
    conjugate  Optional bool. Set True only if your receiver expects inverse rotation.
    align_z    Optional bool. Use True for Rhino planes/rectangles whose +Z
               normal should drive robot TCP +X.
    reference_frame
               Optional string. Use "base" for tooltip_position reference_frame.
    plane_frame
               Optional string. Frame the input Rhino plane is already drawn in.
               Defaults to reference_frame. Use "world" only for planes drawn
               in the URDF world/robot-visualizer frame.

Outputs:
    x, y, z
    qx, qy, qz, qw
    position
    orientation
    reference_frame_out
"""

import math

import Rhino.Geometry as rg


try:
    scale
except NameError:
    scale = 1000.0

try:
    conjugate
except NameError:
    conjugate = False

try:
    align_z
except NameError:
    align_z = True

try:
    reference_frame
except NameError:
    reference_frame = "base"

try:
    plane_frame
except NameError:
    plane_frame = None

if P is None:
    raise ValueError("Connect a Rhino Plane to input P.")

origin = P.Origin

origin_x = origin.X / scale
origin_y = origin.Y / scale
origin_z = origin.Z / scale

x_axis_in = rg.Vector3d(P.XAxis)
y_axis_in = rg.Vector3d(P.YAxis)

if not x_axis_in.Unitize():
    raise ValueError("Plane X axis is invalid.")
if not y_axis_in.Unitize():
    raise ValueError("Plane Y axis is invalid.")

z_axis_in = rg.Vector3d.CrossProduct(x_axis_in, y_axis_in)
if not z_axis_in.Unitize():
    raise ValueError("Plane axes are parallel or invalid.")

if align_z:
    # Robot/tool +X is the faceplate normal. Rhino planes normally use +Z as
    # their normal, so map robot +X to plane +Z. Plane +X controls the roll
    # around that normal by becoming robot +Y.
    x_axis = z_axis_in
    y_axis = x_axis_in
    z_axis = rg.Vector3d.CrossProduct(x_axis, y_axis)
else:
    x_axis = x_axis_in
    y_axis = y_axis_in
    z_axis = z_axis_in

if not z_axis.Unitize():
    raise ValueError("Mapped plane axes are invalid.")

# Recompute Y so the output matrix is exactly orthonormal and right-handed.
y_axis = rg.Vector3d.CrossProduct(z_axis, x_axis)
y_axis.Unitize()

reference_frame_out = str(reference_frame or "base").lower()
plane_frame_in = str(plane_frame or reference_frame_out).lower()

if plane_frame_in == reference_frame_out:
    x = origin_x
    y = origin_y
    z = origin_z
elif plane_frame_in == "world" and reference_frame_out == "base":
    # sbot.urdf has world->base_link as Rz(-pi/2), so convert world geometry
    # to API base with inverse Rz(+pi/2).
    def world_to_base_point(px, py, pz):
        return -py, px, pz

    def world_to_base_vector(v):
        return rg.Vector3d(-v.Y, v.X, v.Z)

    x, y, z = world_to_base_point(origin_x, origin_y, origin_z)
    x_axis = world_to_base_vector(x_axis)
    y_axis = world_to_base_vector(y_axis)
    z_axis = world_to_base_vector(z_axis)
elif plane_frame_in == "base" and reference_frame_out == "world":
    def base_to_world_point(px, py, pz):
        return py, -px, pz

    def base_to_world_vector(v):
        return rg.Vector3d(v.Y, -v.X, v.Z)

    x, y, z = base_to_world_point(origin_x, origin_y, origin_z)
    x_axis = base_to_world_vector(x_axis)
    y_axis = base_to_world_vector(y_axis)
    z_axis = base_to_world_vector(z_axis)
else:
    raise ValueError('plane_frame and reference_frame must be "base" or "world".')

# Rotation matrix with plane axes as columns.
m00 = x_axis.X
m10 = x_axis.Y
m20 = x_axis.Z

m01 = y_axis.X
m11 = y_axis.Y
m21 = y_axis.Z

m02 = z_axis.X
m12 = z_axis.Y
m22 = z_axis.Z

trace = m00 + m11 + m22

if trace > 0.0:
    s = math.sqrt(trace + 1.0) * 2.0
    qw = 0.25 * s
    qx = (m21 - m12) / s
    qy = (m02 - m20) / s
    qz = (m10 - m01) / s
elif m00 > m11 and m00 > m22:
    s = math.sqrt(1.0 + m00 - m11 - m22) * 2.0
    qw = (m21 - m12) / s
    qx = 0.25 * s
    qy = (m01 + m10) / s
    qz = (m02 + m20) / s
elif m11 > m22:
    s = math.sqrt(1.0 + m11 - m00 - m22) * 2.0
    qw = (m02 - m20) / s
    qx = (m01 + m10) / s
    qy = 0.25 * s
    qz = (m12 + m21) / s
else:
    s = math.sqrt(1.0 + m22 - m00 - m11) * 2.0
    qw = (m10 - m01) / s
    qx = (m02 + m20) / s
    qy = (m12 + m21) / s
    qz = 0.25 * s

mag = math.sqrt(qx * qx + qy * qy + qz * qz + qw * qw)
if mag == 0.0:
    raise ValueError("Quaternion magnitude is zero.")

qx /= mag
qy /= mag
qz /= mag
qw /= mag

if conjugate:
    qx = -qx
    qy = -qy
    qz = -qz

position = {
    "x": x,
    "y": y,
    "z": z,
}

orientation = {
    "x": qx,
    "y": qy,
    "z": qz,
    "w": qw,
}
# ---------- end ironpython_2_script ----------

# ----
# ORIENTATION
# QUATERNION
panel = Panel("""x
y
z
w""")
create_json_value = CreateJSONValue(Value=ironpython_2_script.qx)
create_json_value_2 = CreateJSONValue(Value=ironpython_2_script.qy)
create_json_value_3 = CreateJSONValue(Value=ironpython_2_script.qz)
create_json_value_4 = CreateJSONValue(Value=ironpython_2_script.qw)
panel_2 = Panel("""kind
quaternion""")
merge = Merge(Data1=create_json_value, Data2=create_json_value_2, Data3=create_json_value_3, Data4=create_json_value_4)
create_json_value_5 = CreateJSONValue(Value="quaternion")
create_json_object = CreateJSONObject(Keys=panel, Values=merge)
merge_2 = Merge(Data1=create_json_value_5, Data2=create_json_object)
create_json_object_2 = CreateJSONObject(Keys=panel_2, Values=merge_2)
create_json_object_3 = CreateJSONObject(Keys="orientation", Values=create_json_object_2)

# ----
# POSITION
panel_3 = Panel("meters")
create_json_value_6 = CreateJSONValue(Value=panel_3)
create_json_value_7 = CreateJSONValue(Value=ironpython_2_script.x)
create_json_value_8 = CreateJSONValue(Value=ironpython_2_script.y)
create_json_value_9 = CreateJSONValue(Value=ironpython_2_script.z)
panel_4 = Panel("""unit_kind
x
y
z""")
merge_3 = Merge(Data1=create_json_value_6, Data2=create_json_value_7, Data3=create_json_value_8, Data4=create_json_value_9)
create_json_object_4 = CreateJSONObject(Keys=panel_4, Values=merge_3)

# ----
# SPEED PROFILE
max_tooltip_speed = Slider(1, range=0..1)
scaling_factor = Slider(1, range=0..1)
create_json_value_10 = CreateJSONValue(Value=max_tooltip_speed)
create_json_value_11 = CreateJSONValue(Value=scaling_factor)
panel_5 = Panel("""scaling_factor
max_tooltip_speed""")
merge_4 = Merge(Data1=create_json_value_11, Data2=create_json_value_10)
create_json_object_5 = CreateJSONObject(Keys=panel_5, Values=merge_4)

# ----
# Translate target to
# TOOLTIP POSITION
# in JSON
# A quaternion = Move the robot tool to this position,
# with this rotation. It is often written as:
# 
# q = x*i + y*j + z*k + w
# 
# or
# q = [x, y, z, w]
panel_6 = Panel("base")
create_json_value_12 = CreateJSONValue(Value=panel_6)
create_json_value_13 = CreateJSONValue(Value="base")
panel_7 = Panel("""position
orientation
reference_frame
axis_alignment""")
merge_5 = Merge(Data1=create_json_object_4, Data2=create_json_object_2, Data3=create_json_value_12, Data4=create_json_value_13)
create_json_object_6 = CreateJSONObject(Keys=panel_7, Values=merge_5)

# ----
# ROBOT CREDENTIALS
file_path = FilePath("C:\Users\yzheng\OneDrive - HKS Inc\Desktop\API_Keys\Standardbots.txt")
read_file = ReadFile(File=file_path, PerLineParse=False)
bearer_token_auth = BearerTokenAuth(Token=read_file)
create_http_header = CreateHttpHeader(Key="robot-kind", Value="live")
merge_6 = Merge(Data1=bearer_token_auth, Data2=create_http_header)

# ----
# CREATE JSON
panel_8 = Panel("tooltip_position")
create_json_value_14 = CreateJSONValue(Value=panel_8)
create_json_value_15 = CreateJSONValue(Value="line")
panel_9 = Panel("""kind
tooltip_position
movement_kind
speed_profile""")
merge_7 = Merge(Data1=create_json_value_14, Data2=create_json_object_6, Data3=create_json_value_15, Data4=create_json_object_5)
create_json_object_7 = CreateJSONObject(Keys=panel_9, Values=merge_7)
stringify_json_token = StringifyJSONToken(JToken=create_json_object_7)

# ----
# SET CONTROL MODE
panel_10 = Panel("https://cb2347.sb.app/api/v1/status/control-mode")
create_text_body = CreateTextBody(
    Content="{ \"kind\" : \"api\" }",
    IsHtmlChecked=False,
    IsJavascriptChecked=False,
    IsJsonChecked=True,
    IsTextChecked=False,
    IsXmlChecked=False)
post_request = POSTRequest(URL=panel_10, Body=create_text_body, Headers=bearer_token_auth, TimeoutSeconds=100)  # -> Status, Content, Response
panel_11 = Panel(post_request.Content)

target = Panel(stringify_json_token)

# ----
# POST
# GRIPPER
displacement = Slider(0, range=0..83)  # disabled
panel_12 = Panel("millimeters")  # disabled
create_json_value_16 = CreateJSONValue(Value=displacement)  # disabled
create_json_value_17 = CreateJSONValue(Value=panel_12)  # disabled
panel_13 = Panel("""unit_kind
value""")  # disabled
merge_8 = Merge(Data1=create_json_value_17, Data2=create_json_value_16)  # disabled
panel_14 = Panel("internal")  # disabled
panel_15 = Panel("move")  # disabled
create_json_object_8 = CreateJSONObject(Keys=panel_13, Values=merge_8)  # disabled
create_json_value_18 = CreateJSONValue(Value=panel_14)  # disabled
create_json_value_19 = CreateJSONValue(Value=panel_15)  # disabled
panel_16 = Panel("""control_kind
target_grip_width
grip_direction""")  # disabled
panel_17 = Panel("onrobot_2fg7")  # disabled
merge_9 = Merge(Data1=create_json_value_19, Data2=create_json_object_8, Data3=create_json_value_18)  # disabled
create_json_object_9 = CreateJSONObject(Keys=panel_16, Values=merge_9)  # disabled
create_json_value_20 = CreateJSONValue(Value=panel_17)  # disabled
panel_18 = Panel("""kind
onrobot_2fg7""")  # disabled
merge_10 = Merge(Data1=create_json_value_20, Data2=create_json_object_9)  # disabled
create_json_object_10 = CreateJSONObject(Keys=panel_18, Values=merge_10)  # disabled
panel_19 = Panel("https://cb2347.sb.app/api/v1/equipment/end-effector/control")  # disabled
stringify_json_token_2 = StringifyJSONToken(JToken=create_json_object_10)  # disabled
create_text_body_2 = CreateTextBody(
    Content=stringify_json_token_2,
    IsHtmlChecked=False,
    IsJavascriptChecked=False,
    IsJsonChecked=True,
    IsTextChecked=False,
    IsXmlChecked=False)  # disabled
panel_20 = Panel(stringify_json_token_2)  # disabled
post_request_2 = POSTRequest(URL=panel_19, Body=create_text_body_2, Headers=bearer_token_auth, TimeoutSeconds=100)  # -> Status, Content, Response; disabled
panel_21 = Panel(post_request_2.Content)  # disabled
panel_22 = Panel(post_request_2.Status)  # disabled

# ----
# POST
# TOOLTIP LOCATION
panel_23 = Panel("https://cb2347.sb.app/api/v1/movement/position/arm")  # disabled
parse_json_string = ParseJSONString(Text=stringify_json_token)  # disabled
create_text_body_3 = CreateTextBody(
    Content=parse_json_string,
    IsHtmlChecked=False,
    IsJavascriptChecked=False,
    IsJsonChecked=True,
    IsTextChecked=False,
    IsXmlChecked=False)  # disabled
post_request_3 = POSTRequest(URL=panel_23, Body=create_text_body_3, Headers=merge_6, TimeoutSeconds=100)  # -> Status, Content, Response; disabled
panel_24 = Panel(post_request_3.Content)  # disabled

# ----
# GET
# ROBOT POSITION
panel_26 = Panel("https://cb2347.sb.app/api/v1/movement/position/arm")
trigger = Trigger(Interval=500, TimerInterval=500, Target=get_request)
get_request = GETRequest(URL=panel_26, Headers=bearer_token_auth, TimeoutSeconds=100)  # -> Status, Content, Response
format_json_string = FormatJsonString(JSONString=get_request.Content)
parse_json_string_2 = ParseJSONString(Text=get_request.Content)
current = Panel(format_json_string)
get_json_object_key = GetJSONObjectKey(JObject=parse_json_string_2, Key="tooltip_position")
get_json_object_key_2 = GetJSONObjectKey(JObject=get_json_object_key, Key="orientation")
get_json_object_key_3 = GetJSONObjectKey(JObject=get_json_object_key, Key="position")
get_json_object_key_4 = GetJSONObjectKey(JObject=get_json_object_key_2, Key="quaternion")
get_json_object_key_5 = GetJSONObjectKey(JObject=get_json_object_key_3, Key="x")
get_json_object_key_6 = GetJSONObjectKey(JObject=get_json_object_key_3, Key="y")
get_json_object_key_7 = GetJSONObjectKey(JObject=get_json_object_key_3, Key="z")
get_json_object_key_8 = GetJSONObjectKey(JObject=get_json_object_key_4, Key="x")
get_json_object_key_9 = GetJSONObjectKey(JObject=get_json_object_key_4, Key="y")
get_json_object_key_10 = GetJSONObjectKey(JObject=get_json_object_key_4, Key="z")
get_json_object_key_11 = GetJSONObjectKey(JObject=get_json_object_key_4, Key="w")
read_json_value = ReadJSONValue(JValue=get_json_object_key_5)  # -> AsString, AsNumber, AsBool
read_json_value_2 = ReadJSONValue(JValue=get_json_object_key_6)  # -> AsString, AsNumber, AsBool
read_json_value_3 = ReadJSONValue(JValue=get_json_object_key_7)  # -> AsString, AsNumber, AsBool
read_json_value_4 = ReadJSONValue(JValue=get_json_object_key_8)  # -> AsString, AsNumber, AsBool
read_json_value_5 = ReadJSONValue(JValue=get_json_object_key_9)  # -> AsString, AsNumber, AsBool
read_json_value_6 = ReadJSONValue(JValue=get_json_object_key_10)  # -> AsString, AsNumber, AsBool
read_json_value_7 = ReadJSONValue(JValue=get_json_object_key_11)  # -> AsString, AsNumber, AsBool

panel_27 = Panel(get_request.Content)

# ----
# MESH FROM URDF
panel_28 = Panel("joint_rotations")
get_json_object_key_12 = GetJSONObjectKey(JObject=parse_json_string_2, Key=panel_28)
read_json_array = ReadJSONArray(Array=get_json_object_key_12)
read_json_value_8 = ReadJSONValue(JValue=read_json_array)  # -> AsString, AsNumber, AsBool
file_path_2 = FilePath("C:\Users\yzheng\OneDrive - HKS Inc\Documents\GitHub\HKS_MADE_StandardBotsRO1\01_Hardware_Documentation\standard_bots_description\sbot.urdf")
file_path_3 = FilePath("C:\Users\yzheng\OneDrive - HKS Inc\Documents\GitHub\HKS_MADE_StandardBotsRO1\01_Hardware_Documentation\standard_bots_description\meshes\sbot\visual\")
python_3_script = Python3Script(
    joint_rotations=read_json_value_8.AsNumber,
    urdf_path=file_path_2,
    mesh_dir=file_path_3,
    scale=Slider(1000, range=0..1000))  # -> M, N, F, J, Info; inputs joint_rotations: list of Double, urdf_path: String, mesh_dir: String, scale: Double, base_plane: Plane
# ---------- python_3_script: Python ----------
"""GhPython helper: visualize the RO1 from URDF + STL meshes.

Inputs expected in Grasshopper:
    joint_rotations  List[float], six RO1 joint rotations in radians.
    urdf_path        Path to sbot.urdf.
    mesh_dir         Directory containing the visual STL files.
    scale            1000 for Rhino millimeters, 1 for meters.
    base_plane       Optional Rhino plane placing the URDF world frame in Rhino.

Outputs:
    M                Transformed link meshes.
    N                Link names for each mesh.
    F                TCP/faceplate frame as a Rhino plane (`tool0`/`flange`).
    J                Joint names in the order used by joint_rotations.
    Info             Status/debug text.

Notes:
    - This is visualization-only. It ignores collision geometry and primitive shapes.
    - The script honors the URDF world -> base_link fixed transform.
    - URDF and API units are meters. Use scale=1000 in a millimeter Rhino model.
"""

import math
import os
import struct
import xml.etree.ElementTree as ET

import Rhino.Geometry as rg
import scriptcontext as sc


try:
    joint_rotations
except NameError:
    joint_rotations = [0.0] * 6

try:
    urdf_path
except NameError:
    urdf_path = None

try:
    mesh_dir
except NameError:
    mesh_dir = None

try:
    scale
except NameError:
    scale = 1000.0

try:
    base_plane
except NameError:
    base_plane = None


ROOT_LINK = "world"
TCP_LINK_CANDIDATES = ("tool0", "flange")
FACEPLATE_LINK_CANDIDATES = ("tool0", "flange", "wrist_3_link")


class Joint(object):
    def __init__(self, name, joint_type, parent, child, xyz, rpy, axis):
        self.name = name
        self.joint_type = joint_type
        self.parent = parent
        self.child = child
        self.xyz = xyz
        self.rpy = rpy
        self.axis = axis


class LinkMesh(object):
    def __init__(self, link_name, mesh_name, xyz, rpy):
        self.link_name = link_name
        self.mesh_name = mesh_name
        self.xyz = xyz
        self.rpy = rpy


def parse_floats(text, count, default_value):
    if not text:
        return [default_value] * count
    vals = [float(v) for v in text.split()]
    while len(vals) < count:
        vals.append(default_value)
    return vals[:count]


def origin_from_element(element):
    if element is None:
        return [0.0, 0.0, 0.0], [0.0, 0.0, 0.0]
    return (
        parse_floats(element.get("xyz"), 3, 0.0),
        parse_floats(element.get("rpy"), 3, 0.0),
    )


def mesh_basename(filename):
    filename = filename.replace("\\", "/")
    return filename.split("/")[-1]


def parse_urdf(path):
    root = ET.parse(path).getroot()
    joints = []
    parent_to_joints = {}
    link_meshes = []

    for link_el in root.findall("link"):
        link_name = link_el.get("name")
        for visual_el in link_el.findall("visual"):
            xyz, rpy = origin_from_element(visual_el.find("origin"))
            mesh_el = visual_el.find("geometry/mesh")
            if mesh_el is None:
                continue
            filename = mesh_el.get("filename")
            if not filename:
                continue
            link_meshes.append(LinkMesh(link_name, mesh_basename(filename), xyz, rpy))

    for joint_el in root.findall("joint"):
        parent_el = joint_el.find("parent")
        child_el = joint_el.find("child")
        if parent_el is None or child_el is None:
            continue

        xyz, rpy = origin_from_element(joint_el.find("origin"))
        axis_el = joint_el.find("axis")
        axis = parse_floats(axis_el.get("xyz") if axis_el is not None else None, 3, 0.0)
        if axis == [0.0, 0.0, 0.0]:
            axis = [0.0, 0.0, 1.0]

        joint = Joint(
            joint_el.get("name"),
            joint_el.get("type", "fixed"),
            parent_el.get("link"),
            child_el.get("link"),
            xyz,
            rpy,
            axis,
        )
        joints.append(joint)
        parent_to_joints.setdefault(joint.parent, []).append(joint)

    return {
        "joints": joints,
        "parent_to_joints": parent_to_joints,
        "link_meshes": link_meshes,
    }


def rpy_transform(roll, pitch, yaw):
    cr = math.cos(roll)
    sr = math.sin(roll)
    cp = math.cos(pitch)
    sp = math.sin(pitch)
    cy = math.cos(yaw)
    sy = math.sin(yaw)

    # URDF fixed-axis RPY: Rz(yaw) * Ry(pitch) * Rx(roll).
    t = rg.Transform.Identity
    t.M00 = cy * cp
    t.M01 = cy * sp * sr - sy * cr
    t.M02 = cy * sp * cr + sy * sr
    t.M10 = sy * cp
    t.M11 = sy * sp * sr + cy * cr
    t.M12 = sy * sp * cr - cy * sr
    t.M20 = -sp
    t.M21 = cp * sr
    t.M22 = cp * cr
    return t


def origin_transform(xyz, rpy, unit_scale):
    t = rpy_transform(rpy[0], rpy[1], rpy[2])
    t.M03 = xyz[0] * unit_scale
    t.M13 = xyz[1] * unit_scale
    t.M23 = xyz[2] * unit_scale
    return t


def axis_rotation_transform(axis, angle):
    axis_vec = rg.Vector3d(axis[0], axis[1], axis[2])
    if not axis_vec.Unitize():
        axis_vec = rg.Vector3d(0.0, 0.0, 1.0)
    return rg.Transform.Rotation(angle, axis_vec, rg.Point3d.Origin)


def base_transform(plane):
    if plane is None:
        return rg.Transform.Identity
    return rg.Transform.PlaneToPlane(rg.Plane.WorldXY, plane)


def transform_to_plane(xform):
    origin = rg.Point3d.Origin
    x_axis = rg.Vector3d.XAxis
    y_axis = rg.Vector3d.YAxis
    origin.Transform(xform)
    x_axis.Transform(xform)
    y_axis.Transform(xform)
    return rg.Plane(origin, x_axis, y_axis)


def frame_plane_from_links(link_xforms, link_candidates):
    for link_name in link_candidates:
        if link_name in link_xforms:
            return transform_to_plane(link_xforms[link_name]), link_name
    return None, ""


def natural_joint_key(joint):
    if joint.name and joint.name.startswith("joint"):
        tail = joint.name[5:]
        if tail.isdigit():
            return int(tail)
    return 9999


def read_stl_mesh(path):
    with open(path, "rb") as f:
        data = f.read()

    if len(data) < 84:
        raise ValueError("STL file is too small: " + path)

    tri_count = struct.unpack("<I", data[80:84])[0]
    expected_size = 84 + tri_count * 50
    if expected_size == len(data):
        return read_binary_stl(data)
    return read_ascii_stl(data)


def read_binary_stl(data):
    mesh = rg.Mesh()
    tri_count = struct.unpack("<I", data[80:84])[0]
    offset = 84
    for _i in range(tri_count):
        vals = struct.unpack("<12f", data[offset:offset + 48])
        p0 = rg.Point3d(vals[3], vals[4], vals[5])
        p1 = rg.Point3d(vals[6], vals[7], vals[8])
        p2 = rg.Point3d(vals[9], vals[10], vals[11])
        idx = mesh.Vertices.Count
        mesh.Vertices.Add(p0)
        mesh.Vertices.Add(p1)
        mesh.Vertices.Add(p2)
        mesh.Faces.AddFace(idx, idx + 1, idx + 2)
        offset += 50
    mesh.Normals.ComputeNormals()
    mesh.Compact()
    return mesh


def read_ascii_stl(data):
    text = data.decode("utf-8", "ignore")
    mesh = rg.Mesh()
    triangle = []
    for line in text.splitlines():
        s = line.strip()
        if not s.startswith("vertex "):
            continue
        parts = s.split()
        triangle.append(rg.Point3d(float(parts[1]), float(parts[2]), float(parts[3])))
        if len(triangle) == 3:
            idx = mesh.Vertices.Count
            mesh.Vertices.Add(triangle[0])
            mesh.Vertices.Add(triangle[1])
            mesh.Vertices.Add(triangle[2])
            mesh.Faces.AddFace(idx, idx + 1, idx + 2)
            triangle = []
    mesh.Normals.ComputeNormals()
    mesh.Compact()
    return mesh


def cached_model(urdf, meshes_folder):
    key = ("ro1_visual_urdf", os.path.abspath(urdf), os.path.abspath(meshes_folder))
    if key in sc.sticky:
        return sc.sticky[key]

    model = parse_urdf(urdf)
    mesh_cache = {}
    for link_mesh in model["link_meshes"]:
        mesh_path = os.path.join(meshes_folder, link_mesh.mesh_name)
        if not os.path.exists(mesh_path):
            raise IOError("Mesh not found: " + mesh_path)
        if link_mesh.mesh_name not in mesh_cache:
            mesh_cache[link_mesh.mesh_name] = read_stl_mesh(mesh_path)

    model["mesh_cache"] = mesh_cache
    sc.sticky[key] = model
    return model


def compute_link_transforms(model, values, unit_scale, root_xform):
    revolute = [j for j in model["joints"] if j.joint_type in ("revolute", "continuous")]
    revolute.sort(key=natural_joint_key)

    joint_value_by_name = {}
    for i, joint in enumerate(revolute):
        joint_value_by_name[joint.name] = float(values[i]) if i < len(values) else 0.0

    link_xforms = {ROOT_LINK: root_xform}
    queue = [ROOT_LINK]
    while queue:
        parent = queue.pop(0)
        parent_xform = link_xforms[parent]
        for joint in model["parent_to_joints"].get(parent, []):
            t_origin = origin_transform(joint.xyz, joint.rpy, unit_scale)
            t_motion = rg.Transform.Identity
            if joint.joint_type in ("revolute", "continuous"):
                angle = joint_value_by_name.get(joint.name, 0.0)
                t_motion = axis_rotation_transform(joint.axis, angle)
            link_xforms[joint.child] = parent_xform * t_origin * t_motion
            queue.append(joint.child)

    return link_xforms, [j.name for j in revolute]


def reconstruct():
    if not urdf_path:
        raise ValueError("Connect urdf_path.")
    if not mesh_dir:
        raise ValueError("Connect mesh_dir.")

    resolved_urdf = os.path.abspath(urdf_path)
    resolved_mesh_dir = os.path.abspath(mesh_dir)
    if not os.path.exists(resolved_urdf):
        raise IOError("URDF not found: " + resolved_urdf)
    if not os.path.isdir(resolved_mesh_dir):
        raise IOError("Mesh directory not found: " + resolved_mesh_dir)

    unit_scale = float(scale)
    model = cached_model(resolved_urdf, resolved_mesh_dir)
    link_xforms, joint_order = compute_link_transforms(
        model,
        list(joint_rotations or []),
        unit_scale,
        base_transform(base_plane),
    )

    meshes = []
    names = []
    mesh_scale = rg.Transform.Scale(rg.Point3d.Origin, unit_scale)
    for link_mesh in model["link_meshes"]:
        if link_mesh.link_name not in link_xforms:
            continue
        mesh = model["mesh_cache"][link_mesh.mesh_name].DuplicateMesh()
        local_t = origin_transform(link_mesh.xyz, link_mesh.rpy, unit_scale)
        mesh.Transform(link_xforms[link_mesh.link_name] * local_t * mesh_scale)
        meshes.append(mesh)
        names.append(link_mesh.link_name)

    tcp_plane, tcp_link = frame_plane_from_links(link_xforms, TCP_LINK_CANDIDATES)
    faceplate_plane, faceplate_link = frame_plane_from_links(link_xforms, FACEPLATE_LINK_CANDIDATES)

    info = []
    info.append("URDF: " + resolved_urdf)
    info.append("Mesh dir: " + resolved_mesh_dir)
    info.append("Meshes: " + str(len(meshes)))
    info.append("Joint order: " + ", ".join(joint_order))
    info.append("TCP frame: " + (tcp_link or "not found"))
    info.append("TCP/faceplate frame: " + (faceplate_link or "not found"))
    return meshes, names, faceplate_plane, joint_order, "\n".join(info)


try:
    M, N, F, J, Info = reconstruct()
except Exception as e:
    M = []
    N = []
    F = None
    J = []
    Info = "ERROR: " + str(e)
# ---------- end python_3_script ----------
mesh = Mesh(python_3_script.M)

# ---- group: pos_X
number = Number(read_json_value.AsNumber)

# ---- group: pos_Y
number_2 = Number(read_json_value_2.AsNumber)

# ---- group: pos_Z
number_3 = Number(read_json_value_3.AsNumber)

# ---- group: rot_X
number_4 = Number(read_json_value_4.AsNumber)

# ---- group: rot_Y
number_5 = Number(read_json_value_5.AsNumber)

# ---- group: rot_Z
number_6 = Number(read_json_value_6.AsNumber)

# ---- group: rot_W
number_7 = Number(read_json_value_7.AsNumber)

# ----
ironpython_2_script_2 = IronPython2Script(x=number, y=number_2, z=number_3, qx=number_4, qy=number_5, qz=number_6, qw=number_7, scale=scale)  # -> X, Y, Z, P; inputs x: Double, y: Double, z: Double, qx: Double, qy: Double, qz: Double, qw: Double, scale: Double
# ---------- ironpython_2_script_2: IronPython ----------
import math

import Rhino.Geometry as rg


try:
    scale
except NameError:
    scale = 1000.0

try:
    conjugate
except NameError:
    conjugate = False


mag = math.sqrt(qx * qx + qy * qy + qz * qz + qw * qw)
if mag == 0:
    raise ValueError("Quaternion magnitude is zero.")

qx = qx / mag
qy = qy / mag
qz = qz / mag
qw = qw / mag

if conjugate:
    qx = -qx
    qy = -qy
    qz = -qz

origin = rg.Point3d(x * scale, y * scale, z * scale)

xx = qx * qx
yy = qy * qy
zz = qz * qz
xy = qx * qy
xz = qx * qz
yz = qy * qz
wx = qw * qx
wy = qw * qy
wz = qw * qz

m00 = 1 - 2 * (yy + zz)
m01 = 2 * (xy - wz)
m02 = 2 * (xz + wy)

m10 = 2 * (xy + wz)
m11 = 1 - 2 * (xx + zz)
m12 = 2 * (yz - wx)

m20 = 2 * (xz - wy)
m21 = 2 * (yz + wx)
m22 = 1 - 2 * (xx + yy)

X = rg.Vector3d(m00, m10, m20)
Y = rg.Vector3d(m01, m11, m21)
Z = rg.Vector3d(m02, m12, m22)

P = rg.Plane(origin, X, Y)
# ---------- end ironpython_2_script_2 ----------
construct_plane = ConstructPlane(Origin=ironpython_2_script_2.P, XAxis=ironpython_2_script_2.Z, YAxis=ironpython_2_script_2.Y)

panel_29 = Panel(file_path_3)

# ---- group: Faceplate plane
plane = Plane(construct_plane)

# ---- group: F frames
geometry = Geometry(python_3_script.F)

# ---- group: frames to end planes
preset_rotation = Slider(0, range=0..9)
python_3_script_2 = Python3Script(F=geometry, preset=preset_rotation, offset="0")  # -> out, EndPlane, BasePlane, Axes, Info; inputs F: list
# ---------- python_3_script_2: Python ----------
"""
GhPython helper: select RO1 joint-6/end plane and generate corrected mount planes
for the OnRobot 2FG7 gripper.

This is a diagnostic + production component.
It does NOT assume the problem is only a Y/Z flip. Instead it keeps the
joint-6 origin and lets you choose one of several right-handed mounting
orientation presets.

Inputs:
    F              RO1 visualizer F output, or one already-selected joint-6 plane
    preset         Optional integer/string preset. Default 0.
                   0 = raw joint-6 plane
                   1 = rotate +90 deg about local X
                   2 = rotate -90 deg about local X
                   3 = rotate +90 deg about local Y
                   4 = rotate -90 deg about local Y
                   6 = rotate 180 deg about local X
                   6 = rotate 180 deg about local Y
                   7 = rotate 180 deg about local Z
                   8 = swap Y/Z:   X, Z, -Y
                   9 = swap Y/Z v2:X, -Z, Y
    offset         Optional local offset distance, Rhino units. Default 0.
    offset_axis    Optional "X", "Y", or "Z". Default "Z".

Outputs:
    BasePlane      Plane to connect to OnRobot 2FG7 base_plane
    EndPlane       Same as BasePlane
    RawPlane       Unmodified selected joint-6 plane
    AllCandidates  10 candidate planes for quick preview
    Axes           Axis preview curves for BasePlane
    Info           Debug info
"""

import math
import Rhino.Geometry as rg

try:
    F
except NameError:
    F = None

try:
    preset
except NameError:
    preset = 0

try:
    offset
except NameError:
    offset = 0.0

try:
    offset_axis
except NameError:
    offset_axis = "Z"

JOINT6_INDEX = 6
AXIS_LEN = 120.0


def unwrap_gh(value):
    if value is None:
        return None
    if hasattr(value, "Value"):
        try:
            return value.Value
        except Exception:
            pass
    if hasattr(value, "ScriptVariable"):
        try:
            return value.ScriptVariable()
        except Exception:
            pass
    return value


def collect_planes(value):
    planes = []

    def walk(v):
        v = unwrap_gh(v)
        if v is None:
            return

        if isinstance(v, rg.Plane):
            planes.append(rg.Plane(v.Origin, v.XAxis, v.YAxis))
            return

        if hasattr(v, "Origin") and hasattr(v, "XAxis") and hasattr(v, "YAxis"):
            try:
                planes.append(rg.Plane(v.Origin, v.XAxis, v.YAxis))
                return
            except Exception:
                pass

        if hasattr(v, "Branches"):
            try:
                for branch in v.Branches:
                    walk(branch)
                return
            except Exception:
                pass

        if hasattr(v, "Paths") and hasattr(v, "Branch"):
            try:
                for path in v.Paths:
                    walk(v.Branch(path))
                return
            except Exception:
                pass

        if not isinstance(v, str):
            try:
                for item in v:
                    walk(item)
                return
            except Exception:
                pass

    walk(value)
    return planes


def dup(p):
    return rg.Plane(p.Origin, p.XAxis, p.YAxis)


def rotate_about(p, axis_name, degrees):
    q = dup(p)
    a = axis_name.upper()
    if a == "X":
        axis = q.XAxis
    elif a == "Y":
        axis = q.YAxis
    else:
        axis = q.ZAxis
    t = rg.Transform.Rotation(math.radians(degrees), axis, q.Origin)
    q.Transform(t)
    return q


def yz_swap_1(p):
    # X, Z, -Y. Plane constructor receives X and Y; Z is computed.
    x = rg.Vector3d(p.XAxis)
    y = rg.Vector3d(p.ZAxis)
    x.Unitize(); y.Unitize()
    return rg.Plane(p.Origin, x, y)


def yz_swap_2(p):
    # X, -Z, Y. Plane constructor receives X and Y; Z is computed.
    x = rg.Vector3d(p.XAxis)
    y = -rg.Vector3d(p.ZAxis)
    x.Unitize(); y.Unitize()
    return rg.Plane(p.Origin, x, y)


def make_candidates(raw):
    return [
        dup(raw),
        rotate_about(raw, "X", 90),
        rotate_about(raw, "X", -90),
        rotate_about(raw, "Y", 90),
        rotate_about(raw, "Y", -90),
        rotate_about(raw, "X", 180),
        rotate_about(raw, "Y", 180),
        rotate_about(raw, "Z", 180),
        yz_swap_1(raw),
        yz_swap_2(raw),
    ]


def coerce_int(value, default_value):
    value = unwrap_gh(value)
    try:
        return int(value)
    except Exception:
        try:
            return int(str(value).strip())
        except Exception:
            return default_value


def apply_offset(p, distance, axis_name):
    q = dup(p)
    d = float(distance or 0.0)
    if abs(d) <= 1e-9:
        return q
    a = str(axis_name or "Z").strip().upper()
    if a == "X":
        v = q.XAxis
    elif a == "Y":
        v = q.YAxis
    else:
        v = q.ZAxis
    q.Origin = q.Origin + v * d
    return q


def make_axes(p, length):
    o = p.Origin
    return [
        rg.LineCurve(o, o + p.XAxis * length),
        rg.LineCurve(o, o + p.YAxis * length),
        rg.LineCurve(o, o + p.ZAxis * length),
    ]


def solve():
    planes = collect_planes(F)
    if not planes:
        raise ValueError("Connect RO1 visualizer F output, or connect one selected joint-6 plane.")

    if len(planes) >= JOINT6_INDEX + 1:
        raw = planes[JOINT6_INDEX]
        selection_msg = "Selected true joint 6 as F[6]."
    else:
        raw = planes[0]
        selection_msg = "Only one plane received; using that plane directly. This is OK if it is already joint 6."

    candidates = make_candidates(raw)
    idx = coerce_int(preset, 0)
    if idx < 0 or idx >= len(candidates):
        idx = 0

    selected = apply_offset(candidates[idx], offset, offset_axis)

    labels = [
        "0 raw joint-6 plane",
        "1 rot +90 local X",
        "2 rot -90 local X",
        "3 rot +90 local Y",
        "4 rot -90 local Y",
        "6 rot 180 local X",
        "6 rot 180 local Y",
        "7 rot 180 local Z",
        "8 remap X,Z,-Y",
        "9 remap X,-Z,Y",
    ]

    info = []
    info.append("Received plane count: " + str(len(planes)))
    info.append(selection_msg)
    info.append("Using preset: " + labels[idx])
    info.append("offset: " + str(offset) + " along local " + str(offset_axis or "Z"))
    info.append("Candidate labels:")
    for label in labels:
        info.append("  " + label)

    return selected, selected, raw, candidates, make_axes(selected, AXIS_LEN), "\n".join(info)


try:
    BasePlane, EndPlane, RawPlane, AllCandidates, Axes, Info = solve()
except Exception as e:
    BasePlane = None
    EndPlane = None
    RawPlane = None
    AllCandidates = []
    Axes = []
    Info = "ERROR: " + str(e)
# ---------- end python_3_script_2 ----------
geometry_2 = Geometry(python_3_script_2.EndPlane)
geometry_3 = Geometry(python_3_script_2.Axes)

# ----
# PREVIEW DIGITAL TWIN
colour_swatch = ColourSwatch(SwatchColor=RGB(22, 20, 22))
custom_preview = CustomPreview(Geometry=mesh, Material=colour_swatch)

# ---- group: On Robot Gripper
value_list = ValueList({"out": outwards, "in": inwards}, selected="in")
file_path_4 = FilePath("C:\Users\yzheng\OneDrive - HKS Inc\Documents\GitHub\pickNplace\onrobot_2FG7_gripper_description\")
python_3_script_3 = Python3Script(
    package_path=file_path_4,
    stroke_mm=Slider(38, range=0..38),
    finger_configuration=value_list,
    scale=scale,
    base_plane=python_3_script_2.BasePlane)  # -> M, N, F, J, GripPlane, Info; inputs package_path: String, stroke_mm: String, open_ratio: String, finger_configuration: Double, base_plane: Plane
# ---------- python_3_script_3: Python ----------
"""GhPython helper: visualize and drive an OnRobot 2FG7 gripper from the provided description package.

Inputs expected in Grasshopper:
    package_path          Path to either:
                          1) onrobot_2FG7_gripper_description folder, or
                          2) onrobot_2FG7_gripper_description.zip
    stroke_mm             Total finger stroke/open amount in millimeters, 0..38.
                          0 = closed/reference, 38 = fully open/reference.
    open_ratio            Optional normalized open amount, 0..1. Used only if stroke_mm is None.
    finger_configuration  "outwards" or "inwards". Defaults to "outwards".
    scale                 Rhino unit scale from meters. Use 1000 for Rhino millimeters, 1 for meters.
    base_plane            Optional Rhino plane placing the gripper base_link in Rhino.
                          Connect your robot/end_effector_plane here.

Outputs:
    M          Transformed gripper meshes.
    N          Link names for each mesh.
    F          Mesh-centered link frames as Rhino planes.
    J          Joint names used by the virtual gripper.
    GripPlane  Approximate jaw-center / grasp reference plane.
    Info       Status/debug text.

Notes:
    - This is visualization/kinematic-preview only. It does not command the physical gripper.
    - The source package is Xacro, so this script uses the expanded 2FG7 link/joint values directly.
    - The STL files are authored in millimeters and referenced in Xacro with mesh scale="0.001 0.001 0.001".
      This script converts STL mm -> meters, then meters -> Rhino units through `scale`.
    - 2FG7 finger travel in the provided Xacro is 0.019 m per side, so total visual stroke is 38 mm.
    - Updated: output frames F are centered on the actual transformed mesh bounding boxes, not only the URDF link origins.
"""

import math
import os
import struct
import tempfile
import zipfile

import Rhino.Geometry as rg
import scriptcontext as sc


# -------------------------
# Grasshopper input defaults
# -------------------------
try:
    package_path
except NameError:
    package_path = None

try:
    stroke_mm
except NameError:
    stroke_mm = None

try:
    open_ratio
except NameError:
    open_ratio = None

try:
    finger_configuration
except NameError:
    finger_configuration = "outwards"

try:
    scale
except NameError:
    scale = 1000.0

try:
    base_plane
except NameError:
    base_plane = None


# -------------------------
# 2FG7 constants from Xacro
# -------------------------
ROOT_LINK = "base_link"
MAX_TRAVEL_M_PER_FINGER = 0.019
MAX_TOTAL_STROKE_MM = MAX_TRAVEL_M_PER_FINGER * 2.0 * 1000.0  # 38 mm
MESH_FILE_SCALE_TO_METERS = 0.001  # STL mm -> m, from Xacro mesh scale

# Joint origins are in meters, from onrobot_2fg7.xacro.
LEFT_JOINT_ORIGIN = [0.032239, -0.029494, 0.12005]
RIGHT_JOINT_ORIGIN = [-0.054361, -0.029494, 0.12005]
LEFT_AXIS = [-1.0, 0.0, 0.0]
RIGHT_AXIS = [1.0, 0.0, 0.0]

# Visual origins are in meters, from onrobot_2fg7.xacro.
VISUALS = [
    {
        "link": "base_link",
        "mesh_outwards": "base_link.stl",
        "mesh_inwards": "base_link.stl",
        "origin_xyz": [0.0, 0.0, 0.0],
        "origin_rpy": [0.0, 0.0, 0.0],
    },
    {
        "link": "left_finger_link",
        "mesh_outwards": "left_finger_link.stl",
        "mesh_inwards": os.path.join("inwards", "left_finger_link.stl"),
        "origin_xyz": [-0.032239, 0.029494, -0.12005],
        "origin_rpy": [0.0, 0.0, 0.0],
    },
    {
        "link": "right_finger_link",
        "mesh_outwards": "right_finger_link.stl",
        "mesh_inwards": os.path.join("inwards", "right_finger_link.stl"),
        "origin_xyz": [0.054361, 0.029494, -0.12005],
        "origin_rpy": [0.0, 0.0, 0.0],
    },
]


# -------------------------
# Math / transform helpers
# -------------------------
def clamp(value, low, high):
    return max(low, min(high, value))


def rpy_transform(roll, pitch, yaw):
    cr = math.cos(roll)
    sr = math.sin(roll)
    cp = math.cos(pitch)
    sp = math.sin(pitch)
    cy = math.cos(yaw)
    sy = math.sin(yaw)

    # URDF fixed-axis RPY: Rz(yaw) * Ry(pitch) * Rx(roll)
    t = rg.Transform.Identity
    t.M00 = cy * cp
    t.M01 = cy * sp * sr - sy * cr
    t.M02 = cy * sp * cr + sy * sr

    t.M10 = sy * cp
    t.M11 = sy * sp * sr + cy * cr
    t.M12 = sy * sp * cr - cy * sr

    t.M20 = -sp
    t.M21 = cp * sr
    t.M22 = cp * cr

    return t


def origin_transform(xyz, rpy, unit_scale):
    t = rpy_transform(rpy[0], rpy[1], rpy[2])
    t.M03 = xyz[0] * unit_scale
    t.M13 = xyz[1] * unit_scale
    t.M23 = xyz[2] * unit_scale
    return t


def prismatic_transform(axis, distance_m, unit_scale):
    return rg.Transform.Translation(
        rg.Vector3d(
            axis[0] * distance_m * unit_scale,
            axis[1] * distance_m * unit_scale,
            axis[2] * distance_m * unit_scale
        )
    )


def base_transform(plane):
    if plane is None:
        return rg.Transform.Identity
    return rg.Transform.PlaneToPlane(rg.Plane.WorldXY, plane)


def transform_to_plane(xform):
    origin = rg.Point3d.Origin
    x_axis = rg.Vector3d.XAxis
    y_axis = rg.Vector3d.YAxis

    origin.Transform(xform)
    x_axis.Transform(xform)
    y_axis.Transform(xform)

    if not x_axis.Unitize():
        x_axis = rg.Vector3d.XAxis
    if not y_axis.Unitize():
        y_axis = rg.Vector3d.YAxis

    return rg.Plane(origin, x_axis, y_axis)


def centered_mesh_plane(mesh, orientation_xform):
    """
    Plane origin = transformed mesh bounding-box center.
    Plane axes = orientation from the supplied orientation transform.

    This fixes the common URDF visual-offset issue:
    - link frame is at joint/link origin
    - visual mesh is offset by local visual origin
    - therefore the link frame does not always sit at visual mesh center
    """
    bbox = mesh.GetBoundingBox(True)
    center = bbox.Center

    x_axis = rg.Vector3d.XAxis
    y_axis = rg.Vector3d.YAxis

    x_axis.Transform(orientation_xform)
    y_axis.Transform(orientation_xform)

    if not x_axis.Unitize():
        x_axis = rg.Vector3d.XAxis
    if not y_axis.Unitize():
        y_axis = rg.Vector3d.YAxis

    return rg.Plane(center, x_axis, y_axis)


def mesh_center(mesh):
    bbox = mesh.GetBoundingBox(True)
    return bbox.Center


# -------------------------
# Package / mesh loading
# -------------------------
def resolve_package_folder(path):
    if not path:
        raise ValueError("Connect package_path to the 2FG7 folder or .zip file.")

    p = os.path.abspath(str(path))

    if os.path.isdir(p):
        # Accept either the package root or a parent containing the package root.
        if os.path.isdir(os.path.join(p, "meshes")):
            return p

        nested = os.path.join(p, "onrobot_2FG7_gripper_description")
        if os.path.isdir(os.path.join(nested, "meshes")):
            return nested

        raise IOError("Folder found, but no meshes folder was found: " + p)

    if os.path.isfile(p) and p.lower().endswith(".zip"):
        key = ("onrobot_2fg7_zip_extract", p, os.path.getmtime(p), os.path.getsize(p))

        if key in sc.sticky and os.path.isdir(sc.sticky[key]):
            return sc.sticky[key]

        extract_root = os.path.join(
            tempfile.gettempdir(),
            "onrobot_2fg7_gripper_description_extract"
        )

        if not os.path.isdir(extract_root):
            os.makedirs(extract_root)

        with zipfile.ZipFile(p, "r") as zf:
            zf.extractall(extract_root)

        candidate = os.path.join(extract_root, "onrobot_2FG7_gripper_description")

        if not os.path.isdir(os.path.join(candidate, "meshes")):
            raise IOError("Zip extracted, but package meshes folder was not found.")

        sc.sticky[key] = candidate
        return candidate

    raise IOError("package_path is not a folder or .zip file: " + p)


def read_stl_mesh(path):
    with open(path, "rb") as f:
        data = f.read()

    if len(data) < 84:
        raise ValueError("STL file is too small: " + path)

    tri_count = struct.unpack("<I", data[80:84])[0]
    expected_size = 84 + tri_count * 50

    if expected_size == len(data):
        return read_binary_stl(data)

    return read_ascii_stl(data)


def read_binary_stl(data):
    mesh = rg.Mesh()
    tri_count = struct.unpack("<I", data[80:84])[0]
    offset = 84

    for _i in range(tri_count):
        vals = struct.unpack("<12f", data[offset:offset + 48])

        p0 = rg.Point3d(vals[3], vals[4], vals[5])
        p1 = rg.Point3d(vals[6], vals[7], vals[8])
        p2 = rg.Point3d(vals[9], vals[10], vals[11])

        idx = mesh.Vertices.Count
        mesh.Vertices.Add(p0)
        mesh.Vertices.Add(p1)
        mesh.Vertices.Add(p2)
        mesh.Faces.AddFace(idx, idx + 1, idx + 2)

        offset += 50

    mesh.Normals.ComputeNormals()
    mesh.Compact()
    return mesh


def read_ascii_stl(data):
    text = data.decode("utf-8", "ignore")
    mesh = rg.Mesh()
    triangle = []

    for line in text.splitlines():
        s = line.strip()

        if not s.startswith("vertex "):
            continue

        parts = s.split()
        triangle.append(
            rg.Point3d(
                float(parts[1]),
                float(parts[2]),
                float(parts[3])
            )
        )

        if len(triangle) == 3:
            idx = mesh.Vertices.Count
            mesh.Vertices.Add(triangle[0])
            mesh.Vertices.Add(triangle[1])
            mesh.Vertices.Add(triangle[2])
            mesh.Faces.AddFace(idx, idx + 1, idx + 2)
            triangle = []

    mesh.Normals.ComputeNormals()
    mesh.Compact()
    return mesh


def cached_mesh(mesh_path):
    key = (
        "onrobot_2fg7_mesh",
        os.path.abspath(mesh_path),
        os.path.getmtime(mesh_path),
        os.path.getsize(mesh_path)
    )

    if key not in sc.sticky:
        sc.sticky[key] = read_stl_mesh(mesh_path)

    return sc.sticky[key]


# -------------------------
# Gripper reconstruction
# -------------------------
def get_stroke_distance_m():
    # Prefer stroke_mm. If it is not connected, use open_ratio.
    if stroke_mm is not None:
        total_stroke = float(stroke_mm)
    elif open_ratio is not None:
        total_stroke = float(open_ratio) * MAX_TOTAL_STROKE_MM
    else:
        total_stroke = 0.0

    total_stroke = clamp(total_stroke, 0.0, MAX_TOTAL_STROKE_MM)
    one_side_distance_m = (total_stroke * 0.5) / 1000.0

    return one_side_distance_m, total_stroke


def reconstruct():
    package_folder = resolve_package_folder(package_path)
    mesh_folder = os.path.join(package_folder, "meshes")

    if not os.path.isdir(mesh_folder):
        raise IOError("Mesh directory not found: " + mesh_folder)

    config = str(finger_configuration or "outwards").lower().strip()

    if config not in ("outwards", "inwards"):
        config = "outwards"

    unit_scale = float(scale)
    root_xform = base_transform(base_plane)
    one_side_distance_m, total_stroke = get_stroke_distance_m()

    # Base frame plus two prismatic finger frames.
    left_xform = (
        root_xform
        * origin_transform(LEFT_JOINT_ORIGIN, [0.0, 0.0, 0.0], unit_scale)
        * prismatic_transform(LEFT_AXIS, one_side_distance_m, unit_scale)
    )

    right_xform = (
        root_xform
        * origin_transform(RIGHT_JOINT_ORIGIN, [0.0, 0.0, 0.0], unit_scale)
        * prismatic_transform(RIGHT_AXIS, one_side_distance_m, unit_scale)
    )

    link_xforms = {
        "base_link": root_xform,
        "left_finger_link": left_xform,
        "right_finger_link": right_xform,
    }

    meshes = []
    names = []
    frames = []

    # The total mesh scale is: STL mm -> meters -> Rhino units.
    mesh_total_scale = MESH_FILE_SCALE_TO_METERS * unit_scale
    mesh_scale_xform = rg.Transform.Scale(rg.Point3d.Origin, mesh_total_scale)

    for visual in VISUALS:
        link_name = visual["link"]
        mesh_rel = visual["mesh_" + config]
        mesh_path = os.path.join(mesh_folder, mesh_rel)

        if not os.path.exists(mesh_path):
            raise IOError("Mesh not found: " + mesh_path)

        mesh = cached_mesh(mesh_path).DuplicateMesh()

        local_t = origin_transform(
            visual["origin_xyz"],
            visual["origin_rpy"],
            unit_scale
        )

        # Full visual transform includes:
        # link transform + URDF visual origin offset + mesh unit scale.
        mesh_xform = link_xforms[link_name] * local_t * mesh_scale_xform
        mesh.Transform(mesh_xform)

        meshes.append(mesh)
        names.append(link_name)

        # Updated:
        # Frame origin is centered on the transformed mesh.
        # Frame axes still follow the link transform orientation.
        frames.append(centered_mesh_plane(mesh, link_xforms[link_name]))

    # Updated GripPlane:
    # Center between the FRONT gripping ends of the two fingers, not whole mesh centers.
    # In this 2FG7 mesh orientation, the finger tips extend toward local/world negative Y after base transform.
    left_bbox = None
    right_bbox = None

    for mesh, name in zip(meshes, names):
        if name == "left_finger_link":
            left_bbox = mesh.GetBoundingBox(True)
        elif name == "right_finger_link":
            right_bbox = mesh.GetBoundingBox(True)

    if left_bbox is not None and right_bbox is not None:
        # X center between two fingers
        grip_x = (left_bbox.Center.X + right_bbox.Center.X) * 0.5

        # Y should be at the front/tip side, not the mesh center.
        # Use the more forward side of both finger bounding boxes.
        grip_y = min(left_bbox.Min.Y, right_bbox.Min.Y)

        # Z center between fingers
        grip_z = (left_bbox.Center.Z + right_bbox.Center.Z) * 0.5

        grip_center = rg.Point3d(grip_x, grip_y, grip_z)

        # Plane orientation follows base/root transform
        x_axis = rg.Vector3d.XAxis
        y_axis = rg.Vector3d.YAxis

        x_axis.Transform(root_xform)
        y_axis.Transform(root_xform)

        if not x_axis.Unitize():
            x_axis = rg.Vector3d.XAxis
        if not y_axis.Unitize():
            y_axis = rg.Vector3d.YAxis

        grip_plane = rg.Plane(grip_center, x_axis, y_axis)

    else:
        # Fallback: midpoint between the two prismatic joint origins.
        jaw_center = [
            (LEFT_JOINT_ORIGIN[0] + RIGHT_JOINT_ORIGIN[0]) * 0.5,
            (LEFT_JOINT_ORIGIN[1] + RIGHT_JOINT_ORIGIN[1]) * 0.5,
            (LEFT_JOINT_ORIGIN[2] + RIGHT_JOINT_ORIGIN[2]) * 0.5,
        ]

        grip_xform = root_xform * origin_transform(
            jaw_center,
            [0.0, 0.0, 0.0],
            unit_scale
        )

        grip_plane = transform_to_plane(grip_xform)

    info = []
    info.append("OnRobot 2FG7 gripper preview")
    info.append("Package: " + package_folder)
    info.append("Mesh dir: " + mesh_folder)
    info.append("Configuration: " + config)
    info.append("Total stroke_mm clamped: " + str(round(total_stroke, 4)) + " / " + str(MAX_TOTAL_STROKE_MM))
    info.append("Per-finger travel_m: " + str(round(one_side_distance_m, 6)) + " / " + str(MAX_TRAVEL_M_PER_FINGER))
    info.append("Joint order: left_finger_joint, right_finger_joint mimic")
    info.append("Meshes: " + str(len(meshes)))
    info.append("Frames F: mesh-centered planes using transformed mesh bounding boxes")
    info.append("GripPlane: midpoint between transformed left/right finger mesh centers")
    info.append("Connect base_plane to the robot end_effector_plane to attach this gripper to the RO1 preview.")

    return (
        meshes,
        names,
        frames,
        ["left_finger_joint", "right_finger_joint_mimic"],
        grip_plane,
        "\n".join(info)
    )


try:
    M, N, F, J, GripPlane, Info = reconstruct()

except Exception as e:
    M = []
    N = []
    F = []
    J = []
    GripPlane = None
    Info = "ERROR: " + str(e)
# ---------- end python_3_script_3 ----------
panel_30 = Panel(python_3_script_3.Info)
geometry_4 = Geometry(python_3_script_3.M)
custom_preview_2 = CustomPreview(Geometry=geometry_4, Material=ColourSwatch(SwatchColor=RGB(79, 79, 79)))

# ----
panel_31 = Panel(file_path_4)
geometry_5 = Geometry(python_3_script_3.GripPlane)
geometry_6 = Geometry(python_3_script_3.F)
