# Grasshopper definition 003-swiftlet-test-mcp.ghx (Grasshopper 1.0.8)
# plug-ins: BitmapPlus, Swiftlet

# ----
# MCP
# Define only input and output with agent
file_path = FilePath("C:\Users\yzheng\OneDrive - HKS Inc\Desktop\API_Keys\Standardbots.txt")
read_file = ReadFile(File=file_path, PerLineParse=False)
bearer_token_auth = BearerTokenAuth(Token=read_file)

scale = Panel("1000")

# ----
# see-rhino-viewport
panel = Panel("Returns a Rhino viewport screenshot showing the rendered position of the robot arm in 3D space based on rotations of each joint. Helpful for understanding the overall state of the robot arm beyond the TCP.")
panel_2 = Panel("View o screenshot. Can be Perspective, Top, Right, or Front")
define_tool_parameter = DefineToolParameter(Name="view_name", Type="string", Description=panel_2, Required=True)
define_tool = DefineTool(Name="see-rhino-viewport", Description=panel, Parameters=define_tool_parameter)

# ----
# operate-grip
panel_3 = Panel("operate-grip")
panel_4 = Panel("Opens and closes the grip tool. Useful for grasping objects.")
panel_5 = Panel("Sets the distance between the two grip claws. Value of 0 means grip is fully closed. Value of 83 means the grip is fully open and the claws are 83 mm apart.")
define_tool_parameter_2 = DefineToolParameter(Name="grip_value", Type="number", Description=panel_5, Required=True)
define_tool_2 = DefineTool(Name=panel_3, Description=panel_4, Parameters=define_tool_parameter_2)

# ----
# get-current-tool-position
panel_6 = Panel("get-crrent-tool-position")
define_tool_3 = DefineTool(Name=panel_6, Description="Returns the current position of a tool in 3D space", Parameters=define_tool_parameter_2)

# ----
# move-tcp
panel_7 = Panel("Quaternion X")
panel_8 = Panel("Move the Target Center Point of the robotic arm to a target location and orientation. NOTE: this robot can't handle large dramatic moves. If the target is too far from current position, the robot will throw an error. Try breaking up large motions into several smaller steps.")
define_tool_parameter_3 = DefineToolParameter(Name="orientation_w", Type="number", Description="Quaternion W", Required=True)
define_tool_parameter_4 = DefineToolParameter(Name="orientation_x", Type="number", Description=panel_7, Required=True)
define_tool_parameter_5 = DefineToolParameter(Name="orientation_z", Type="number", Description="Quaternion Z", Required=True)
define_tool_parameter_6 = DefineToolParameter(Name="position_x", Type="number", Description="Target position X in meters", Required=True)
define_tool_parameter_7 = DefineToolParameter(Name="position_z", Type="number", Description="Target position Z in meters", Required=True)
define_tool_parameter_8 = DefineToolParameter(Name="orientation_y", Type="number", Description="Quaternion Y", Required=True)
define_tool_parameter_9 = DefineToolParameter(Name="position_y", Type="number", Description="Target position Y in meters", Required=True)
merge = Merge(
    Data1=define_tool_parameter_6,
    Data2=define_tool_parameter_9,
    Data3=define_tool_parameter_7,
    Data4=define_tool_parameter_4,
    Data5=define_tool_parameter_8,
    Data6=define_tool_parameter_5,
    Data7=define_tool_parameter_3)
define_tool_4 = DefineTool(Name="move-tcp", Description=panel_8, Parameters=merge)

# ----
# SET-CONTROL-MODE
panel_9 = Panel("Use this tool when an action fails and the arm is stuck in the breaked mode. Setting control mode should unbreak it.")
define_tool_5 = DefineTool(Name="set-control-mode", Description=panel_9, Parameters=merge)

# ----
# VIEW-ROBOT-CAMERA
panel_10 = Panel("Get an image from the robot's on-board camera")
define_tool_6 = DefineTool(Name="view-robot-camera", Description=panel_10)

# ----
# set correct mcp agent
merge_2 = Merge(
    Data1=define_tool_2,
    Data2=define_tool_3,
    Data3=define_tool,
    Data4=define_tool_4,
    Data5=define_tool_5,
    Data6=define_tool_6)
mcp_server = MCPServer(Port=3001, Tools=merge_2, ServerName="Swiftlet")  # -> OperateGrip, GetCrrentToolPosition, SeeRhinoViewport, MoveTcp, ViewRobotCamera, SetControlMode

# ----
# DEFINE TOOLS TO AGENT
# future: add fallbacks conditions
panel_11 = Panel(merge_2)
panel_12 = Panel(mcp_server.SeeRhinoViewport)
deconstruct_tool_call = DeconstructToolCall(Request=mcp_server.SeeRhinoViewport)  # -> Request, Tool, Arguments

deconstruct_tool_call_2 = DeconstructToolCall(Request=mcp_server.OperateGrip)  # -> Request, Tool, Arguments

# ----
# Translate MCP tool to HTTP
panel_13 = Panel("grip_value")
get_json_object_key = GetJSONObjectKey(JObject=deconstruct_tool_call_2.Arguments, Key=panel_13)
read_json_value = ReadJSONValue(JValue=get_json_object_key)  # -> AsString, AsNumber, AsBool
panel_14 = Panel(read_json_value.AsNumber)
create_json_value = CreateJSONValue(Value=read_json_value.AsNumber)
create_json_value_2 = CreateJSONValue(Value="millimeters")
panel_15 = Panel("""unit_kind
value""")
merge_3 = Merge(Data1=create_json_value_2, Data2=create_json_value)
create_json_object = CreateJSONObject(Keys=panel_15, Values=merge_3)
create_json_value_3 = CreateJSONValue(Value="move")
create_json_value_4 = CreateJSONValue(Value="internal")
merge_4 = Merge(Data1=create_json_value_3, Data2=create_json_object, Data3=create_json_value_4)
panel_16 = Panel("""control_kind
target_grip_width
grip_direction""")
create_json_value_5 = CreateJSONValue(Value="onrobot_2fg7")
create_json_object_2 = CreateJSONObject(Keys=panel_16, Values=merge_4)
panel_17 = Panel("""kind
onrobot_2fg7""")
merge_5 = Merge(Data1=create_json_value_5, Data2=create_json_object_2)
create_json_object_3 = CreateJSONObject(Keys=panel_17, Values=merge_5)
panel_18 = Panel("https://cb2347.sb.app/api/v1/equipment/end-effector/control")
null_item = NullItem(Item=deconstruct_tool_call.Request)  # -> NullFlags, InvalidFlags, Description
stringify_json_token = StringifyJSONToken(JToken=create_json_object_3)
dispatch = Dispatch(List=bearer_token_auth, DispatchPattern=null_item.NullFlags)  # -> ListA, ListB
panel_19 = Panel(stringify_json_token)
create_text_body = CreateTextBody(
    Content=stringify_json_token,
    IsHtmlChecked=False,
    IsJavascriptChecked=False,
    IsJsonChecked=True,
    IsTextChecked=False,
    IsXmlChecked=False)
post_request = POSTRequest(URL=panel_18, Body=create_text_body, Headers=dispatch.ListB, TimeoutSeconds=100)  # -> Status, Content, Response
panel_20 = Panel(post_request.Content)
panel_21 = Panel(post_request.Status)
equality = Equality(FirstNumber=post_request.Status, SecondNumber="200")  # -> Equality, Inequality
create_json_value_6 = CreateJSONValue(Value=equality.Equality)
create_json_object_4 = CreateJSONObject(Keys="success", Values=create_json_value_6)
stringify_json_token_2 = StringifyJSONToken(JToken=create_json_object_4)
create_mcp_text_content = CreateMCPTextContent(Text=stringify_json_token_2)

panel_22 = Panel("""brightness
contrast
exposure
sharpness
hue
whiteBalance
autoWhiteBalance""")  # disabled
auto_white_balance = BooleanToggle(True)  # disabled
bightness = Slider(50, range=0..100)  # disabled
contrast = Slider(50, range=0..100)  # disabled
exposure = Slider(100, range=0..100)  # disabled
sharpness = Slider(50, range=0..100)  # disabled
hue = Slider(0, range=0..100)  # disabled
white_balance = Slider(4000, range=0..10000)  # disabled
panel_23 = Panel("camera_settings")  # disabled
deconstruct_tool_call_3 = DeconstructToolCall()  # -> Request, Tool, Arguments; disabled
panel_24 = Panel("https://cb2347.sb.app/api/v1/camera/frame/rgb")  # disabled
create_json_value_7 = CreateJSONValue(Value=contrast)  # disabled
create_json_value_8 = CreateJSONValue(Value=bightness)  # disabled
create_json_value_9 = CreateJSONValue(Value=exposure)  # disabled
create_json_value_10 = CreateJSONValue(Value=sharpness)  # disabled
create_json_value_11 = CreateJSONValue(Value=hue)  # disabled
create_json_value_12 = CreateJSONValue(Value=white_balance)  # disabled
create_json_value_13 = CreateJSONValue(Value=auto_white_balance)  # disabled
merge_6 = Merge(
    Data1=create_json_value_8,
    Data2=create_json_value_7,
    Data3=create_json_value_9,
    Data4=create_json_value_10,
    Data5=create_json_value_11,
    Data6=create_json_value_12,
    Data7=create_json_value_13)  # disabled
null_item_2 = NullItem(Item=deconstruct_tool_call_3.Request)  # -> NullFlags, InvalidFlags, Description; disabled
create_json_object_5 = CreateJSONObject(Keys=panel_22, Values=merge_6)  # disabled
create_json_object_6 = CreateJSONObject(Keys=panel_23, Values=create_json_object_5)  # disabled
gate_not = GateNot(A=null_item_2.NullFlags)  # disabled
create_text_body_2 = CreateTextBody(
    Content=create_json_object_6,
    IsHtmlChecked=False,
    IsJavascriptChecked=False,
    IsJsonChecked=True,
    IsTextChecked=False,
    IsXmlChecked=False)  # disabled
number_slider = Slider(75, range=0..100)  # disabled
number_slider_2 = Slider(1024, range=0..10000)  # disabled
dispatch_2 = Dispatch(List=panel_24, DispatchPattern=gate_not)  # -> ListA, ListB; disabled
python_3_script = Python3Script(
    url=dispatch_2.ListA,
    brightness=bightness,
    contrast=contrast,
    exposure=exposure,
    sharpness=sharpness,
    hue=hue,
    white_balance=white_balance,
    auto_white_balance=auto_white_balance,
    max_width=number_slider_2,
    jpeg_quality=number_slider)  # -> img; inputs url: String, token: String, brightness: Double, contrast: Double, exposure: Double, sharpness: Double, hue: Double, white_balance: Double, auto_white_balance: Boolean, max_width: Double, jpeg_quality: Double; disabled
# ---------- python_3_script: Python ----------
import json
import base64
import urllib.request
from io import BytesIO

from PIL import Image

import System
import System.Drawing

def value_or(v, fallback):
    return fallback if v is None else v

try:
    max_width
except NameError:
    max_width = 1024

try:
    jpeg_quality
except NameError:
    jpeg_quality = 75

body = {
    "camera_settings": {
        "brightness": int(value_or(brightness, 50)),
        "contrast": int(value_or(contrast, 50)),
        "exposure": int(value_or(exposure, 100)),
        "sharpness": int(value_or(sharpness, 50)),
        "hue": int(value_or(hue, 0)),
        "whiteBalance": int(value_or(white_balance, 4000)),
        "autoWhiteBalance": bool(value_or(auto_white_balance, True)),
    }
}

payload = json.dumps(body).encode("utf-8")

req = urllib.request.Request(
    url,
    data=payload,
    method="GET",
    headers={
        "Authorization": "Bearer " + str(token),
        "robot-kind": "live",
        "Content-Type": "application/json",
        "Accept": "image/jpeg",
    },
)

with urllib.request.urlopen(req) as res:
    data = res.read()

text = data.decode("utf-8").strip()

if text.startswith("data:image"):
    b64 = text.split(",", 1)[1]
    jpeg_bytes = base64.b64decode(b64)
else:
    jpeg_bytes = data

original_byte_count = len(jpeg_bytes)

image = Image.open(BytesIO(jpeg_bytes)).convert("RGB")

if image.width > int(max_width):
    scale = float(max_width) / float(image.width)
    new_size = (int(image.width * scale), int(image.height * scale))
    image = image.resize(new_size, Image.LANCZOS)

out = BytesIO()
image.save(
    out,
    format="JPEG",
    quality=int(jpeg_quality),
    optimize=True,
)

compressed_bytes = out.getvalue()
compressed_b64 = base64.b64encode(compressed_bytes).decode("ascii")
mcp_image = "data:image/jpeg;base64," + compressed_b64

# Grasshopper preview bitmap
byte_array = System.Array[System.Byte](compressed_bytes)
stream = System.IO.MemoryStream(byte_array)
img = System.Drawing.Bitmap(stream)

byte_count = len(compressed_bytes)
width = image.width
height = image.height
# ---------- end python_3_script ----------
prev_image = PrevImage(SmartBitmap=python_3_script)  # disabled
create_mcp_image_content = CreateMCPImageContent(Bitmap=python_3_script, Format="png")  # disabled
mcp_tool_response = MCPToolResponse(Request=deconstruct_tool_call_3.Request, ContentBlocks=create_mcp_image_content, IsError=False)  # disabled

# ----
# see-rhino-viewport
clean_tree = CleanTree(RemoveNulls=True, RemoveInvalid=True, RemoveEmpty=False)  # disabled
data_recorder = DataRecorder(clean_tree, DataLimit=10, RecordData=True)  # disabled
list_item = ListItem(List=data_recorder, Index=0, Wrap=True)  # -> Item, Item1; disabled
deconstruct_tool_call_4 = DeconstructToolCall(Request=mcp_server.SeeRhinoViewport)  # -> Request, Tool, Arguments
get_json_object_key_2 = GetJSONObjectKey(JObject=deconstruct_tool_call_4.Arguments, Key="view_name")
read_json_value_2 = ReadJSONValue(JValue=get_json_object_key_2)  # -> AsString, AsNumber, AsBool
null_item_3 = NullItem(Item=read_json_value_2.AsString)  # -> NullFlags, InvalidFlags, Description
panel_25 = Panel(read_json_value_2.AsString)
gate_not_2 = GateNot(A=null_item_3.NullFlags)
screen_capture_viewport = ScreenCaptureViewport(Capture=gate_not_2, ViewportName=read_json_value_2.AsString)
create_mcp_image_content_2 = CreateMCPImageContent(Bitmap=screen_capture_viewport, Format="png")
mcp_tool_response_2 = MCPToolResponse(Request=deconstruct_tool_call_4.Request, ContentBlocks=create_mcp_image_content_2, IsError=False)
prev_image_2 = PrevImage(SmartBitmap=screen_capture_viewport)

# ----
# get-current-tool-position
clean_tree_2 = CleanTree(RemoveNulls=True, RemoveInvalid=True, RemoveEmpty=False)  # disabled
data_recorder_2 = DataRecorder(clean_tree_2, DataLimit=10, RecordData=True)  # disabled
list_item_2 = ListItem(List=data_recorder_2, Index=0, Wrap=True)  # -> Item, Item1; disabled
deconstruct_tool_call_5 = DeconstructToolCall()  # -> Request, Tool, Arguments; disabled
panel_26 = Panel("https://cb2347.sb.app/api/v1/movement/position/arm")  # disabled
null_item_4 = NullItem(Item=deconstruct_tool_call_5.Request)  # -> NullFlags, InvalidFlags, Description; disabled
dispatch_3 = Dispatch(List=panel_26, DispatchPattern=null_item_4.NullFlags)  # -> ListA, ListB; disabled
get_request = GETRequest(URL=dispatch_3.ListB, Headers=bearer_token_auth, TimeoutSeconds=100)  # -> Status, Content, Response; disabled
panel_27 = Panel("200")  # disabled
equality_2 = Equality(FirstNumber=get_request.Status, SecondNumber=panel_27)  # -> Equality, Inequality; disabled
create_mcp_text_content_2 = CreateMCPTextContent(Text=get_request.Content)  # disabled
mcp_tool_response_3 = MCPToolResponse(Request=deconstruct_tool_call_5.Request, ContentBlocks=create_mcp_text_content_2, IsError=equality_2.Inequality)  # disabled

panel_28 = Panel("C:\Users\yzheng\OneDrive - HKS Inc\Documents\GitHub\HKS_MADE_StandardBotsRO1\03_Example_Files\Grasshopper\temp_img\")
# fix: SwiftUI/MCP client call tools/call, decode the base64 image
# 
# try json
boolean_toggle = BooleanToggle(True)
save_bitmap = SaveBitmap(ImageBitmap=screen_capture_viewport, FolderPath=panel_28, FileName="temp_view", Extension=0, Save=boolean_toggle)
create_mcp_text_content_3 = CreateMCPTextContent(Text=save_bitmap)

# ----
# SPEED PROFILE
max_tooltip_speed = Slider(1, range=0..1)  # disabled
scaling_factor = Slider(1, range=0..1)  # disabled
create_json_value_14 = CreateJSONValue(Value=max_tooltip_speed)  # disabled
create_json_value_15 = CreateJSONValue(Value=scaling_factor)  # disabled
panel_29 = Panel("""scaling_factor
max_tooltip_speed""")  # disabled
merge_7 = Merge(Data1=create_json_value_15, Data2=create_json_value_14)  # disabled
create_json_object_7 = CreateJSONObject(Keys=panel_29, Values=merge_7)  # disabled

mcp_tool_response_4 = MCPToolResponse(Request=deconstruct_tool_call.Request, ContentBlocks=create_mcp_text_content, IsError=equality.Inequality)
panel_30 = Panel(mcp_tool_response_4)

file_path_2 = FilePath("C:\Users\yzheng\OneDrive - HKS Inc\Documents\GitHub\HKS_MADE_StandardBotsRO1\01_Hardware_Documentation\standard_bots_description\sbot.urdf")
file_path_3 = FilePath("C:\Users\yzheng\OneDrive - HKS Inc\Documents\GitHub\HKS_MADE_StandardBotsRO1\01_Hardware_Documentation\standard_bots_description\meshes\sbot\visual\")

clean_tree_3 = CleanTree(RemoveNulls=True, RemoveInvalid=True, RemoveEmpty=False)  # disabled
data_recorder_3 = DataRecorder(clean_tree_3, DataLimit=10, RecordData=True)  # disabled
list_item_3 = ListItem(List=data_recorder_3, Index=0, Wrap=True)  # -> Item, Item1; disabled
deconstruct_tool_call_6 = DeconstructToolCall()  # -> Request, Tool, Arguments; disabled
panel_31 = Panel("orientation_y")  # disabled
panel_32 = Panel("orientation_x")  # disabled
panel_33 = Panel("orientation_z")  # disabled
panel_34 = Panel("orientation_w")  # disabled
panel_35 = Panel("position_x")  # disabled
panel_36 = Panel("position_y")  # disabled
panel_37 = Panel("position_z")  # disabled
get_json_object_key_3 = GetJSONObjectKey(JObject=deconstruct_tool_call_6.Arguments, Key=panel_35)  # disabled
get_json_object_key_4 = GetJSONObjectKey(JObject=deconstruct_tool_call_6.Arguments, Key=panel_31)  # disabled
get_json_object_key_5 = GetJSONObjectKey(JObject=deconstruct_tool_call_6.Arguments, Key=panel_34)  # disabled
get_json_object_key_6 = GetJSONObjectKey(JObject=deconstruct_tool_call_6.Arguments, Key=panel_36)  # disabled
get_json_object_key_7 = GetJSONObjectKey(JObject=deconstruct_tool_call_6.Arguments, Key=panel_32)  # disabled
get_json_object_key_8 = GetJSONObjectKey(JObject=deconstruct_tool_call_6.Arguments, Key=panel_33)  # disabled
get_json_object_key_9 = GetJSONObjectKey(JObject=deconstruct_tool_call_6.Arguments, Key=panel_37)  # disabled
read_json_value_3 = ReadJSONValue(JValue=get_json_object_key_3)  # -> AsString, AsNumber, AsBool; disabled
read_json_value_4 = ReadJSONValue(JValue=get_json_object_key_4)  # -> AsString, AsNumber, AsBool; disabled
read_json_value_5 = ReadJSONValue(JValue=get_json_object_key_8)  # -> AsString, AsNumber, AsBool; disabled
read_json_value_6 = ReadJSONValue(JValue=get_json_object_key_5)  # -> AsString, AsNumber, AsBool; disabled
read_json_value_7 = ReadJSONValue(JValue=get_json_object_key_9)  # -> AsString, AsNumber, AsBool; disabled
read_json_value_8 = ReadJSONValue(JValue=get_json_object_key_7)  # -> AsString, AsNumber, AsBool; disabled
read_json_value_9 = ReadJSONValue(JValue=get_json_object_key_6)  # -> AsString, AsNumber, AsBool; disabled
panel_38 = Panel("tooltip_position")  # disabled
panel_39 = Panel("line")  # disabled
create_json_value_16 = CreateJSONValue(Value=panel_38)  # disabled
create_json_value_17 = CreateJSONValue(Value=panel_39)  # disabled
panel_40 = Panel("""kind
tooltip_position
movement_kind
speed_profile""")  # disabled
panel_41 = Panel("robot-kind")  # disabled
panel_42 = Panel("live")  # disabled
null_item_5 = NullItem(Item=deconstruct_tool_call_6.Request)  # -> NullFlags, InvalidFlags, Description; disabled
create_http_header = CreateHttpHeader(Key=panel_41, Value=panel_42)  # disabled
panel_43 = Panel("https://cb2347.sb.app/api/v1/movement/position/arm")  # disabled
merge_8 = Merge(Data1=bearer_token_auth, Data2=create_http_header)  # disabled
dispatch_4 = Dispatch(List=merge_8, DispatchPattern=null_item_5.NullFlags)  # -> ListA, ListB; disabled

# ----
# ORIENTATION
# QUATERNION
panel_44 = Panel("""x
y
z
w""")  # disabled
create_json_value_18 = CreateJSONValue(Value=read_json_value_8.AsNumber)  # disabled
create_json_value_19 = CreateJSONValue(Value=read_json_value_4.AsNumber)  # disabled
create_json_value_20 = CreateJSONValue(Value=read_json_value_5.AsNumber)  # disabled
create_json_value_21 = CreateJSONValue(Value=read_json_value_6.AsNumber)  # disabled
merge_9 = Merge(Data1=create_json_value_18, Data2=create_json_value_19, Data3=create_json_value_20, Data4=create_json_value_21)  # disabled
panel_45 = Panel("""kind
quaternion""")  # disabled
panel_46 = Panel("quaternion")  # disabled
create_json_value_22 = CreateJSONValue(Value=panel_46)  # disabled
create_json_object_8 = CreateJSONObject(Keys=panel_44, Values=merge_9)  # disabled
merge_10 = Merge(Data1=create_json_value_22, Data2=create_json_object_8)  # disabled
create_json_object_9 = CreateJSONObject(Keys=panel_45, Values=merge_10)  # disabled
panel_47 = Panel("orientation")  # disabled
create_json_object_10 = CreateJSONObject(Keys=panel_47, Values=create_json_object_9)  # disabled

# ----
# POSITION
panel_48 = Panel("""unit_kind
x
y
z""")  # disabled
panel_49 = Panel("meters")  # disabled
create_json_value_23 = CreateJSONValue(Value=panel_49)  # disabled
create_json_value_24 = CreateJSONValue(Value=read_json_value_3.AsNumber)  # disabled
create_json_value_25 = CreateJSONValue(Value=read_json_value_9.AsNumber)  # disabled
create_json_value_26 = CreateJSONValue(Value=read_json_value_7.AsNumber)  # disabled
merge_11 = Merge(Data1=create_json_value_23, Data2=create_json_value_24, Data3=create_json_value_25, Data4=create_json_value_26)  # disabled
create_json_object_11 = CreateJSONObject(Keys=panel_48, Values=merge_11)  # disabled

# ----
# TOOLTIP POSITION
panel_50 = Panel("base")  # disabled
panel_51 = Panel("base")  # disabled
create_json_value_27 = CreateJSONValue(Value=panel_50)  # disabled
create_json_value_28 = CreateJSONValue(Value=panel_51)  # disabled
panel_52 = Panel("""position
orientation
reference_frame
axis_alignment""")  # disabled
merge_12 = Merge(Data1=create_json_object_11, Data2=create_json_object_9, Data3=create_json_value_27, Data4=create_json_value_28)  # disabled
create_json_object_12 = CreateJSONObject(Keys=panel_52, Values=merge_12)  # disabled

merge_13 = Merge(Data1=create_json_value_16, Data2=create_json_object_12, Data3=create_json_value_17, Data4=create_json_object_7)  # disabled
create_json_object_13 = CreateJSONObject(Keys=panel_40, Values=merge_13)  # disabled
stringify_json_token_3 = StringifyJSONToken(JToken=create_json_object_13)  # disabled
target = Panel(stringify_json_token_3)  # disabled
parse_json_string = ParseJSONString(Text=stringify_json_token_3)  # disabled
create_text_body_3 = CreateTextBody(
    Content=parse_json_string,
    IsHtmlChecked=False,
    IsJavascriptChecked=False,
    IsJsonChecked=True,
    IsTextChecked=False,
    IsXmlChecked=False)  # disabled
post_request_2 = POSTRequest(URL=panel_43, Body=create_text_body_3, Headers=dispatch_4.ListB, TimeoutSeconds=100)  # -> Status, Content, Response; disabled
panel_53 = Panel(post_request_2.Content)  # disabled
create_mcp_text_content_4 = CreateMCPTextContent(Text=post_request_2.Content)  # disabled
mcp_tool_response_5 = MCPToolResponse(Request=deconstruct_tool_call_6.Request, ContentBlocks=create_mcp_text_content_4, IsError=False)  # disabled

deconstruct_tool_call_7 = DeconstructToolCall()  # -> Request, Tool, Arguments; disabled
null_item_6 = NullItem(Item=deconstruct_tool_call_7.Request)  # -> NullFlags, InvalidFlags, Description; disabled
gate_not_3 = GateNot(A=null_item_6.NullFlags)  # disabled

# ----
# SET CONTROL MODE
panel_54 = Panel("https://cb2347.sb.app/api/v1/status/control-mode")  # disabled
panel_55 = Panel("{ \"kind\" : \"api\" }")  # disabled
create_text_body_4 = CreateTextBody(
    Content=panel_55,
    IsHtmlChecked=False,
    IsJavascriptChecked=False,
    IsJsonChecked=True,
    IsTextChecked=False,
    IsXmlChecked=False)  # disabled

dispatch_5 = Dispatch(List=panel_54, DispatchPattern=gate_not_3)  # -> ListA, ListB; disabled

post_request_3 = POSTRequest(URL=dispatch_5.ListA, Body=create_text_body_4, Headers=bearer_token_auth, TimeoutSeconds=100)  # -> Status, Content, Response; disabled
panel_56 = Panel(post_request_3.Content)  # disabled

create_mcp_text_content_5 = CreateMCPTextContent(Text=post_request_3.Content)  # disabled
mcp_tool_response_6 = MCPToolResponse(Request=deconstruct_tool_call_7.Request, ContentBlocks=create_mcp_text_content_5, IsError=False)  # disabled

# ----
# GET
# ROBOT POSITION
panel_57 = Panel("https://cb2347.sb.app/api/v1/movement/position/arm")
trigger = Trigger(Interval=500, TimerInterval=500, Target=get_request_2)
get_request_2 = GETRequest(URL=panel_57, Headers=bearer_token_auth, TimeoutSeconds=100)  # -> Status, Content, Response
format_json_string = FormatJsonString(JSONString=get_request_2.Content)
parse_json_string_2 = ParseJSONString(Text=get_request_2.Content)
current = Panel(format_json_string)
get_json_object_key_10 = GetJSONObjectKey(JObject=parse_json_string_2, Key="tooltip_position")
get_json_object_key_11 = GetJSONObjectKey(JObject=get_json_object_key_10, Key="orientation")
get_json_object_key_12 = GetJSONObjectKey(JObject=get_json_object_key_10, Key="position")
get_json_object_key_13 = GetJSONObjectKey(JObject=get_json_object_key_11, Key="quaternion")
get_json_object_key_14 = GetJSONObjectKey(JObject=get_json_object_key_12, Key="x")
get_json_object_key_15 = GetJSONObjectKey(JObject=get_json_object_key_12, Key="y")
get_json_object_key_16 = GetJSONObjectKey(JObject=get_json_object_key_12, Key="z")
get_json_object_key_17 = GetJSONObjectKey(JObject=get_json_object_key_13, Key="x")
get_json_object_key_18 = GetJSONObjectKey(JObject=get_json_object_key_13, Key="y")
get_json_object_key_19 = GetJSONObjectKey(JObject=get_json_object_key_13, Key="z")
get_json_object_key_20 = GetJSONObjectKey(JObject=get_json_object_key_13, Key="w")
read_json_value_10 = ReadJSONValue(JValue=get_json_object_key_14)  # -> AsString, AsNumber, AsBool
read_json_value_11 = ReadJSONValue(JValue=get_json_object_key_15)  # -> AsString, AsNumber, AsBool
read_json_value_12 = ReadJSONValue(JValue=get_json_object_key_16)  # -> AsString, AsNumber, AsBool
read_json_value_13 = ReadJSONValue(JValue=get_json_object_key_17)  # -> AsString, AsNumber, AsBool
read_json_value_14 = ReadJSONValue(JValue=get_json_object_key_18)  # -> AsString, AsNumber, AsBool
read_json_value_15 = ReadJSONValue(JValue=get_json_object_key_19)  # -> AsString, AsNumber, AsBool
read_json_value_16 = ReadJSONValue(JValue=get_json_object_key_20)  # -> AsString, AsNumber, AsBool

# ----
# MESH FROM URDF
panel_58 = Panel("joint_rotations")
get_json_object_key_21 = GetJSONObjectKey(JObject=parse_json_string_2, Key=panel_58)
read_json_array = ReadJSONArray(Array=get_json_object_key_21)
read_json_value_17 = ReadJSONValue(JValue=read_json_array)  # -> AsString, AsNumber, AsBool
python_3_script_2 = Python3Script(
    joint_rotations=read_json_value_17.AsNumber,
    urdf_path=file_path_2,
    mesh_dir=file_path_3,
    scale=Slider(1000, range=0..1000))  # -> M, N, F, J, Info; inputs joint_rotations: list of Double, urdf_path: String, mesh_dir: String, scale: Double, base_plane: Plane
# ---------- python_3_script_2: Python ----------
"""GhPython helper: visualize the RO1 from URDF + STL meshes.

Inputs expected in Grasshopper:
    joint_rotations  List[float], six RO1 joint rotations in radians.
    urdf_path        Path to sbot.urdf.
    mesh_dir         Directory containing the visual STL files.
    scale            1000 for Rhino millimeters, 1 for meters.
    base_plane       Optional Rhino plane placing the URDF world frame in Rhino.

Outputs:
    M                Transformed link meshes.
    N                Link names for each mesh.
    F                TCP/faceplate frame as a Rhino plane (`tool0`/`flange`).
    J                Joint names in the order used by joint_rotations.
    Info             Status/debug text.

Notes:
    - This is visualization-only. It ignores collision geometry and primitive shapes.
    - The script honors the URDF world -> base_link fixed transform.
    - URDF and API units are meters. Use scale=1000 in a millimeter Rhino model.
"""

import math
import os
import struct
import xml.etree.ElementTree as ET

import Rhino.Geometry as rg
import scriptcontext as sc


try:
    joint_rotations
except NameError:
    joint_rotations = [0.0] * 6

try:
    urdf_path
except NameError:
    urdf_path = None

try:
    mesh_dir
except NameError:
    mesh_dir = None

try:
    scale
except NameError:
    scale = 1000.0

try:
    base_plane
except NameError:
    base_plane = None


ROOT_LINK = "world"
TCP_LINK_CANDIDATES = ("tool0", "flange")
FACEPLATE_LINK_CANDIDATES = ("tool0", "flange", "wrist_3_link")


class Joint(object):
    def __init__(self, name, joint_type, parent, child, xyz, rpy, axis):
        self.name = name
        self.joint_type = joint_type
        self.parent = parent
        self.child = child
        self.xyz = xyz
        self.rpy = rpy
        self.axis = axis


class LinkMesh(object):
    def __init__(self, link_name, mesh_name, xyz, rpy):
        self.link_name = link_name
        self.mesh_name = mesh_name
        self.xyz = xyz
        self.rpy = rpy


def parse_floats(text, count, default_value):
    if not text:
        return [default_value] * count
    vals = [float(v) for v in text.split()]
    while len(vals) < count:
        vals.append(default_value)
    return vals[:count]


def origin_from_element(element):
    if element is None:
        return [0.0, 0.0, 0.0], [0.0, 0.0, 0.0]
    return (
        parse_floats(element.get("xyz"), 3, 0.0),
        parse_floats(element.get("rpy"), 3, 0.0),
    )


def mesh_basename(filename):
    filename = filename.replace("\\", "/")
    return filename.split("/")[-1]


def parse_urdf(path):
    root = ET.parse(path).getroot()
    joints = []
    parent_to_joints = {}
    link_meshes = []

    for link_el in root.findall("link"):
        link_name = link_el.get("name")
        for visual_el in link_el.findall("visual"):
            xyz, rpy = origin_from_element(visual_el.find("origin"))
            mesh_el = visual_el.find("geometry/mesh")
            if mesh_el is None:
                continue
            filename = mesh_el.get("filename")
            if not filename:
                continue
            link_meshes.append(LinkMesh(link_name, mesh_basename(filename), xyz, rpy))

    for joint_el in root.findall("joint"):
        parent_el = joint_el.find("parent")
        child_el = joint_el.find("child")
        if parent_el is None or child_el is None:
            continue

        xyz, rpy = origin_from_element(joint_el.find("origin"))
        axis_el = joint_el.find("axis")
        axis = parse_floats(axis_el.get("xyz") if axis_el is not None else None, 3, 0.0)
        if axis == [0.0, 0.0, 0.0]:
            axis = [0.0, 0.0, 1.0]

        joint = Joint(
            joint_el.get("name"),
            joint_el.get("type", "fixed"),
            parent_el.get("link"),
            child_el.get("link"),
            xyz,
            rpy,
            axis,
        )
        joints.append(joint)
        parent_to_joints.setdefault(joint.parent, []).append(joint)

    return {
        "joints": joints,
        "parent_to_joints": parent_to_joints,
        "link_meshes": link_meshes,
    }


def rpy_transform(roll, pitch, yaw):
    cr = math.cos(roll)
    sr = math.sin(roll)
    cp = math.cos(pitch)
    sp = math.sin(pitch)
    cy = math.cos(yaw)
    sy = math.sin(yaw)

    # URDF fixed-axis RPY: Rz(yaw) * Ry(pitch) * Rx(roll).
    t = rg.Transform.Identity
    t.M00 = cy * cp
    t.M01 = cy * sp * sr - sy * cr
    t.M02 = cy * sp * cr + sy * sr
    t.M10 = sy * cp
    t.M11 = sy * sp * sr + cy * cr
    t.M12 = sy * sp * cr - cy * sr
    t.M20 = -sp
    t.M21 = cp * sr
    t.M22 = cp * cr
    return t


def origin_transform(xyz, rpy, unit_scale):
    t = rpy_transform(rpy[0], rpy[1], rpy[2])
    t.M03 = xyz[0] * unit_scale
    t.M13 = xyz[1] * unit_scale
    t.M23 = xyz[2] * unit_scale
    return t


def axis_rotation_transform(axis, angle):
    axis_vec = rg.Vector3d(axis[0], axis[1], axis[2])
    if not axis_vec.Unitize():
        axis_vec = rg.Vector3d(0.0, 0.0, 1.0)
    return rg.Transform.Rotation(angle, axis_vec, rg.Point3d.Origin)


def base_transform(plane):
    if plane is None:
        return rg.Transform.Identity
    return rg.Transform.PlaneToPlane(rg.Plane.WorldXY, plane)


def transform_to_plane(xform):
    origin = rg.Point3d.Origin
    x_axis = rg.Vector3d.XAxis
    y_axis = rg.Vector3d.YAxis
    origin.Transform(xform)
    x_axis.Transform(xform)
    y_axis.Transform(xform)
    return rg.Plane(origin, x_axis, y_axis)


def frame_plane_from_links(link_xforms, link_candidates):
    for link_name in link_candidates:
        if link_name in link_xforms:
            return transform_to_plane(link_xforms[link_name]), link_name
    return None, ""


def natural_joint_key(joint):
    if joint.name and joint.name.startswith("joint"):
        tail = joint.name[5:]
        if tail.isdigit():
            return int(tail)
    return 9999


def read_stl_mesh(path):
    with open(path, "rb") as f:
        data = f.read()

    if len(data) < 84:
        raise ValueError("STL file is too small: " + path)

    tri_count = struct.unpack("<I", data[80:84])[0]
    expected_size = 84 + tri_count * 50
    if expected_size == len(data):
        return read_binary_stl(data)
    return read_ascii_stl(data)


def read_binary_stl(data):
    mesh = rg.Mesh()
    tri_count = struct.unpack("<I", data[80:84])[0]
    offset = 84
    for _i in range(tri_count):
        vals = struct.unpack("<12f", data[offset:offset + 48])
        p0 = rg.Point3d(vals[3], vals[4], vals[5])
        p1 = rg.Point3d(vals[6], vals[7], vals[8])
        p2 = rg.Point3d(vals[9], vals[10], vals[11])
        idx = mesh.Vertices.Count
        mesh.Vertices.Add(p0)
        mesh.Vertices.Add(p1)
        mesh.Vertices.Add(p2)
        mesh.Faces.AddFace(idx, idx + 1, idx + 2)
        offset += 50
    mesh.Normals.ComputeNormals()
    mesh.Compact()
    return mesh


def read_ascii_stl(data):
    text = data.decode("utf-8", "ignore")
    mesh = rg.Mesh()
    triangle = []
    for line in text.splitlines():
        s = line.strip()
        if not s.startswith("vertex "):
            continue
        parts = s.split()
        triangle.append(rg.Point3d(float(parts[1]), float(parts[2]), float(parts[3])))
        if len(triangle) == 3:
            idx = mesh.Vertices.Count
            mesh.Vertices.Add(triangle[0])
            mesh.Vertices.Add(triangle[1])
            mesh.Vertices.Add(triangle[2])
            mesh.Faces.AddFace(idx, idx + 1, idx + 2)
            triangle = []
    mesh.Normals.ComputeNormals()
    mesh.Compact()
    return mesh


def cached_model(urdf, meshes_folder):
    key = ("ro1_visual_urdf", os.path.abspath(urdf), os.path.abspath(meshes_folder))
    if key in sc.sticky:
        return sc.sticky[key]

    model = parse_urdf(urdf)
    mesh_cache = {}
    for link_mesh in model["link_meshes"]:
        mesh_path = os.path.join(meshes_folder, link_mesh.mesh_name)
        if not os.path.exists(mesh_path):
            raise IOError("Mesh not found: " + mesh_path)
        if link_mesh.mesh_name not in mesh_cache:
            mesh_cache[link_mesh.mesh_name] = read_stl_mesh(mesh_path)

    model["mesh_cache"] = mesh_cache
    sc.sticky[key] = model
    return model


def compute_link_transforms(model, values, unit_scale, root_xform):
    revolute = [j for j in model["joints"] if j.joint_type in ("revolute", "continuous")]
    revolute.sort(key=natural_joint_key)

    joint_value_by_name = {}
    for i, joint in enumerate(revolute):
        joint_value_by_name[joint.name] = float(values[i]) if i < len(values) else 0.0

    link_xforms = {ROOT_LINK: root_xform}
    queue = [ROOT_LINK]
    while queue:
        parent = queue.pop(0)
        parent_xform = link_xforms[parent]
        for joint in model["parent_to_joints"].get(parent, []):
            t_origin = origin_transform(joint.xyz, joint.rpy, unit_scale)
            t_motion = rg.Transform.Identity
            if joint.joint_type in ("revolute", "continuous"):
                angle = joint_value_by_name.get(joint.name, 0.0)
                t_motion = axis_rotation_transform(joint.axis, angle)
            link_xforms[joint.child] = parent_xform * t_origin * t_motion
            queue.append(joint.child)

    return link_xforms, [j.name for j in revolute]


def reconstruct():
    if not urdf_path:
        raise ValueError("Connect urdf_path.")
    if not mesh_dir:
        raise ValueError("Connect mesh_dir.")

    resolved_urdf = os.path.abspath(urdf_path)
    resolved_mesh_dir = os.path.abspath(mesh_dir)
    if not os.path.exists(resolved_urdf):
        raise IOError("URDF not found: " + resolved_urdf)
    if not os.path.isdir(resolved_mesh_dir):
        raise IOError("Mesh directory not found: " + resolved_mesh_dir)

    unit_scale = float(scale)
    model = cached_model(resolved_urdf, resolved_mesh_dir)
    link_xforms, joint_order = compute_link_transforms(
        model,
        list(joint_rotations or []),
        unit_scale,
        base_transform(base_plane),
    )

    meshes = []
    names = []
    mesh_scale = rg.Transform.Scale(rg.Point3d.Origin, unit_scale)
    for link_mesh in model["link_meshes"]:
        if link_mesh.link_name not in link_xforms:
            continue
        mesh = model["mesh_cache"][link_mesh.mesh_name].DuplicateMesh()
        local_t = origin_transform(link_mesh.xyz, link_mesh.rpy, unit_scale)
        mesh.Transform(link_xforms[link_mesh.link_name] * local_t * mesh_scale)
        meshes.append(mesh)
        names.append(link_mesh.link_name)

    tcp_plane, tcp_link = frame_plane_from_links(link_xforms, TCP_LINK_CANDIDATES)
    faceplate_plane, faceplate_link = frame_plane_from_links(link_xforms, FACEPLATE_LINK_CANDIDATES)

    info = []
    info.append("URDF: " + resolved_urdf)
    info.append("Mesh dir: " + resolved_mesh_dir)
    info.append("Meshes: " + str(len(meshes)))
    info.append("Joint order: " + ", ".join(joint_order))
    info.append("TCP frame: " + (tcp_link or "not found"))
    info.append("TCP/faceplate frame: " + (faceplate_link or "not found"))
    return meshes, names, faceplate_plane, joint_order, "\n".join(info)


try:
    M, N, F, J, Info = reconstruct()
except Exception as e:
    M = []
    N = []
    F = None
    J = []
    Info = "ERROR: " + str(e)
# ---------- end python_3_script_2 ----------
mesh = Mesh(python_3_script_2.M)

# ---- group: pos_X
number = Number(read_json_value_10.AsNumber)

# ---- group: pos_Y
number_2 = Number(read_json_value_11.AsNumber)

# ---- group: pos_Z
number_3 = Number(read_json_value_12.AsNumber)

# ---- group: rot_X
number_4 = Number(read_json_value_13.AsNumber)

# ---- group: rot_Y
number_5 = Number(read_json_value_14.AsNumber)

# ---- group: rot_Z
number_6 = Number(read_json_value_15.AsNumber)

# ---- group: rot_W
number_7 = Number(read_json_value_16.AsNumber)

# ----
ironpython_2_script = IronPython2Script(x=number, y=number_2, z=number_3, qx=number_4, qy=number_5, qz=number_6, qw=number_7, scale=scale)  # -> X, Y, Z, P; inputs x: Double, y: Double, z: Double, qx: Double, qy: Double, qz: Double, qw: Double, scale: Double
# ---------- ironpython_2_script: IronPython ----------
import math

import Rhino.Geometry as rg


try:
    scale
except NameError:
    scale = 1000.0

try:
    conjugate
except NameError:
    conjugate = False


mag = math.sqrt(qx * qx + qy * qy + qz * qz + qw * qw)
if mag == 0:
    raise ValueError("Quaternion magnitude is zero.")

qx = qx / mag
qy = qy / mag
qz = qz / mag
qw = qw / mag

if conjugate:
    qx = -qx
    qy = -qy
    qz = -qz

origin = rg.Point3d(x * scale, y * scale, z * scale)

xx = qx * qx
yy = qy * qy
zz = qz * qz
xy = qx * qy
xz = qx * qz
yz = qy * qz
wx = qw * qx
wy = qw * qy
wz = qw * qz

m00 = 1 - 2 * (yy + zz)
m01 = 2 * (xy - wz)
m02 = 2 * (xz + wy)

m10 = 2 * (xy + wz)
m11 = 1 - 2 * (xx + zz)
m12 = 2 * (yz - wx)

m20 = 2 * (xz - wy)
m21 = 2 * (yz + wx)
m22 = 1 - 2 * (xx + yy)

X = rg.Vector3d(m00, m10, m20)
Y = rg.Vector3d(m01, m11, m21)
Z = rg.Vector3d(m02, m12, m22)

P = rg.Plane(origin, X, Y)
# ---------- end ironpython_2_script ----------
construct_plane = ConstructPlane(Origin=ironpython_2_script.P, XAxis=ironpython_2_script.Z, YAxis=ironpython_2_script.Y)

# ---- group: Faceplate plane
plane = Plane(construct_plane)

# ----
# PREVIEW DIGITAL TWIN
colour_swatch = ColourSwatch(SwatchColor=RGB(22, 20, 22))
custom_preview = CustomPreview(Geometry=mesh, Material=colour_swatch)
