# Grasshopper definition URDF_OnRobot_Gripper.gh (Grasshopper 1.0.8)

# ---- group: F frames
# Download URDF:
# https://github.com/juandpenan/onrobot_2FG7_gripper_description
geometry = Geometry()

# ---- group: frames to end planes
preset_rotation = Slider(4, range=0..9)
python_3_script = Python3Script(F=geometry, preset=preset_rotation, offset="0")  # -> out, EndPlane, BasePlane, Axes, Info; inputs F: list
# ---------- python_3_script: Python ----------
"""
GhPython helper: select RO1 joint-6/end plane and generate corrected mount planes
for the OnRobot 2FG7 gripper.

This is a diagnostic + production component.
It does NOT assume the problem is only a Y/Z flip. Instead it keeps the
joint-6 origin and lets you choose one of several right-handed mounting
orientation presets.

Inputs:
    F              RO1 visualizer F output, or one already-selected joint-6 plane
    preset         Optional integer/string preset. Default 0.
                   0 = raw joint-6 plane
                   1 = rotate +90 deg about local X
                   2 = rotate -90 deg about local X
                   3 = rotate +90 deg about local Y
                   4 = rotate -90 deg about local Y
                   6 = rotate 180 deg about local X
                   6 = rotate 180 deg about local Y
                   7 = rotate 180 deg about local Z
                   8 = swap Y/Z:   X, Z, -Y
                   9 = swap Y/Z v2:X, -Z, Y
    offset         Optional local offset distance, Rhino units. Default 0.
    offset_axis    Optional "X", "Y", or "Z". Default "Z".

Outputs:
    BasePlane      Plane to connect to OnRobot 2FG7 base_plane
    EndPlane       Same as BasePlane
    RawPlane       Unmodified selected joint-6 plane
    AllCandidates  10 candidate planes for quick preview
    Axes           Axis preview curves for BasePlane
    Info           Debug info
"""

import math
import Rhino.Geometry as rg

try:
    F
except NameError:
    F = None

try:
    preset
except NameError:
    preset = 0

try:
    offset
except NameError:
    offset = 0.0

try:
    offset_axis
except NameError:
    offset_axis = "Z"

JOINT6_INDEX = 6
AXIS_LEN = 120.0


def unwrap_gh(value):
    if value is None:
        return None
    if hasattr(value, "Value"):
        try:
            return value.Value
        except Exception:
            pass
    if hasattr(value, "ScriptVariable"):
        try:
            return value.ScriptVariable()
        except Exception:
            pass
    return value


def collect_planes(value):
    planes = []

    def walk(v):
        v = unwrap_gh(v)
        if v is None:
            return

        if isinstance(v, rg.Plane):
            planes.append(rg.Plane(v.Origin, v.XAxis, v.YAxis))
            return

        if hasattr(v, "Origin") and hasattr(v, "XAxis") and hasattr(v, "YAxis"):
            try:
                planes.append(rg.Plane(v.Origin, v.XAxis, v.YAxis))
                return
            except Exception:
                pass

        if hasattr(v, "Branches"):
            try:
                for branch in v.Branches:
                    walk(branch)
                return
            except Exception:
                pass

        if hasattr(v, "Paths") and hasattr(v, "Branch"):
            try:
                for path in v.Paths:
                    walk(v.Branch(path))
                return
            except Exception:
                pass

        if not isinstance(v, str):
            try:
                for item in v:
                    walk(item)
                return
            except Exception:
                pass

    walk(value)
    return planes


def dup(p):
    return rg.Plane(p.Origin, p.XAxis, p.YAxis)


def rotate_about(p, axis_name, degrees):
    q = dup(p)
    a = axis_name.upper()
    if a == "X":
        axis = q.XAxis
    elif a == "Y":
        axis = q.YAxis
    else:
        axis = q.ZAxis
    t = rg.Transform.Rotation(math.radians(degrees), axis, q.Origin)
    q.Transform(t)
    return q


def yz_swap_1(p):
    # X, Z, -Y. Plane constructor receives X and Y; Z is computed.
    x = rg.Vector3d(p.XAxis)
    y = rg.Vector3d(p.ZAxis)
    x.Unitize(); y.Unitize()
    return rg.Plane(p.Origin, x, y)


def yz_swap_2(p):
    # X, -Z, Y. Plane constructor receives X and Y; Z is computed.
    x = rg.Vector3d(p.XAxis)
    y = -rg.Vector3d(p.ZAxis)
    x.Unitize(); y.Unitize()
    return rg.Plane(p.Origin, x, y)


def make_candidates(raw):
    return [
        dup(raw),
        rotate_about(raw, "X", 90),
        rotate_about(raw, "X", -90),
        rotate_about(raw, "Y", 90),
        rotate_about(raw, "Y", -90),
        rotate_about(raw, "X", 180),
        rotate_about(raw, "Y", 180),
        rotate_about(raw, "Z", 180),
        yz_swap_1(raw),
        yz_swap_2(raw),
    ]


def coerce_int(value, default_value):
    value = unwrap_gh(value)
    try:
        return int(value)
    except Exception:
        try:
            return int(str(value).strip())
        except Exception:
            return default_value


def apply_offset(p, distance, axis_name):
    q = dup(p)
    d = float(distance or 0.0)
    if abs(d) <= 1e-9:
        return q
    a = str(axis_name or "Z").strip().upper()
    if a == "X":
        v = q.XAxis
    elif a == "Y":
        v = q.YAxis
    else:
        v = q.ZAxis
    q.Origin = q.Origin + v * d
    return q


def make_axes(p, length):
    o = p.Origin
    return [
        rg.LineCurve(o, o + p.XAxis * length),
        rg.LineCurve(o, o + p.YAxis * length),
        rg.LineCurve(o, o + p.ZAxis * length),
    ]


def solve():
    planes = collect_planes(F)
    if not planes:
        raise ValueError("Connect RO1 visualizer F output, or connect one selected joint-6 plane.")

    if len(planes) >= JOINT6_INDEX + 1:
        raw = planes[JOINT6_INDEX]
        selection_msg = "Selected true joint 6 as F[6]."
    else:
        raw = planes[0]
        selection_msg = "Only one plane received; using that plane directly. This is OK if it is already joint 6."

    candidates = make_candidates(raw)
    idx = coerce_int(preset, 0)
    if idx < 0 or idx >= len(candidates):
        idx = 0

    selected = apply_offset(candidates[idx], offset, offset_axis)

    labels = [
        "0 raw joint-6 plane",
        "1 rot +90 local X",
        "2 rot -90 local X",
        "3 rot +90 local Y",
        "4 rot -90 local Y",
        "6 rot 180 local X",
        "6 rot 180 local Y",
        "7 rot 180 local Z",
        "8 remap X,Z,-Y",
        "9 remap X,-Z,Y",
    ]

    info = []
    info.append("Received plane count: " + str(len(planes)))
    info.append(selection_msg)
    info.append("Using preset: " + labels[idx])
    info.append("offset: " + str(offset) + " along local " + str(offset_axis or "Z"))
    info.append("Candidate labels:")
    for label in labels:
        info.append("  " + label)

    return selected, selected, raw, candidates, make_axes(selected, AXIS_LEN), "\n".join(info)


try:
    BasePlane, EndPlane, RawPlane, AllCandidates, Axes, Info = solve()
except Exception as e:
    BasePlane = None
    EndPlane = None
    RawPlane = None
    AllCandidates = []
    Axes = []
    Info = "ERROR: " + str(e)
# ---------- end python_3_script ----------
geometry_2 = Geometry(python_3_script.Axes)
geometry_3 = Geometry(python_3_script.EndPlane)

# ----
data = Data()

# ---- group: On Robot Gripper
value_list = ValueList({"out": outwards, "in": inwards}, selected="in")
file_path = FilePath("C:\Users\yzheng\OneDrive - HKS Inc\Documents\GitHub\onrobot_2FG7_gripper_description\")
python_3_script_2 = Python3Script(
    package_path=file_path,
    stroke_mm=Slider(4, range=0..38),
    finger_configuration=value_list,
    scale=data,
    base_plane=python_3_script.BasePlane)  # -> M, N, F, J, GripPlane, Info; inputs package_path: String, stroke_mm: String, open_ratio: String, finger_configuration: Double, base_plane: Plane
# ---------- python_3_script_2: Python ----------
"""GhPython helper: visualize and drive an OnRobot 2FG7 gripper from the provided description package.

Inputs expected in Grasshopper:
    package_path          Path to either:
                          1) onrobot_2FG7_gripper_description folder, or
                          2) onrobot_2FG7_gripper_description.zip
    stroke_mm             Total finger stroke/open amount in millimeters, 0..38.
                          0 = closed/reference, 38 = fully open/reference.
    open_ratio            Optional normalized open amount, 0..1. Used only if stroke_mm is None.
    finger_configuration  "outwards" or "inwards". Defaults to "outwards".
    scale                 Rhino unit scale from meters. Use 1000 for Rhino millimeters, 1 for meters.
    base_plane            Optional Rhino plane placing the gripper base_link in Rhino.
                          Connect your robot/end_effector_plane here.

Outputs:
    M          Transformed gripper meshes.
    N          Link names for each mesh.
    F          Mesh-centered link frames as Rhino planes.
    J          Joint names used by the virtual gripper.
    GripPlane  Approximate jaw-center / grasp reference plane.
    Info       Status/debug text.

Notes:
    - This is visualization/kinematic-preview only. It does not command the physical gripper.
    - The source package is Xacro, so this script uses the expanded 2FG7 link/joint values directly.
    - The STL files are authored in millimeters and referenced in Xacro with mesh scale="0.001 0.001 0.001".
      This script converts STL mm -> meters, then meters -> Rhino units through `scale`.
    - 2FG7 finger travel in the provided Xacro is 0.019 m per side, so total visual stroke is 38 mm.
    - Updated: output frames F are centered on the actual transformed mesh bounding boxes, not only the URDF link origins.
"""

import math
import os
import struct
import tempfile
import zipfile

import Rhino.Geometry as rg
import scriptcontext as sc


# -------------------------
# Grasshopper input defaults
# -------------------------
try:
    package_path
except NameError:
    package_path = None

try:
    stroke_mm
except NameError:
    stroke_mm = None

try:
    open_ratio
except NameError:
    open_ratio = None

try:
    finger_configuration
except NameError:
    finger_configuration = "outwards"

try:
    scale
except NameError:
    scale = 1000.0

try:
    base_plane
except NameError:
    base_plane = None


# -------------------------
# 2FG7 constants from Xacro
# -------------------------
ROOT_LINK = "base_link"
MAX_TRAVEL_M_PER_FINGER = 0.019
MAX_TOTAL_STROKE_MM = MAX_TRAVEL_M_PER_FINGER * 2.0 * 1000.0  # 38 mm
MESH_FILE_SCALE_TO_METERS = 0.001  # STL mm -> m, from Xacro mesh scale

# Joint origins are in meters, from onrobot_2fg7.xacro.
LEFT_JOINT_ORIGIN = [0.032239, -0.029494, 0.12005]
RIGHT_JOINT_ORIGIN = [-0.054361, -0.029494, 0.12005]
LEFT_AXIS = [-1.0, 0.0, 0.0]
RIGHT_AXIS = [1.0, 0.0, 0.0]

# Visual origins are in meters, from onrobot_2fg7.xacro.
VISUALS = [
    {
        "link": "base_link",
        "mesh_outwards": "base_link.stl",
        "mesh_inwards": "base_link.stl",
        "origin_xyz": [0.0, 0.0, 0.0],
        "origin_rpy": [0.0, 0.0, 0.0],
    },
    {
        "link": "left_finger_link",
        "mesh_outwards": "left_finger_link.stl",
        "mesh_inwards": os.path.join("inwards", "left_finger_link.stl"),
        "origin_xyz": [-0.032239, 0.029494, -0.12005],
        "origin_rpy": [0.0, 0.0, 0.0],
    },
    {
        "link": "right_finger_link",
        "mesh_outwards": "right_finger_link.stl",
        "mesh_inwards": os.path.join("inwards", "right_finger_link.stl"),
        "origin_xyz": [0.054361, 0.029494, -0.12005],
        "origin_rpy": [0.0, 0.0, 0.0],
    },
]


# -------------------------
# Math / transform helpers
# -------------------------
def clamp(value, low, high):
    return max(low, min(high, value))


def rpy_transform(roll, pitch, yaw):
    cr = math.cos(roll)
    sr = math.sin(roll)
    cp = math.cos(pitch)
    sp = math.sin(pitch)
    cy = math.cos(yaw)
    sy = math.sin(yaw)

    # URDF fixed-axis RPY: Rz(yaw) * Ry(pitch) * Rx(roll)
    t = rg.Transform.Identity
    t.M00 = cy * cp
    t.M01 = cy * sp * sr - sy * cr
    t.M02 = cy * sp * cr + sy * sr

    t.M10 = sy * cp
    t.M11 = sy * sp * sr + cy * cr
    t.M12 = sy * sp * cr - cy * sr

    t.M20 = -sp
    t.M21 = cp * sr
    t.M22 = cp * cr

    return t


def origin_transform(xyz, rpy, unit_scale):
    t = rpy_transform(rpy[0], rpy[1], rpy[2])
    t.M03 = xyz[0] * unit_scale
    t.M13 = xyz[1] * unit_scale
    t.M23 = xyz[2] * unit_scale
    return t


def prismatic_transform(axis, distance_m, unit_scale):
    return rg.Transform.Translation(
        rg.Vector3d(
            axis[0] * distance_m * unit_scale,
            axis[1] * distance_m * unit_scale,
            axis[2] * distance_m * unit_scale
        )
    )


def base_transform(plane):
    if plane is None:
        return rg.Transform.Identity
    return rg.Transform.PlaneToPlane(rg.Plane.WorldXY, plane)


def transform_to_plane(xform):
    origin = rg.Point3d.Origin
    x_axis = rg.Vector3d.XAxis
    y_axis = rg.Vector3d.YAxis

    origin.Transform(xform)
    x_axis.Transform(xform)
    y_axis.Transform(xform)

    if not x_axis.Unitize():
        x_axis = rg.Vector3d.XAxis
    if not y_axis.Unitize():
        y_axis = rg.Vector3d.YAxis

    return rg.Plane(origin, x_axis, y_axis)


def centered_mesh_plane(mesh, orientation_xform):
    """
    Plane origin = transformed mesh bounding-box center.
    Plane axes = orientation from the supplied orientation transform.

    This fixes the common URDF visual-offset issue:
    - link frame is at joint/link origin
    - visual mesh is offset by local visual origin
    - therefore the link frame does not always sit at visual mesh center
    """
    bbox = mesh.GetBoundingBox(True)
    center = bbox.Center

    x_axis = rg.Vector3d.XAxis
    y_axis = rg.Vector3d.YAxis

    x_axis.Transform(orientation_xform)
    y_axis.Transform(orientation_xform)

    if not x_axis.Unitize():
        x_axis = rg.Vector3d.XAxis
    if not y_axis.Unitize():
        y_axis = rg.Vector3d.YAxis

    return rg.Plane(center, x_axis, y_axis)


def mesh_center(mesh):
    bbox = mesh.GetBoundingBox(True)
    return bbox.Center


# -------------------------
# Package / mesh loading
# -------------------------
def resolve_package_folder(path):
    if not path:
        raise ValueError("Connect package_path to the 2FG7 folder or .zip file.")

    p = os.path.abspath(str(path))

    if os.path.isdir(p):
        # Accept either the package root or a parent containing the package root.
        if os.path.isdir(os.path.join(p, "meshes")):
            return p

        nested = os.path.join(p, "onrobot_2FG7_gripper_description")
        if os.path.isdir(os.path.join(nested, "meshes")):
            return nested

        raise IOError("Folder found, but no meshes folder was found: " + p)

    if os.path.isfile(p) and p.lower().endswith(".zip"):
        key = ("onrobot_2fg7_zip_extract", p, os.path.getmtime(p), os.path.getsize(p))

        if key in sc.sticky and os.path.isdir(sc.sticky[key]):
            return sc.sticky[key]

        extract_root = os.path.join(
            tempfile.gettempdir(),
            "onrobot_2fg7_gripper_description_extract"
        )

        if not os.path.isdir(extract_root):
            os.makedirs(extract_root)

        with zipfile.ZipFile(p, "r") as zf:
            zf.extractall(extract_root)

        candidate = os.path.join(extract_root, "onrobot_2FG7_gripper_description")

        if not os.path.isdir(os.path.join(candidate, "meshes")):
            raise IOError("Zip extracted, but package meshes folder was not found.")

        sc.sticky[key] = candidate
        return candidate

    raise IOError("package_path is not a folder or .zip file: " + p)


def read_stl_mesh(path):
    with open(path, "rb") as f:
        data = f.read()

    if len(data) < 84:
        raise ValueError("STL file is too small: " + path)

    tri_count = struct.unpack("<I", data[80:84])[0]
    expected_size = 84 + tri_count * 50

    if expected_size == len(data):
        return read_binary_stl(data)

    return read_ascii_stl(data)


def read_binary_stl(data):
    mesh = rg.Mesh()
    tri_count = struct.unpack("<I", data[80:84])[0]
    offset = 84

    for _i in range(tri_count):
        vals = struct.unpack("<12f", data[offset:offset + 48])

        p0 = rg.Point3d(vals[3], vals[4], vals[5])
        p1 = rg.Point3d(vals[6], vals[7], vals[8])
        p2 = rg.Point3d(vals[9], vals[10], vals[11])

        idx = mesh.Vertices.Count
        mesh.Vertices.Add(p0)
        mesh.Vertices.Add(p1)
        mesh.Vertices.Add(p2)
        mesh.Faces.AddFace(idx, idx + 1, idx + 2)

        offset += 50

    mesh.Normals.ComputeNormals()
    mesh.Compact()
    return mesh


def read_ascii_stl(data):
    text = data.decode("utf-8", "ignore")
    mesh = rg.Mesh()
    triangle = []

    for line in text.splitlines():
        s = line.strip()

        if not s.startswith("vertex "):
            continue

        parts = s.split()
        triangle.append(
            rg.Point3d(
                float(parts[1]),
                float(parts[2]),
                float(parts[3])
            )
        )

        if len(triangle) == 3:
            idx = mesh.Vertices.Count
            mesh.Vertices.Add(triangle[0])
            mesh.Vertices.Add(triangle[1])
            mesh.Vertices.Add(triangle[2])
            mesh.Faces.AddFace(idx, idx + 1, idx + 2)
            triangle = []

    mesh.Normals.ComputeNormals()
    mesh.Compact()
    return mesh


def cached_mesh(mesh_path):
    key = (
        "onrobot_2fg7_mesh",
        os.path.abspath(mesh_path),
        os.path.getmtime(mesh_path),
        os.path.getsize(mesh_path)
    )

    if key not in sc.sticky:
        sc.sticky[key] = read_stl_mesh(mesh_path)

    return sc.sticky[key]


# -------------------------
# Gripper reconstruction
# -------------------------
def get_stroke_distance_m():
    # Prefer stroke_mm. If it is not connected, use open_ratio.
    if stroke_mm is not None:
        total_stroke = float(stroke_mm)
    elif open_ratio is not None:
        total_stroke = float(open_ratio) * MAX_TOTAL_STROKE_MM
    else:
        total_stroke = 0.0

    total_stroke = clamp(total_stroke, 0.0, MAX_TOTAL_STROKE_MM)
    one_side_distance_m = (total_stroke * 0.5) / 1000.0

    return one_side_distance_m, total_stroke


def reconstruct():
    package_folder = resolve_package_folder(package_path)
    mesh_folder = os.path.join(package_folder, "meshes")

    if not os.path.isdir(mesh_folder):
        raise IOError("Mesh directory not found: " + mesh_folder)

    config = str(finger_configuration or "outwards").lower().strip()

    if config not in ("outwards", "inwards"):
        config = "outwards"

    unit_scale = float(scale)
    root_xform = base_transform(base_plane)
    one_side_distance_m, total_stroke = get_stroke_distance_m()

    # Base frame plus two prismatic finger frames.
    left_xform = (
        root_xform
        * origin_transform(LEFT_JOINT_ORIGIN, [0.0, 0.0, 0.0], unit_scale)
        * prismatic_transform(LEFT_AXIS, one_side_distance_m, unit_scale)
    )

    right_xform = (
        root_xform
        * origin_transform(RIGHT_JOINT_ORIGIN, [0.0, 0.0, 0.0], unit_scale)
        * prismatic_transform(RIGHT_AXIS, one_side_distance_m, unit_scale)
    )

    link_xforms = {
        "base_link": root_xform,
        "left_finger_link": left_xform,
        "right_finger_link": right_xform,
    }

    meshes = []
    names = []
    frames = []

    # The total mesh scale is: STL mm -> meters -> Rhino units.
    mesh_total_scale = MESH_FILE_SCALE_TO_METERS * unit_scale
    mesh_scale_xform = rg.Transform.Scale(rg.Point3d.Origin, mesh_total_scale)

    for visual in VISUALS:
        link_name = visual["link"]
        mesh_rel = visual["mesh_" + config]
        mesh_path = os.path.join(mesh_folder, mesh_rel)

        if not os.path.exists(mesh_path):
            raise IOError("Mesh not found: " + mesh_path)

        mesh = cached_mesh(mesh_path).DuplicateMesh()

        local_t = origin_transform(
            visual["origin_xyz"],
            visual["origin_rpy"],
            unit_scale
        )

        # Full visual transform includes:
        # link transform + URDF visual origin offset + mesh unit scale.
        mesh_xform = link_xforms[link_name] * local_t * mesh_scale_xform
        mesh.Transform(mesh_xform)

        meshes.append(mesh)
        names.append(link_name)

        # Updated:
        # Frame origin is centered on the transformed mesh.
        # Frame axes still follow the link transform orientation.
        frames.append(centered_mesh_plane(mesh, link_xforms[link_name]))

    # Updated GripPlane:
    # Center between the FRONT gripping ends of the two fingers, not whole mesh centers.
    # In this 2FG7 mesh orientation, the finger tips extend toward local/world negative Y after base transform.
    left_bbox = None
    right_bbox = None

    for mesh, name in zip(meshes, names):
        if name == "left_finger_link":
            left_bbox = mesh.GetBoundingBox(True)
        elif name == "right_finger_link":
            right_bbox = mesh.GetBoundingBox(True)

    if left_bbox is not None and right_bbox is not None:
        # X center between two fingers
        grip_x = (left_bbox.Center.X + right_bbox.Center.X) * 0.5

        # Y should be at the front/tip side, not the mesh center.
        # Use the more forward side of both finger bounding boxes.
        grip_y = min(left_bbox.Min.Y, right_bbox.Min.Y)

        # Z center between fingers
        grip_z = (left_bbox.Center.Z + right_bbox.Center.Z) * 0.5

        grip_center = rg.Point3d(grip_x, grip_y, grip_z)

        # Plane orientation follows base/root transform
        x_axis = rg.Vector3d.XAxis
        y_axis = rg.Vector3d.YAxis

        x_axis.Transform(root_xform)
        y_axis.Transform(root_xform)

        if not x_axis.Unitize():
            x_axis = rg.Vector3d.XAxis
        if not y_axis.Unitize():
            y_axis = rg.Vector3d.YAxis

        grip_plane = rg.Plane(grip_center, x_axis, y_axis)

    else:
        # Fallback: midpoint between the two prismatic joint origins.
        jaw_center = [
            (LEFT_JOINT_ORIGIN[0] + RIGHT_JOINT_ORIGIN[0]) * 0.5,
            (LEFT_JOINT_ORIGIN[1] + RIGHT_JOINT_ORIGIN[1]) * 0.5,
            (LEFT_JOINT_ORIGIN[2] + RIGHT_JOINT_ORIGIN[2]) * 0.5,
        ]

        grip_xform = root_xform * origin_transform(
            jaw_center,
            [0.0, 0.0, 0.0],
            unit_scale
        )

        grip_plane = transform_to_plane(grip_xform)

    info = []
    info.append("OnRobot 2FG7 gripper preview")
    info.append("Package: " + package_folder)
    info.append("Mesh dir: " + mesh_folder)
    info.append("Configuration: " + config)
    info.append("Total stroke_mm clamped: " + str(round(total_stroke, 4)) + " / " + str(MAX_TOTAL_STROKE_MM))
    info.append("Per-finger travel_m: " + str(round(one_side_distance_m, 6)) + " / " + str(MAX_TRAVEL_M_PER_FINGER))
    info.append("Joint order: left_finger_joint, right_finger_joint mimic")
    info.append("Meshes: " + str(len(meshes)))
    info.append("Frames F: mesh-centered planes using transformed mesh bounding boxes")
    info.append("GripPlane: midpoint between transformed left/right finger mesh centers")
    info.append("Connect base_plane to the robot end_effector_plane to attach this gripper to the RO1 preview.")

    return (
        meshes,
        names,
        frames,
        ["left_finger_joint", "right_finger_joint_mimic"],
        grip_plane,
        "\n".join(info)
    )


try:
    M, N, F, J, GripPlane, Info = reconstruct()

except Exception as e:
    M = []
    N = []
    F = []
    J = []
    GripPlane = None
    Info = "ERROR: " + str(e)
# ---------- end python_3_script_2 ----------
panel = Panel(python_3_script_2.Info)
geometry_4 = Geometry(python_3_script_2.M)
custom_preview = CustomPreview(Geometry=geometry_4, Material=ColourSwatch(SwatchColor=RGB(79, 79, 79)))

# ----
panel_2 = Panel(file_path)
geometry_5 = Geometry(python_3_script_2.GripPlane)
geometry_6 = Geometry(python_3_script_2.F)
