# Grasshopper definition swiftlet-test_ek_5_IK_FK.ghx (Grasshopper 1.0.8)
# plug-ins: CORE.Toolbox.Grasshopper, Pufferfish, Swiftlet

# ---- group: curves
curve = Curve(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)
divide_curve = DivideCurve(Curve=curve, Count=10, Kinks=False)  # -> Points, Tangents, Parameters
perp_frame = PerpFrame(Curve=curve, Parameter=divide_curve.Parameters)

# ----
# FK
# INPUT FRAMES
curve_2 = Curve(<curve referenced from the Rhino model>)

file_path = FilePath("C:\Users\yzheng\OneDrive - HKS Inc\Desktop\API_Keys\Standardbots.txt")
# Interoperate between Rhino simulation space &
# Standardbots REST API over HTTP using JSON
# Packages:
# Swiftlet
# 
# Model Unit: Millimeter
# URDF Unit: Meter
read_file = ReadFile(File=file_path, PerLineParse=False)
bearer_token_auth = BearerTokenAuth(Token=read_file)

scale = Panel("1000")

panel = Panel("C:\Users\yzheng\OneDrive - HKS Inc\Documents\GitHub\pickNplace\onrobot_2FG7_gripper_description\")
file_path_2 = FilePath(panel)

panel_2 = Panel("C:\Users\yzheng\OneDrive - HKS Inc\Documents\GitHub\HKS_MADE_StandardBotsRO1\01_Hardware_Documentation\standard_bots_description\meshes\sbot\visual\")
panel_3 = Panel("C:\Users\yzheng\OneDrive - HKS Inc\Documents\GitHub\HKS_MADE_StandardBotsRO1\01_Hardware_Documentation\standard_bots_description\sbot.urdf")
file_path_3 = FilePath(panel_3)
file_path_4 = FilePath(panel_2)

# ---- group: point
point = Point([Point(-128.1496384, 473.8743949, 817.8734781), Point(128.1496384, 898.1629477, 817.8734781)])
xy_plane = XYPlane(Origin=point)

# ----
# IK Move
python_3_script = Python3Script(target_planes=perp_frame)  # -> out, a; inputs target_planes: list
# ---------- python_3_script: Python ----------
"""
IK Move component
=================
Takes one plane OR a list of planes, outputs one move OR a list of moves.
Wire a single Construct Plane for a single waypoint.
Wire a divided curve's frames for a full toolpath.

INPUTS:
    target_planes  Rhino Plane or list of Rhino Planes (TCP targets in mm)
    speed          float 0.01-1.0 (default 0.1)
    label          optional string name (appended with index for multiple)
    movement_kind  "line" or "joint" (default "line")

OUTPUTS:
    move           one move dict or list of move dicts (connect to GH Merge)
    a              JSON string for inspection in a panel
"""
import math
import json
import Rhino.Geometry as rg

def _get(name, default):
    try:
        v = globals()[name]
        return default if v is None else v
    except (KeyError, NameError):
        return default

_planes        = _get("target_planes", None)
_speed         = float(_get("speed", 0.1))
_label         = str(_get("label", "IK"))
_movement_kind = str(_get("movement_kind", "line")).lower()
_speed         = max(0.01, min(1.0, _speed))

# Normalize input to always be a list
if _planes is None:
    _plane_list = []
elif isinstance(_planes, rg.Plane):
    _plane_list = [_planes]
else:
    try:
        _plane_list = list(_planes)
    except TypeError:
        _plane_list = [_planes]

def _quat_from_plane(p):
    xa, ya = p.XAxis, p.YAxis
    za = rg.Vector3d.CrossProduct(xa, ya)
    m00,m01,m02 = xa.X, ya.X, za.X
    m10,m11,m12 = xa.Y, ya.Y, za.Y
    m20,m21,m22 = xa.Z, ya.Z, za.Z
    tr = m00+m11+m22
    if tr > 0:
        s=0.5/math.sqrt(tr+1); w=0.25/s
        return (m21-m12)*s,(m02-m20)*s,(m10-m01)*s,w
    elif m00>m11 and m00>m22:
        s=2.0*math.sqrt(1+m00-m11-m22)
        return 0.25*s,(m01+m10)/s,(m02+m20)/s,(m21-m12)/s
    elif m11>m22:
        s=2.0*math.sqrt(1+m11-m00-m22)
        return (m01+m10)/s,0.25*s,(m12+m21)/s,(m02-m20)/s
    else:
        s=2.0*math.sqrt(1+m22-m00-m11)
        return (m02+m20)/s,(m12+m21)/s,0.25*s,(m10-m01)/s

def plane_to_move(plane, label):
    MM = 1000.0
    ox = round(plane.Origin.X / MM, 6)
    oy = round(plane.Origin.Y / MM, 6)
    oz = round(plane.Origin.Z / MM, 6)
    qx,qy,qz,qw = _quat_from_plane(plane)
    return {
        "kind": "tooltip_position",
        "label": label,
        "tooltip_position": {
            "position": {
                "unit_kind": "meters",
                "x": ox, "y": oy, "z": oz,
            },
            "orientation": {
                "kind": "quaternion",
                "quaternion": {
                    "x": round(qx,6), "y": round(qy,6),
                    "z": round(qz,6), "w": round(qw,6),
                },
            },
            "reference_frame": "base",
            "axis_alignment": "base",
        },
        "movement_kind": _movement_kind,
        "speed_profile": {
            "scaling_factor": round(_speed, 4),
            "max_tooltip_speed": round(_speed, 4),
        },
    }

if not _plane_list:
    a = ["ERROR: no target_planes connected"]
elif len(_plane_list) == 1:
    a = json.dumps(plane_to_move(_plane_list[0], _label), indent=2)
else:
    a = [json.dumps(plane_to_move(p, "{}_{}".format(_label, i)), indent=2)
         for i, p in enumerate(_plane_list)]
# ---------- end python_3_script ----------

# ----
# IK Move
python_3_script_2 = Python3Script(target_planes=xy_plane, label=Slider(0, range=0..1))  # -> out, a; inputs target_planes: list; same code as python_3_script

panel_4 = Panel(python_3_script_2.a)
base_frame = Relay()
geometry = Geometry()
gripper_states_set_manually = Panel("""0
0
0
0
18
18
18
18
18
18
18
18
18
18
18
0
0
0
0
0""")

# ---- group: Record position!
# Click this button to save
# the current position
# of the robot arm
snapshot = Button()

# ----
# 1. CALIBRATE OPERATION SURFACE
# Save current arm positions from Standardbots
panel_5 = Panel("https://cb2347.sb.app/api/v1/movement/position/arm")
dispatch = Dispatch(List=panel_5, DispatchPattern=snapshot)  # -> ListA, ListB
get_request = GETRequest(URL=dispatch.ListA, Headers=bearer_token_auth, TimeoutSeconds=100)  # -> Status, Content, Response
clean_tree = CleanTree(RemoveNulls=True, RemoveInvalid=True, RemoveEmpty=True, Tree=get_request.Content)
data_recorder = DataRecorder(clean_tree, DataLimit=-10, RecordData=True)

# ---- group: TOTAL FRAMES
# The range of the slider must be equal to the total
# number of frames coming out of the interpolation
# component
number_slider = Slider(0, range=0..10)

# ---- group: REPLAY!
replay = BooleanToggle(False)

# ----
brute_force = BruteForce(Run=replay, Input1=number_slider)  # -> Permutation, Output1

list_item = ListItem(List=gripper_states_set_manually, Index=brute_force.Output1, Wrap=True)  # disabled
integer = Integer(list_item)  # disabled
arm_locations = Panel(data_recorder)
scaling_factor = Slider(1, range=0..1)
# ARM REPLAY
parse_json_string = ParseJSONString(Text=python_3_script.a)
scaling_factor_2 = Slider(1, range=0..1)
format_json_string = FormatJsonString(JSONString=arm_locations)
create_json_value = CreateJSONValue(Value=scaling_factor)
get_json_object_key = GetJSONObjectKey(JObject=parse_json_string, Key="joint_rotation")
create_json_object = CreateJSONObject(Keys="scaling_factor", Values=create_json_value)
create_json_value_2 = CreateJSONValue(Value=scaling_factor_2)
list_item_2 = ListItem(List=python_3_script.a, Index=brute_force.Output1, Wrap=True)
create_json_value_3 = CreateJSONValue(Value="joint")
create_json_value_4 = CreateJSONValue(Value="joint_rotation")

# ----
# IK SIMULATION / FK INTERPOLATION
number_slider_2 = Slider(20, range=0..20)
xy_plane_2 = XYPlane(Origin=Point(0, 0, 0))
python_3_script_3 = Python3Script(
    program=format_json_string,
    scrub=Slider(0.27, range=0..1),
    steps=number_slider_2,
    urdf_path=file_path_3,
    mesh_Dir=file_path_4,
    scale=scale,
    base_plane=xy_plane_2,
    speed=Slider(1, range=0..1))  # -> meshes, tcp_plane, frames, joint_degrees, current_move, Info; inputs program: list, scrub: Double, urdf_path: String, mesh_Dir: String, scale: Int32
# ---------- python_3_script_3: Python ----------
"""
Simulator component
===================
Takes a merged program and a scrub slider (0-1).
Shows the robot in the Rhino viewport at the scrubbed position.

INPUTS:
    program       list of JSON strings from Merge
    scrub         float 0.0-1.0  (0 = first move, 1 = last move)
    urdf_path     path to sbot.urdf
    mesh_Dir      path to meshes/sbot/visual/
    scale         float 1000 for mm (default)
    base_plane    optional Rhino Plane for robot base

OUTPUTS:
    meshes        transformed link meshes for Custom Preview
    tcp_plane     current TCP as Rhino Plane
    joint_degrees current joint angles in degrees
    current_move  index and label of active move at scrub position
    info          status string
"""

import math
import os
import json
import struct
import xml.etree.ElementTree as ET
import Rhino.Geometry as rg
import scriptcontext as sc

def _get(name, default):
    try:
        v = globals()[name]
        return default if v is None else v
    except (KeyError, NameError):
        return default

speed = float(_get("speed", 0.1))
program    = _get("program",    [])
scrub      = float(_get("scrub",     0.0))
urdf_path  = _get("urdf_path",  None)
mesh_dir   = _get("mesh_Dir",   None)
scale      = float(_get("scale",     1000.0))
base_plane = _get("base_plane", None)

scrub = max(0.0, min(1.0, scrub))

ROOT_LINK = "base_link"

class Joint(object):
    def __init__(self, name, jtype, parent, child, xyz, rpy, axis):
        self.name=name; self.joint_type=jtype; self.parent=parent
        self.child=child; self.xyz=xyz; self.rpy=rpy; self.axis=axis

class LinkMesh(object):
    def __init__(self, link_name, mesh_name, xyz, rpy):
        self.link_name=link_name; self.mesh_name=mesh_name
        self.xyz=xyz; self.rpy=rpy

def _pf(text, count, dv):
    if not text: return [dv]*count
    v=[float(x) for x in text.split()]
    while len(v)<count: v.append(dv)
    return v[:count]

def _origin(el):
    if el is None: return [0.0,0.0,0.0],[0.0,0.0,0.0]
    return _pf(el.get("xyz"),3,0.0), _pf(el.get("rpy"),3,0.0)

def parse_urdf(path):
    root=ET.parse(path).getroot()
    joints,p2j,lms=[],{},[]
    for lel in root.findall("link"):
        ln=lel.get("name")
        for vel in lel.findall("visual"):
            xyz,rpy=_origin(vel.find("origin"))
            mel=vel.find("geometry/mesh")
            if mel is None: continue
            fn=mel.get("filename")
            if fn: lms.append(LinkMesh(ln, fn.replace("\\","/").split("/")[-1], xyz, rpy))
    for jel in root.findall("joint"):
        pel=jel.find("parent"); cel=jel.find("child")
        if pel is None or cel is None: continue
        xyz,rpy=_origin(jel.find("origin"))
        ael=jel.find("axis")
        ax=_pf(ael.get("xyz") if ael is not None else None,3,0.0)
        if ax==[0.0,0.0,0.0]: ax=[0.0,0.0,1.0]
        j=Joint(jel.get("name"),jel.get("type","fixed"),
                pel.get("link"),cel.get("link"),xyz,rpy,ax)
        joints.append(j)
        p2j.setdefault(j.parent,[]).append(j)
    return {"joints":joints,"p2j":p2j,"lms":lms}

def rpy_xf(roll,pitch,yaw):
    cr,sr=math.cos(roll),math.sin(roll)
    cp,sp=math.cos(pitch),math.sin(pitch)
    cy,sy=math.cos(yaw),math.sin(yaw)
    t=rg.Transform.Identity
    t.M00=cy*cp; t.M01=cy*sp*sr-sy*cr; t.M02=cy*sp*cr+sy*sr
    t.M10=sy*cp; t.M11=sy*sp*sr+cy*cr; t.M12=sy*sp*cr-cy*sr
    t.M20=-sp;   t.M21=cp*sr;          t.M22=cp*cr
    return t

def origin_xf(xyz, rpy, us):
    t=rpy_xf(rpy[0],rpy[1],rpy[2])
    t.M03=xyz[0]*us; t.M13=xyz[1]*us; t.M23=xyz[2]*us
    return t

def axis_rot(axis, angle):
    v=rg.Vector3d(axis[0],axis[1],axis[2])
    if not v.Unitize(): v=rg.Vector3d(0,0,1)
    return rg.Transform.Rotation(angle, v, rg.Point3d.Origin)

def natural_key(j):
    if j.name and j.name.startswith("joint"):
        t=j.name[5:]
        if t.isdigit(): return int(t)
    return 9999

def read_stl(path):
    with open(path,"rb") as f: data=f.read()
    if len(data)<84: raise ValueError("STL too small")
    n=struct.unpack("<I",data[80:84])[0]
    if 84+n*50==len(data):
        mesh=rg.Mesh(); off=84
        for _ in range(n):
            v=struct.unpack("<12f",data[off:off+48])
            idx=mesh.Vertices.Count
            mesh.Vertices.Add(v[3],v[4],v[5])
            mesh.Vertices.Add(v[6],v[7],v[8])
            mesh.Vertices.Add(v[9],v[10],v[11])
            mesh.Faces.AddFace(idx,idx+1,idx+2)
            off+=50
    else:
        mesh=rg.Mesh(); tri=[]
        for line in data.decode("utf-8","ignore").splitlines():
            s=line.strip()
            if not s.startswith("vertex "): continue
            p=s.split()
            tri.append(rg.Point3d(float(p[1]),float(p[2]),float(p[3])))
            if len(tri)==3:
                idx=mesh.Vertices.Count
                for pt in tri: mesh.Vertices.Add(pt)
                mesh.Faces.AddFace(idx,idx+1,idx+2)
                tri=[]
    mesh.Normals.ComputeNormals(); mesh.Compact()
    return mesh

def get_model(urdf, mdir):
    key=("sbot_sim_v2", os.path.abspath(urdf), os.path.abspath(mdir))
    if key in sc.sticky: return sc.sticky[key]
    model=parse_urdf(urdf)
    mc={}
    for lm in model["lms"]:
        p=os.path.join(mdir,lm.mesh_name)
        if not os.path.exists(p): raise IOError("Mesh not found: "+p)
        if lm.mesh_name not in mc: mc[lm.mesh_name]=read_stl(p)
    model["mc"]=mc
    sc.sticky[key]=model
    return model

def compute_fk(model, q, us, root_xf):
    rev=sorted([j for j in model["joints"] if j.joint_type in("revolute","continuous")],
               key=natural_key)
    jv={j.name: float(q[i]) if i<len(q) else 0.0 for i,j in enumerate(rev)}
    lx={ROOT_LINK: root_xf}
    queue=[ROOT_LINK]
    while queue:
        parent=queue.pop(0)
        px=lx[parent]
        for j in model["p2j"].get(parent,[]):
            to=origin_xf(j.xyz,j.rpy,us)
            tm=(axis_rot(j.axis,jv.get(j.name,0.0))
                if j.joint_type in("revolute","continuous")
                else rg.Transform.Identity)
            lx[j.child]=px*to*tm
            queue.append(j.child)
    return lx, [j.name for j in rev]

def xf_to_plane(xf):
    o=rg.Point3d.Origin; xa=rg.Vector3d.XAxis; ya=rg.Vector3d.YAxis
    o.Transform(xf); xa.Transform(xf); ya.Transform(xf)
    return rg.Plane(o,xa,ya)

def get_tcp(lx):
    for name in ("tool0","wrist_3_link","flange"):
        if name in lx: return lx[name]
    return list(lx.values())[-1]

def solve_ik(model, target_pl, seed, us, root_xf, iters=300, tol=0.5):
    tx,ty,tz = target_pl.Origin.X, target_pl.Origin.Y, target_pl.Origin.Z
    rev=sorted([j for j in model["joints"] if j.joint_type in("revolute","continuous")],
               key=natural_key)
    q=list(seed[:len(rev)]) if seed else [0.0]*len(rev)
    lam=0.05

    def tcp_pos(angles):
        jv={j.name: float(angles[i]) if i<len(angles) else 0.0 for i,j in enumerate(rev)}
        lx={ROOT_LINK: root_xf}
        queue=[ROOT_LINK]
        while queue:
            p=queue.pop(0)
            px=lx[p]
            for j in model["p2j"].get(p,[]):
                to=origin_xf(j.xyz,j.rpy,us)
                tm=(axis_rot(j.axis,jv.get(j.name,0.0))
                    if j.joint_type in("revolute","continuous")
                    else rg.Transform.Identity)
                lx[j.child]=px*to*tm
                queue.append(j.child)
        for name in ("tool0","wrist_3_link","flange"):
            if name in lx:
                pt=rg.Point3d.Origin; pt.Transform(lx[name])
                return pt.X,pt.Y,pt.Z
        pt=rg.Point3d.Origin; pt.Transform(list(lx.values())[-1])
        return pt.X,pt.Y,pt.Z

    for _ in range(iters):
        cx,cy,cz=tcp_pos(q)
        ep=[tx-cx,ty-cy,tz-cz]
        err=math.sqrt(sum(e*e for e in ep))
        if err<tol: return q,True,err
        J=[]
        d=1e-4
        for i in range(len(q)):
            qp=list(q); qp[i]+=d
            px,py,pz=tcp_pos(qp)
            J.append([(px-cx)/d,(py-cy)/d,(pz-cz)/d])
        JJT=[[sum(J[k][r]*J[k][c] for k in range(len(q))) for c in range(3)] for r in range(3)]
        for k in range(3): JJT[k][k]+=lam*lam
        M=[list(JJT[i])+[ep[i]] for i in range(3)]
        for c in range(3):
            piv=next((r for r in range(c,3) if abs(M[r][c])>1e-12),None)
            if piv is None: break
            M[c],M[piv]=M[piv],M[c]
            s=M[c][c]; M[c]=[v/s for v in M[c]]
            for r in range(3):
                if r!=c:
                    f=M[r][c]; M[r]=[M[r][k]-f*M[c][k] for k in range(4)]
        alpha=[M[i][3] for i in range(3)]
        for i in range(len(q)):
            q[i]+=sum(J[i][r]*alpha[r] for r in range(3))
            q[i]=max(-6.2832,min(6.2832,q[i]))
    cx,cy,cz=tcp_pos(q)
    err=math.sqrt((tx-cx)**2+(ty-cy)**2+(tz-cz)**2)
    return q,err<tol*10,err

def move_to_joints(m, prev_q, model, us, root_xf):
    # Handle joint_rotations directly (Standard Bots response format)
    if "joint_rotations" in m:
        return list(m["joint_rotations"]), True, "joint_rotations"
    
    kind = m.get("kind", "")
    if kind == "joint_position":
        return list(m["joint_position"]["joints"]), True, "FK"
    elif kind == "tooltip_position":
        # Use pre-solved joint_rotations if available
        if "joint_rotations" in m:
            return list(m["joint_rotations"]), True, "joint_rotations"
        # Fall back to numerical IK
        pos = m["tooltip_position"]["position"]
        ori = m["tooltip_position"]["orientation"]
        x = pos["x"]*us; y = pos["y"]*us; z = pos["z"]*us
        q = ori.get("quaternion", {})
        qx,qy,qz,qw = q.get("x",0),q.get("y",0),q.get("z",0),q.get("w",1)
        def quat_to_axes(qx,qy,qz,qw):
            x2,y2,z2=qx*2,qy*2,qz*2
            xx,yy,zz=qx*x2,qy*y2,qz*z2
            xy,xz,yz=qx*y2,qx*z2,qy*z2
            wx,wy,wz=qw*x2,qw*y2,qw*z2
            xa=rg.Vector3d(1-(yy+zz),xy+wz,xz-wy)
            ya=rg.Vector3d(xy-wz,1-(xx+zz),yz+wx)
            return xa,ya
        xa,ya=quat_to_axes(qx,qy,qz,qw)
        plane=rg.Plane(rg.Point3d(x,y,z),xa,ya)
        joints,conv,err=solve_ik(model,plane,prev_q,us,root_xf)
        return joints,conv,"IK err={:.1f}".format(err)
    return prev_q, False, "unknown move kind"
# --- Main ---
meshes=[]
tcp_plane=rg.Plane.WorldXY
joint_degrees=[0.0]*6
current_move="none"
info="OK"

try:
    if not urdf_path:
        raise ValueError("connect urdf_path")
    if not mesh_dir:
        raise ValueError("connect mesh_Dir")
    if not program:
        raise ValueError("connect program from Merge")

    ru=os.path.abspath(urdf_path)
    rm=os.path.abspath(mesh_dir)
    if not os.path.exists(ru): raise IOError("URDF not found: "+ru)
    if not os.path.isdir(rm):  raise IOError("mesh_Dir not found: "+rm)

    model=get_model(ru,rm)

    root_xf=(rg.Transform.PlaneToPlane(rg.Plane.WorldXY,base_plane)
             if base_plane else rg.Transform.Identity)

    # Parse JSON strings into dicts
    parsed=[]
    for item in program:
        if isinstance(item, str):
            parsed.append(json.loads(item))
        elif isinstance(item, dict):
            parsed.append(item)
    program=parsed

    n=len(program)
    if n==0: raise ValueError("program is empty after parsing")

    # Solve joint angles for every move in the program
    all_q = []
    prev_q = [0.0]*6
    for i in range(n):
        qi, _, _ = move_to_joints(program[i], prev_q, model, scale, root_xf)
        all_q.append(qi)
        prev_q = qi

    # Interpolate smoothly between moves based on scrub
    t = scrub * (n - 1)
    idx_lo = int(math.floor(t))
    idx_hi = min(idx_lo + 1, n - 1)
    frac = t - idx_lo

    q_lo = all_q[idx_lo]
    q_hi = all_q[idx_hi]
    q = [q_lo[j] + frac * (q_hi[j] - q_lo[j]) for j in range(len(q_lo))]

    m = program[idx_lo]
    solve_info = "interp {:.2f}".format(frac)
    current_move = "{:.0f}% [{}/{}] {}".format(
        scrub*100, idx_lo+1, n, m.get("label",""))







    lx,joint_order=compute_fk(model,q,scale,root_xf)
    joint_degrees=[round(math.degrees(a),2) for a in q]

    tcp_xf=get_tcp(lx)
    tcp_plane=xf_to_plane(tcp_xf)

    mscale=rg.Transform.Scale(rg.Point3d.Origin,scale)
    for lm in model["lms"]:
        if lm.link_name not in lx: continue
        mesh=model["mc"][lm.mesh_name].DuplicateMesh()
        lt=origin_xf(lm.xyz,lm.rpy,scale)
        mesh.Transform(lx[lm.link_name]*lt*mscale)
        meshes.append(mesh)


    # Interpolate all_q into steps frames for execution
        n_wp = len(all_q)
        steps = max(n_wp, int(_get("steps", 10)))
        interp_frames = []
        for i in range(steps):
            t = i / (steps - 1) * (n_wp - 1) if steps > 1 else 0
            lo = int(math.floor(t))
            hi = min(lo + 1, n_wp - 1)
            frac = t - lo
            q_lo = all_q[lo]
            q_hi = all_q[hi]
            q_interp = [q_lo[j] + frac * (q_hi[j] - q_lo[j]) for j in range(len(q_lo))]
            interp_frames.append(q_interp)

        frames = [
            json.dumps({
                "kind": "joint_rotations",
                "label": "frame_{}".format(i),
                "joint_rotation": {
                    "joints": [round(a, 6) for a in q_frame],
                },
                "movement_kind": "joint",
                "speed_profile": {"scaling_factor": speed},
            })
            for i, q_frame in enumerate(interp_frames)
        ]   







    info="Move {}/{}: {} | {} | joints={}".format(
        idx+1,n,m.get("label",""),solve_info,
        ", ".join("{:.1f}".format(d) for d in joint_degrees))

except Exception as e:
    import traceback
    info="ERROR: "+str(e)+"\n"+traceback.format_exc()
# ---------- end python_3_script_3 ----------

panel_6 = Panel("""kind
joint_rotation
movement_kind
speed_profile""")
stringify_json_token = StringifyJSONToken(JToken=get_json_object_key)
create_json_object_2 = CreateJSONObject(Keys="scaling_factor", Values=create_json_value_2)
parse_json_string_2 = ParseJSONString(Text=list_item_2)
get_json_object_key_2 = GetJSONObjectKey(JObject=parse_json_string_2, Key="joint_rotation")
format_json_string_2 = FormatJsonString(JSONString=list_item_2)
merge = Merge(
    Data1=flatten(create_json_value_4),
    Data2=flatten(get_json_object_key),
    Data3=flatten(create_json_value_3),
    Data4=flatten(create_json_object))
create_json_value_5 = CreateJSONValue(Value="joint")
create_json_value_6 = CreateJSONValue(Value="joint_rotation")
stringify_json_token_2 = StringifyJSONToken(JToken=get_json_object_key_2)
create_json_object_3 = CreateJSONObject(Keys=panel_6, Values=merge)
panel_7 = Panel("""kind
joint_rotation
movement_kind
speed_profile""")
panel_8 = Panel(format_json_string_2)
merge_2 = Merge(
    Data1=flatten(create_json_value_6),
    Data2=flatten(get_json_object_key_2),
    Data3=flatten(create_json_value_5),
    Data4=flatten(create_json_object_2))
panel_9 = Panel(stringify_json_token_2)
stringify_json_token_3 = StringifyJSONToken(JToken=create_json_object_3)
create_json_object_4 = CreateJSONObject(Keys=panel_7, Values=merge_2)
panel_10 = Panel("""{
    "kind": "joint_rotation",
    "joint_rotation": {
      "joints": [
        -2.893150568008423,
        -0.5640031099319458,
        -1.1821074485778809,
        4.449723243713379,
        -1.704693078994751,
        1.1274534463882446
      ]
    },
    "movement_kind": "joint",
    "speed_profile": {
      "scaling_factor": 0.05
    }
  }""")

# ----
# PREVIEW DIGITAL TWIN
colour_swatch = ColourSwatch(SwatchColor=RGB(22, 20, 22))
custom_preview = CustomPreview(Geometry=python_3_script_3.meshes, Material=colour_swatch)

stringify_json_token_4 = StringifyJSONToken(JToken=create_json_object_4)
panel_11 = Panel("joints")
panel_12 = Panel(stringify_json_token_3)
panel_13 = Panel(stringify_json_token_4)
create_text_body = CreateTextBody(
    Content=stringify_json_token_4,
    IsHtmlChecked=False,
    IsJavascriptChecked=False,
    IsJsonChecked=True,
    IsTextChecked=False,
    IsXmlChecked=False)
create_http_header = CreateHttpHeader(Key="robot-kind", Value="live")
dispatch_2 = Dispatch(List="https://cb2347.sb.app/api/v1/movement/position/arm", DispatchPattern=replay)  # -> ListA, ListB
merge_3 = Merge(Data2=create_http_header)
post_request = POSTRequest(URL=dispatch_2.ListA, Body=create_text_body, Headers=merge_3, TimeoutSeconds=100)  # -> Status, Content, Response
parse_json_string_3 = ParseJSONString(Text=post_request.Content)
panel_14 = Panel(post_request.Content)
get_json_object_key_3 = GetJSONObjectKey(JObject=parse_json_string_3, Key="kind")
read_json_value = ReadJSONValue(JValue=get_json_object_key_3)  # -> AsString, AsNumber, AsBool
python_3_script_4 = Python3Script(x=read_json_value.AsString, y="success")  # -> a
# ---------- python_3_script_4: Python ----------
a = x == y
# ---------- end python_3_script_4 ----------

# ---- group: Delay
python_3_script_5 = Python3Script(x=python_3_script_4, delay=Slider(0.05, range=0..2))  # -> a; inputs delay: Double
# ---------- python_3_script_5: Python ----------
import time
a = x
time.sleep(delay)
# ---------- end python_3_script_5 ----------

# ----
# Axis Move
# (Sets default location)
number_slider_3 = Slider(0, range=0..100)
merge_4 = Merge(
    Data1=number_slider_3,
    Data2=Slider(0, range=0..100),
    Data3=Slider(0, range=0..100),
    Data4=Slider(0, range=0..100),
    Data5=Slider(0, range=0..100),
    Data6=Slider(0, range=0..100))

# ----
# Axis Move
number_slider_4 = Slider(0, range=0..100)
merge_5 = Merge(
    Data1=number_slider_4,
    Data2=Slider(0, range=0..100),
    Data3=Slider(0, range=0..100),
    Data4=Slider(0, range=0..100),
    Data5=Slider(0, range=0..100),
    Data6=Slider(0, range=0..100))

# ----
# FK
radians = Radians(Degrees=merge_4)
radians_2 = Radians(Degrees=merge_5)

python_3_script_6 = Python3Script(joint_angles=radians, speed=Slider(0.25, range=0..1))  # -> out, a; inputs joint_angles: list
# ---------- python_3_script_6: Python ----------
"""
FK Move component
=================
Produces one FK move payload from 6 joint angles.
Wire multiple of these and merge them into a program.

INPUTS:
    joint_angles  list of 6 floats in radians
    speed         float 0.01-1.0 (default 0.1)
    label         optional string name for this move

OUTPUTS:
    move          dict  (connect to Merge)
    info          string summary
"""
import math

def _get(name, default):
    try:
        v = globals()[name]
        return default if v is None else v
    except (KeyError, NameError):
        return default

_joint_angles = list(_get("joint_angles", [0.0]*6))
_speed        = float(_get("speed", 0.1))
_label        = str(_get("label", "FK"))

while len(_joint_angles) < 6:
    _joint_angles.append(0.0)

# Clamp speed
_speed = max(0.01, min(1.0, _speed))

move = {
    "kind": "joint_position",
    "label": _label,
    "joint_position": {
        "joints": [round(float(a), 6) for a in _joint_angles[:6]],
        "unit_kind": "radians",
    },
    "movement_kind": "joint",
    "speed_profile": {
        "scaling_factor": round(_speed, 4),
    },
}

_deg = [round(math.degrees(a), 2) for a in _joint_angles[:6]]
info = "[FK] {} | speed={} | joints={}".format(
    _label, _speed, ", ".join(str(d) for d in _deg)
)

import json
a = json.dumps(move, indent=2)
# ---------- end python_3_script_6 ----------

python_3_script_7 = Python3Script(joint_angles=radians_2, speed=Slider(0.5, range=0..1))  # -> out, a; inputs joint_angles: list; same code as python_3_script_6

panel_15 = Panel(python_3_script_7.a)
merge_6 = Merge(Data2=flatten(python_3_script_6.a), Data3=flatten(python_3_script_2.a), Data4=flatten(python_3_script.a))
merge_7 = Merge(Data2=flatten(python_3_script_6.a), Data4=flatten(python_3_script.a))
panel_16 = Panel(merge_7)

number_slider_5 = Slider(1000, range=0..1000)
number_slider_6 = Slider(10, range=0..10)
number_slider_7 = Slider(0.57, range=0..1)
xy_plane_3 = XYPlane(Origin=Point(0, 0, 0))
python_3_script_8 = Python3Script(
    program=merge_7,
    scrub=Slider(0.85, range=0..1),
    steps=number_slider_6,
    urdf_path=file_path_3,
    mesh_Dir=file_path_4,
    scale=number_slider_5,
    base_plane=xy_plane_3,
    speed=number_slider_7)  # -> meshes, tcp_plane, joint_degrees, current_move, Info; inputs program: list, scrub: Double, urdf_path: String, mesh_Dir: String, scale: Int32
# ---------- python_3_script_8: Python ----------
"""
Simulator component - TCP-normal IK version
==========================================
Takes a merged program and a scrub slider (0-1).
Shows the robot in the Rhino viewport at the scrubbed position.

This version differs from the previous simulator in one important way:
    tooltip_position moves solve BOTH:
        1) TCP position
        2) TCP normal direction / TCP ZAxis

So if your input frame list has:
    O(x,y,z) Z(nx,ny,nz)

the simulator tries to place the robot TCP at O(x,y,z) and align the TCP plane
ZAxis to Z(nx,ny,nz).

INPUTS:
    program       list of JSON strings, move dicts, or a JSON list of move dicts
    scrub         float 0.0-1.0  (0 = first move, 1 = last move)
    urdf_path     path to sbot.urdf
    mesh_Dir      path to meshes/sbot/visual/
    scale         float 1000 for Rhino mm (default)
    base_plane    optional Rhino Plane for robot base
    speed         optional float, only used for internal diagnostic frames

OUTPUTS:
    meshes        transformed link meshes for Custom Preview
    tcp_plane     current TCP as Rhino Plane
    joint_degrees current joint angles in degrees
    current_move  index and label of active move at scrub position
    info          status + diagnostics string
"""

# -----------------------------------------------------------------------------
# Hard default Grasshopper outputs
# -----------------------------------------------------------------------------
meshes = []
tcp_plane = None
joint_degrees = []
current_move = "SCRIPT_STARTED"
info = "SCRIPT_STARTED: code reached first executable line"
Info = info
INFO = info

import math
import os
import json
import struct
import xml.etree.ElementTree as ET
import Rhino.Geometry as rg
import scriptcontext as sc

try:
    string_types = (basestring,)
except NameError:
    string_types = (str,)

# -----------------------------------------------------------------------------
# Grasshopper inputs
# -----------------------------------------------------------------------------

def _get(name, default):
    try:
        v = globals()[name]
        return default if v is None else v
    except (KeyError, NameError):
        return default

speed      = float(_get("speed", 0.1))
program    = _get("program",    [])
scrub      = float(_get("scrub",     0.0))
urdf_path  = _get("urdf_path",  None)
mesh_dir   = _get("mesh_Dir",   None)   # keep GH input name exactly mesh_Dir
scale      = float(_get("scale",     1000.0))
base_plane = _get("base_plane", None)

scrub = max(0.0, min(1.0, scrub))
ROOT_LINK_PREFERRED = "base_link"

# IK tuning
TCP_POSITION_TOL_MM = 1.0
TCP_NORMAL_TOL_DEG = 3.0
IK_MAX_ITERS = 550

# Larger = tool normal matters more. If the robot follows the position but not
# the normal, increase this. If position gets worse, decrease it.
ORIENT_WEIGHT = 150.0

# Larger = smoother/slower IK convergence. If joints jump, increase it.
IK_DAMPING = 5.0

# Max radian change per joint per IK iteration. Lower = smoother, slower.
MAX_IK_STEP = 0.12

# -----------------------------------------------------------------------------
# Diagnostics helpers
# -----------------------------------------------------------------------------

diag = []

def add_diag(msg):
    try:
        diag.append(str(msg))
    except Exception:
        diag.append(repr(msg))

def preview(items, limit=12):
    try:
        vals = list(items)
    except Exception:
        vals = [items]
    vals = [str(v) for v in vals]
    if len(vals) > limit:
        vals = vals[:limit] + ["... +{} more".format(len(vals)-limit)]
    return ", ".join(vals)

def build_info(status):
    if diag:
        return status + "\n\nDIAGNOSTICS:\n- " + "\n- ".join(diag)
    return status

# -----------------------------------------------------------------------------
# Data containers
# -----------------------------------------------------------------------------

class Joint(object):
    def __init__(self, name, jtype, parent, child, xyz, rpy, axis):
        self.name = name
        self.joint_type = jtype
        self.parent = parent
        self.child = child
        self.xyz = xyz
        self.rpy = rpy
        self.axis = axis

class LinkMesh(object):
    def __init__(self, link_name, mesh_name, xyz, rpy):
        self.link_name = link_name
        self.mesh_name = mesh_name
        self.xyz = xyz
        self.rpy = rpy

# -----------------------------------------------------------------------------
# URDF / mesh loading
# -----------------------------------------------------------------------------

def _pf(text, count, dv):
    if not text:
        return [dv] * count
    v = [float(x) for x in text.split()]
    while len(v) < count:
        v.append(dv)
    return v[:count]

def _origin(el):
    if el is None:
        return [0.0, 0.0, 0.0], [0.0, 0.0, 0.0]
    return _pf(el.get("xyz"), 3, 0.0), _pf(el.get("rpy"), 3, 0.0)

def strip_mesh_filename(filename):
    return filename.replace("\\", "/").split("/")[-1]

def parse_urdf(path):
    root = ET.parse(path).getroot()
    joints = []
    p2j = {}
    lms = []
    link_names = []

    for lel in root.findall("link"):
        ln = lel.get("name")
        if ln:
            link_names.append(ln)
        for vel in lel.findall("visual"):
            xyz, rpy = _origin(vel.find("origin"))
            mel = vel.find("geometry/mesh")
            if mel is None:
                continue
            fn = mel.get("filename")
            if fn:
                lms.append(LinkMesh(ln, strip_mesh_filename(fn), xyz, rpy))

    for jel in root.findall("joint"):
        pel = jel.find("parent")
        cel = jel.find("child")
        if pel is None or cel is None:
            continue
        xyz, rpy = _origin(jel.find("origin"))
        ael = jel.find("axis")
        ax = _pf(ael.get("xyz") if ael is not None else None, 3, 0.0)
        if ax == [0.0, 0.0, 0.0]:
            ax = [0.0, 0.0, 1.0]
        j = Joint(jel.get("name"), jel.get("type", "fixed"),
                  pel.get("link"), cel.get("link"), xyz, rpy, ax)
        joints.append(j)
        p2j.setdefault(j.parent, []).append(j)

    model = {"joints": joints, "p2j": p2j, "lms": lms, "links": link_names}
    model["root_link"] = find_root_link(model)
    return model

def find_root_link(model):
    parents = set([j.parent for j in model.get("joints", [])])
    children = set([j.child for j in model.get("joints", [])])
    links = set(model.get("links", []))
    roots = sorted(list(parents - children))

    if ROOT_LINK_PREFERRED in roots:
        return ROOT_LINK_PREFERRED
    if len(roots) == 1:
        return roots[0]
    if ROOT_LINK_PREFERRED in parents:
        return ROOT_LINK_PREFERRED
    if ROOT_LINK_PREFERRED in links:
        return ROOT_LINK_PREFERRED
    if roots:
        return roots[0]
    if model.get("links"):
        return model["links"][0]
    return ROOT_LINK_PREFERRED

def mesh_dir_stamp(mdir):
    count = 0
    latest = 0
    try:
        for root, dirs, files in os.walk(mdir):
            for f in files:
                if f.lower().endswith((".stl", ".obj", ".dae", ".ply")):
                    count += 1
                    p = os.path.join(root, f)
                    try:
                        latest = max(latest, int(os.path.getmtime(p)))
                    except Exception:
                        pass
    except Exception:
        pass
    return count, latest

def find_mesh_path(mdir, mesh_name):
    exact = os.path.join(mdir, mesh_name)
    if os.path.exists(exact):
        return exact

    target = mesh_name.lower()
    try:
        for root, dirs, files in os.walk(mdir):
            for f in files:
                if f.lower() == target:
                    return os.path.join(root, f)
    except Exception:
        pass
    return exact

def read_stl(path):
    if not path.lower().endswith(".stl"):
        raise ValueError("Only STL mesh reading is supported by this script: " + path)

    with open(path, "rb") as f:
        data = f.read()
    if len(data) < 84:
        raise ValueError("STL too small: " + path)

    n = struct.unpack("<I", data[80:84])[0]

    # Binary STL
    if 84 + n * 50 == len(data):
        mesh = rg.Mesh()
        off = 84
        for _ in range(n):
            v = struct.unpack("<12f", data[off:off+48])
            idx = mesh.Vertices.Count
            mesh.Vertices.Add(v[3], v[4], v[5])
            mesh.Vertices.Add(v[6], v[7], v[8])
            mesh.Vertices.Add(v[9], v[10], v[11])
            mesh.Faces.AddFace(idx, idx+1, idx+2)
            off += 50
    # ASCII STL fallback
    else:
        mesh = rg.Mesh()
        tri = []
        for line in data.decode("utf-8", "ignore").splitlines():
            s = line.strip()
            if not s.startswith("vertex "):
                continue
            p = s.split()
            tri.append(rg.Point3d(float(p[1]), float(p[2]), float(p[3])))
            if len(tri) == 3:
                idx = mesh.Vertices.Count
                for pt in tri:
                    mesh.Vertices.Add(pt)
                mesh.Faces.AddFace(idx, idx+1, idx+2)
                tri = []

    mesh.Normals.ComputeNormals()
    mesh.Compact()
    return mesh

def get_model(urdf, mdir):
    mcount, mlatest = mesh_dir_stamp(mdir)
    try:
        umtime = int(os.path.getmtime(urdf))
    except Exception:
        umtime = 0

    key = ("sbot_sim_tcp_normal_ik_v1", os.path.abspath(urdf), umtime,
           os.path.abspath(mdir), mcount, mlatest)

    if key in sc.sticky:
        model = sc.sticky[key]
        add_diag("cache: using cached model for current URDF/mesh timestamps")
        return model

    model = parse_urdf(urdf)

    link_count = len(model.get("links", []))
    joint_count = len(model.get("joints", []))
    visual_count = len(model.get("lms", []))
    rev_count = len([j for j in model["joints"] if j.joint_type in ("revolute", "continuous")])

    add_diag("URDF parsed: links={}, joints={}, revolute/continuous={}, visual_mesh_refs={}, detected_root={}".format(
        link_count, joint_count, rev_count, visual_count, model.get("root_link")))

    parents = set([j.parent for j in model.get("joints", [])])
    children = set([j.child for j in model.get("joints", [])])
    roots = sorted(list(parents - children))
    if ROOT_LINK_PREFERRED not in roots:
        add_diag("preferred root '{}' is not a top URDF root; top root candidates: {}".format(
            ROOT_LINK_PREFERRED, preview(roots)))

    mc = {}
    mesh_paths = {}
    missing = []
    unsupported = []

    for lm in model["lms"]:
        p = find_mesh_path(mdir, lm.mesh_name)
        mesh_paths[lm.mesh_name] = p
        if not os.path.exists(p):
            missing.append(lm.mesh_name)
            continue
        if not p.lower().endswith(".stl"):
            unsupported.append(lm.mesh_name)
            continue
        if lm.mesh_name not in mc:
            mc[lm.mesh_name] = read_stl(p)

    if missing:
        add_diag("mesh files missing from mesh_Dir: {}".format(preview(missing)))
    if unsupported:
        add_diag("mesh files found but not STL, so this script cannot read them: {}".format(preview(unsupported)))

    add_diag("mesh loader: loaded_unique_stl_meshes={} from mesh_Dir file_count={}".format(len(mc), mcount))

    model["mc"] = mc
    model["mesh_paths"] = mesh_paths
    sc.sticky[key] = model
    return model

# -----------------------------------------------------------------------------
# Transforms / kinematics
# -----------------------------------------------------------------------------

def rpy_xf(roll, pitch, yaw):
    cr, sr = math.cos(roll), math.sin(roll)
    cp, sp = math.cos(pitch), math.sin(pitch)
    cy, sy = math.cos(yaw), math.sin(yaw)
    t = rg.Transform.Identity
    t.M00 = cy*cp
    t.M01 = cy*sp*sr - sy*cr
    t.M02 = cy*sp*cr + sy*sr
    t.M10 = sy*cp
    t.M11 = sy*sp*sr + cy*cr
    t.M12 = sy*sp*cr - cy*sr
    t.M20 = -sp
    t.M21 = cp*sr
    t.M22 = cp*cr
    return t

def origin_xf(xyz, rpy, us):
    t = rpy_xf(rpy[0], rpy[1], rpy[2])
    t.M03 = xyz[0] * us
    t.M13 = xyz[1] * us
    t.M23 = xyz[2] * us
    return t

def axis_rot(axis, angle):
    v = rg.Vector3d(axis[0], axis[1], axis[2])
    if not v.Unitize():
        v = rg.Vector3d(0, 0, 1)
    return rg.Transform.Rotation(angle, v, rg.Point3d.Origin)

def natural_key(j):
    if j.name and j.name.startswith("joint"):
        t = j.name[5:]
        if t.isdigit():
            return int(t)
    return 9999

def compute_fk(model, q, us, root_xf, emit_diag=False):
    rev = sorted([j for j in model["joints"] if j.joint_type in ("revolute", "continuous")], key=natural_key)
    jv = {j.name: float(q[i]) if i < len(q) else 0.0 for i, j in enumerate(rev)}

    root_link = model.get("root_link", ROOT_LINK_PREFERRED)
    lx = {root_link: root_xf}
    queue = [root_link]

    while queue:
        parent = queue.pop(0)
        px = lx[parent]
        for j in model["p2j"].get(parent, []):
            to = origin_xf(j.xyz, j.rpy, us)
            tm = axis_rot(j.axis, jv.get(j.name, 0.0)) if j.joint_type in ("revolute", "continuous") else rg.Transform.Identity
            lx[j.child] = px * to * tm
            queue.append(j.child)

    if emit_diag:
        all_links = set(model.get("links", []))
        reached = set(lx.keys())
        unreachable = sorted(list(all_links - reached))
        visual_links = sorted(list(set([lm.link_name for lm in model.get("lms", [])])))
        missing_visual = [ln for ln in visual_links if ln not in reached]

        add_diag("FK traversal: root={}, reached_links={}, total_urdf_links={}".format(
            root_link, len(reached), len(all_links)))
        if unreachable:
            add_diag("FK unreachable URDF links from selected root: {}".format(preview(unreachable)))
        if missing_visual:
            add_diag("visual mesh links missing from FK transforms: {}".format(preview(missing_visual)))
        if not model["p2j"].get(root_link, []):
            add_diag("selected root '{}' has no child joints in p2j; check URDF root/link names".format(root_link))

    return lx, [j.name for j in rev]

def xf_to_plane(xf):
    o = rg.Point3d.Origin
    xa = rg.Vector3d.XAxis
    ya = rg.Vector3d.YAxis
    o.Transform(xf)
    xa.Transform(xf)
    ya.Transform(xf)
    return rg.Plane(o, xa, ya)

def get_tcp(lx):
    for name in ("tool0", "wrist_3_link", "flange"):
        if name in lx:
            return lx[name]
    vals = list(lx.values())
    if vals:
        return vals[-1]
    return rg.Transform.Identity

# -----------------------------------------------------------------------------
# TCP normal IK helpers
# -----------------------------------------------------------------------------

def _v_dot(a, b):
    return a.X*b.X + a.Y*b.Y + a.Z*b.Z

def _safe_unit_vec(v, fallback):
    vv = rg.Vector3d(v)
    if not vv.Unitize():
        vv = rg.Vector3d(fallback)
        vv.Unitize()
    return vv

def _plane_z_axis(pl):
    z = rg.Vector3d.CrossProduct(pl.XAxis, pl.YAxis)
    return _safe_unit_vec(z, rg.Vector3d.ZAxis)

def _angle_deg_between(a, b):
    aa = _safe_unit_vec(a, rg.Vector3d.ZAxis)
    bb = _safe_unit_vec(b, rg.Vector3d.ZAxis)
    d = max(-1.0, min(1.0, _v_dot(aa, bb)))
    return math.degrees(math.acos(d))

def _solve_linear(A, b):
    """Small Gaussian-elimination solver for 3x3 or 6x6."""
    n = len(b)
    M = [list(A[i]) + [b[i]] for i in range(n)]

    for c in range(n):
        piv = c
        best = abs(M[c][c])
        for r in range(c + 1, n):
            val = abs(M[r][c])
            if val > best:
                best = val
                piv = r

        if best < 1e-12:
            return [0.0] * n

        if piv != c:
            M[c], M[piv] = M[piv], M[c]

        s = M[c][c]
        M[c] = [v / s for v in M[c]]

        for r in range(n):
            if r == c:
                continue
            f = M[r][c]
            M[r] = [M[r][k] - f * M[c][k] for k in range(n + 1)]

    return [M[i][n] for i in range(n)]

def _quat_to_plane_in_units(x, y, z, qx, qy, qz, qw):
    """Converts JSON tooltip position + quaternion into a Rhino plane."""
    mag = math.sqrt(qx*qx + qy*qy + qz*qz + qw*qw)
    if mag > 1e-9:
        qx, qy, qz, qw = qx/mag, qy/mag, qz/mag, qw/mag

    x2, y2, z2 = qx*2.0, qy*2.0, qz*2.0
    xx, yy, zz = qx*x2, qy*y2, qz*z2
    xy, xz, yz = qx*y2, qx*z2, qy*z2
    wx, wy, wz = qw*x2, qw*y2, qw*z2

    xa = rg.Vector3d(1.0 - (yy + zz), xy + wz, xz - wy)
    ya = rg.Vector3d(xy - wz, 1.0 - (xx + zz), yz + wx)

    xa = _safe_unit_vec(xa, rg.Vector3d.XAxis)
    ya = _safe_unit_vec(ya, rg.Vector3d.YAxis)

    return rg.Plane(rg.Point3d(x, y, z), xa, ya)

def _transform_plane(pl, xf):
    p = rg.Plane(pl)
    p.Transform(xf)
    return p

def solve_ik(model, target_pl, seed, us, root_xf, iters=IK_MAX_ITERS, tol=TCP_POSITION_TOL_MM):
    """
    Position + TCP-normal IK.

    This solves a 6D error vector:
        [position x/y/z, weighted TCP ZAxis x/y/z]

    It does NOT fully constrain tool roll around the TCP ZAxis. That is intended
    because your main request is: frame normal should drive tooltip normal.
    """
    rev = sorted([j for j in model["joints"] if j.joint_type in ("revolute", "continuous")], key=natural_key)

    q = list(seed[:len(rev)]) if seed else [0.0] * len(rev)
    while len(q) < len(rev):
        q.append(0.0)

    target_z = _plane_z_axis(target_pl)

    def tcp_plane_from_angles(angles):
        lx, _ = compute_fk(model, angles, us, root_xf, emit_diag=False)
        return xf_to_plane(get_tcp(lx))

    def state_from_angles(angles):
        pl = tcp_plane_from_angles(angles)
        zaxis = _plane_z_axis(pl)
        return [
            pl.Origin.X,
            pl.Origin.Y,
            pl.Origin.Z,
            ORIENT_WEIGHT * zaxis.X,
            ORIENT_WEIGHT * zaxis.Y,
            ORIENT_WEIGHT * zaxis.Z
        ], pl, zaxis

    target_state = [
        target_pl.Origin.X,
        target_pl.Origin.Y,
        target_pl.Origin.Z,
        ORIENT_WEIGHT * target_z.X,
        ORIENT_WEIGHT * target_z.Y,
        ORIENT_WEIGHT * target_z.Z
    ]

    d = 1e-4
    dim = 6

    for _ in range(iters):
        cur_state, cur_pl, cur_z = state_from_angles(q)
        e = [target_state[i] - cur_state[i] for i in range(dim)]

        pos_err = math.sqrt(e[0]*e[0] + e[1]*e[1] + e[2]*e[2])
        ang_err = _angle_deg_between(cur_z, target_z)

        if pos_err < TCP_POSITION_TOL_MM and ang_err < TCP_NORMAL_TOL_DEG:
            return q, True, pos_err, ang_err

        # Numerical Jacobian: one 6D column per joint.
        J = []
        for j_i in range(len(q)):
            qp = list(q)
            qp[j_i] += d
            stp, _, _ = state_from_angles(qp)
            J.append([(stp[r] - cur_state[r]) / d for r in range(dim)])

        # Damped least squares: dq = J^T inv(JJ^T + lambda^2 I) e
        JJT = []
        for r in range(dim):
            row = []
            for c in range(dim):
                row.append(sum(J[k][r] * J[k][c] for k in range(len(q))))
            JJT.append(row)

        for k in range(dim):
            JJT[k][k] += IK_DAMPING * IK_DAMPING

        alpha = _solve_linear(JJT, e)

        dq = []
        for j_i in range(len(q)):
            dq.append(sum(J[j_i][r] * alpha[r] for r in range(dim)))

        largest = max([abs(v) for v in dq] + [1e-9])
        if largest > MAX_IK_STEP:
            s = MAX_IK_STEP / largest
            dq = [v * s for v in dq]

        for j_i in range(len(q)):
            q[j_i] += dq[j_i]
            q[j_i] = max(-6.2832, min(6.2832, q[j_i]))

    cur_state, cur_pl, cur_z = state_from_angles(q)
    pos_err = math.sqrt(
        (target_pl.Origin.X - cur_pl.Origin.X)**2 +
        (target_pl.Origin.Y - cur_pl.Origin.Y)**2 +
        (target_pl.Origin.Z - cur_pl.Origin.Z)**2
    )
    ang_err = _angle_deg_between(cur_z, target_z)
    ok = pos_err < TCP_POSITION_TOL_MM * 10.0 and ang_err < 15.0
    return q, ok, pos_err, ang_err

def move_to_joints(m, prev_q, model, us, root_xf):
    kind = m.get("kind", "")

    if kind == "joint_position":
        if "joint_position" not in m or "joints" not in m["joint_position"]:
            return prev_q, False, "joint_position move missing joints"
        return list(m["joint_position"]["joints"]), True, "FK"

    elif kind == "tooltip_position":
        if "tooltip_position" not in m:
            return prev_q, False, "tooltip_position move missing tooltip_position data"

        pos = m["tooltip_position"].get("position", {})
        ori = m["tooltip_position"].get("orientation", {})
        qq = ori.get("quaternion", {})

        # JSON is in meters. Convert to Rhino units with scale=1000 for mm.
        x = pos.get("x", 0.0) * us
        y = pos.get("y", 0.0) * us
        z = pos.get("z", 0.0) * us

        qx = qq.get("x", 0.0)
        qy = qq.get("y", 0.0)
        qz = qq.get("z", 0.0)
        qw = qq.get("w", 1.0)

        target_plane_base = _quat_to_plane_in_units(x, y, z, qx, qy, qz, qw)

        # Program reference_frame is "base". If base_plane is connected, convert
        # this base-space target plane into Rhino world for the simulator.
        target_plane_world = _transform_plane(target_plane_base, root_xf)

        joints, conv, pos_err, ang_err = solve_ik(model, target_plane_world, prev_q, us, root_xf)
        return joints, conv, "IK pos_err={:.1f}mm normal_err={:.1f}deg".format(pos_err, ang_err)

    return prev_q, False, "unknown move kind '{}'".format(kind)

# -----------------------------------------------------------------------------
# Program parsing
# -----------------------------------------------------------------------------

def parse_program_input(raw_program):
    parsed = []
    skipped = []
    invalid = []

    if isinstance(raw_program, string_types):
        raw_program = [raw_program]

    try:
        raw_count = len(raw_program)
    except Exception:
        raw_count = "unknown"
    add_diag("program raw input count={}".format(raw_count))

    def _short_text(x, limit=160):
        try:
            t = str(x)
        except Exception:
            t = repr(x)
        t = t.replace("\r", "\\r").replace("\n", "\\n")
        if len(t) > limit:
            t = t[:limit] + "..."
        return t

    def append_move_obj(obj, source_index):
        if isinstance(obj, dict):
            if "kind" not in obj:
                invalid.append("item {} parsed as dict but has no 'kind': {}".format(source_index, _short_text(obj)))
                return
            parsed.append(obj)
            return

        if isinstance(obj, list) or isinstance(obj, tuple):
            kept = 0
            for sub_i, sub in enumerate(obj):
                if isinstance(sub, dict) and "kind" in sub:
                    parsed.append(sub)
                    kept += 1
                elif isinstance(sub, string_types):
                    try:
                        sub_obj = json.loads(sub)
                        if isinstance(sub_obj, dict) and "kind" in sub_obj:
                            parsed.append(sub_obj)
                            kept += 1
                        else:
                            invalid.append("item {}[{}] JSON was not a move dict".format(source_index, sub_i))
                    except Exception as ex:
                        invalid.append("item {}[{}] invalid JSON: {}".format(source_index, sub_i, ex))
                else:
                    invalid.append("item {}[{}] ignored; expected move dict, got {}".format(
                        source_index, sub_i, type(sub).__name__))
            if kept == 0:
                skipped.append("item {} list contained no valid moves".format(source_index))
            return

        invalid.append("item {} parsed but is not a move dict/list: {} = {}".format(
            source_index, type(obj).__name__, _short_text(obj)))

    for i, item in enumerate(raw_program):
        if item is None:
            skipped.append("item {} skipped: None/<null>".format(i))
            continue

        if isinstance(item, dict):
            append_move_obj(item, i)
            continue

        if isinstance(item, string_types):
            s = item.strip()
            if not s:
                skipped.append("item {} skipped: blank string".format(i))
                continue
            if s.lower() in ("none", "null", "<null>"):
                skipped.append("item {} skipped: {}".format(i, _short_text(s)))
                continue

            try:
                obj = json.loads(s)
                append_move_obj(obj, i)
            except Exception as ex:
                invalid.append("item {} invalid JSON: {}; starts with: {}".format(i, ex, _short_text(s)))
            continue

        text = _short_text(item)
        if text.strip().startswith("{") or text.strip().startswith("["):
            try:
                obj = json.loads(text.strip())
                append_move_obj(obj, i)
            except Exception as ex:
                invalid.append("item {} unsupported object invalid as JSON: {}; type={}".format(i, ex, type(item).__name__))
        else:
            invalid.append("item {} ignored; unsupported type {}: {}".format(i, type(item).__name__, text))

    if skipped:
        add_diag("program skipped items: {}".format(preview(skipped, limit=10)))
    if invalid:
        add_diag("program invalid items: {}".format(preview(invalid, limit=10)))

    return parsed

# -----------------------------------------------------------------------------
# Main
# -----------------------------------------------------------------------------

meshes = []
tcp_plane = rg.Plane.WorldXY
joint_degrees = [0.0] * 6
current_move = "none"
info = "OK"

try:
    # 1) Input checks ----------------------------------------------------------
    if not urdf_path:
        raise ValueError("connect urdf_path")
    if not mesh_dir:
        raise ValueError("connect mesh_Dir")
    if not program:
        raise ValueError("connect program from Merge or IK move component")

    ru = os.path.abspath(str(urdf_path))
    rm = os.path.abspath(str(mesh_dir))

    add_diag("inputs: scrub={:.3f}, scale={}, urdf_path='{}', mesh_Dir='{}'".format(scrub, scale, ru, rm))

    if not os.path.exists(ru):
        raise IOError("URDF not found: " + ru)
    if not os.path.isdir(rm):
        raise IOError("mesh_Dir not found: " + rm)

    # 2) Load URDF + mesh files ------------------------------------------------
    model = get_model(ru, rm)

    root_xf = rg.Transform.PlaneToPlane(rg.Plane.WorldXY, base_plane) if base_plane else rg.Transform.Identity
    if base_plane:
        add_diag("base_plane connected: interpreting JSON targets in robot base frame, then transforming to Rhino world")
    else:
        add_diag("base_plane empty: robot base frame equals Rhino WorldXY")

    # 3) Parse JSON program ----------------------------------------------------
    program = parse_program_input(program)

    n = len(program)
    if n == 0:
        raise ValueError("program is empty after parsing. Check Merge input: no valid JSON move dicts were found.")

    kinds = [m.get("kind", "") for m in program]
    labels = [m.get("label", "") for m in program]
    add_diag("program parsed: valid_moves={}, kinds={}, labels={}".format(n, preview(kinds), preview(labels)))

    # 4) Solve every move ------------------------------------------------------
    all_q = []
    solve_notes = []
    prev_q = [0.0] * 6

    for i in range(n):
        qi, conv, note = move_to_joints(program[i], prev_q, model, scale, root_xf)
        all_q.append(qi)
        prev_q = qi
        if not conv:
            solve_notes.append("move {} {}: {}".format(i, program[i].get("label", ""), note))

    if solve_notes:
        add_diag("move solve warnings: {}".format(preview(solve_notes, limit=8)))

    q_lengths = sorted(list(set([len(qi) for qi in all_q])))
    if len(q_lengths) > 1:
        add_diag("joint vector lengths differ across moves: {}".format(preview(q_lengths)))
    else:
        add_diag("joint vector length={}".format(q_lengths[0] if q_lengths else 0))

    # 5) Interpolate from scrub ------------------------------------------------
    t = scrub * (n - 1)
    idx_lo = int(math.floor(t))
    idx_hi = min(idx_lo + 1, n - 1)
    frac = t - idx_lo

    q_lo = all_q[idx_lo]
    q_hi = all_q[idx_hi]
    q = [q_lo[j] + frac * (q_hi[j] - q_lo[j]) for j in range(min(len(q_lo), len(q_hi)))]

    m = program[idx_lo]
    current_move = "{:.0f}% [{}/{}] {}".format(scrub * 100.0, idx_lo + 1, n, m.get("label", ""))

    # 6) FK -------------------------------------------------------------------
    lx, joint_order = compute_fk(model, q, scale, root_xf, emit_diag=True)
    joint_degrees = [round(math.degrees(a), 2) for a in q]

    tcp_xf = get_tcp(lx)
    tcp_plane = xf_to_plane(tcp_xf)

    # 7) Mesh transform/output ------------------------------------------------
    visual_links = sorted(list(set([lm.link_name for lm in model.get("lms", [])])))
    skipped_no_fk = []
    skipped_no_loaded_mesh = []
    transform_errors = []

    mscale = rg.Transform.Scale(rg.Point3d.Origin, scale)
    for lm in model["lms"]:
        if lm.link_name not in lx:
            skipped_no_fk.append(lm.link_name)
            continue
        if lm.mesh_name not in model.get("mc", {}):
            skipped_no_loaded_mesh.append(lm.mesh_name)
            continue
        try:
            mesh = model["mc"][lm.mesh_name].DuplicateMesh()
            lt = origin_xf(lm.xyz, lm.rpy, scale)
            mesh.Transform(lx[lm.link_name] * lt * mscale)
            meshes.append(mesh)
        except Exception as ex:
            transform_errors.append("{} / {}: {}".format(lm.link_name, lm.mesh_name, ex))

    if skipped_no_fk:
        add_diag("mesh refs skipped because visual link has no FK transform: {}".format(
            preview(sorted(list(set(skipped_no_fk))))))
    if skipped_no_loaded_mesh:
        add_diag("mesh refs skipped because STL was not loaded: {}".format(
            preview(sorted(list(set(skipped_no_loaded_mesh))))))
    if transform_errors:
        add_diag("mesh transform errors: {}".format(preview(transform_errors, limit=6)))

    add_diag("mesh output: visual_links={}, visual_refs={}, loaded_unique_meshes={}, output_meshes={}".format(
        len(visual_links), len(model.get("lms", [])), len(model.get("mc", {})), len(meshes)))

    if len(meshes) == 0:
        add_diag("NO MESH OUTPUT. Most likely causes: missing STL files, non-STL mesh files, visual link names not reached by FK, or wrong URDF root.")

    status = "Move {}/{}: {} | interp {:.2f} | joints={} | meshes={}".format(
        idx_lo + 1,
        n,
        m.get("label", ""),
        frac,
        ", ".join("{:.1f}".format(d) for d in joint_degrees),
        len(meshes)
    )
    info = build_info(status)

except Exception as e:
    import traceback
    add_diag("exception type: {}".format(type(e)))
    info = build_info("ERROR: " + str(e) + "\n" + traceback.format_exc())

# -----------------------------------------------------------------------------
# Final output aliases / safety sync
# -----------------------------------------------------------------------------
try:
    Info = info
    INFO = info
except Exception:
    pass
# ---------- end python_3_script_8 ----------

# ----
# use to attach any custom end effector
last_index = LastIndex(List=python_3_script_8.meshes)
list_item_3 = ListItem(List=python_3_script_8.meshes, Index=last_index, Wrap=True)
bounding_box = BoundingBox(Content=list_item_3, Plane=python_3_script_8.tcp_plane)  # -> Box, Box_2
deconstruct_brep = DeconstructBrep(Brep=bounding_box.Box)  # -> Faces, Edges, Vertices
deconstruct_box = DeconstructBox(Box=bounding_box.Box)  # -> Plane, X, Y, Z
rectangle = Rectangle(Plane=deconstruct_box.Plane, XSize=deconstruct_box.X, YSize=deconstruct_box.Y, Radius=0)  # -> Rectangle, Length
list_item_4 = ListItem(List=deconstruct_brep.Faces, Index=Slider(5, range=0..10), Wrap=True)
area = Area(Geometry=list_item_4)  # -> Area, Centroid
area_2 = Area(Geometry=rectangle.Rectangle)  # -> Area, Centroid
evaluate_surface = EvaluateSurface(Surface=rectangle.Rectangle, Point=area_2.Centroid)  # -> Point, Normal, UDirection, VDirection, Frame
distance = Distance(PointA=area_2.Centroid, PointB=area.Centroid)
multiplication = Multiplication(A=evaluate_surface.Normal, B=distance)
move = Move(Geometry=rectangle.Rectangle, Motion=multiplication)  # -> Geometry, Transform
convert_units = ConvertUnits(Data="7", Source=8, Target=2)
division = Division(A=convert_units, B=2)
multiplication_2 = Multiplication(A=convert_units, B=2)
division_2 = Division(A=convert_units, B=3)
division_3 = Division(A=multiplication_2, B=3)
negative = Negative(Value=division_3)
negative_2 = Negative(Value=division)
construct_domain = ConstructDomain(DomainStart=negative_2, DomainEnd=division_3)
construct_domain_2 = ConstructDomain(DomainStart=negative, DomainEnd=division_2)
rectangle_2 = Rectangle(Plane=move.Geometry, XSize=construct_domain_2, YSize=construct_domain, Radius=0)  # -> Rectangle, Length
convert_units_2 = ConvertUnits(Data="4", Source=8, Target=2)
box_rectangle = BoxRectangle(Rectangle=rectangle_2.Rectangle, Height=convert_units_2)

orient = Orient(Geometry=geometry, Source=base_frame, Target=python_3_script_8.tcp_plane)  # -> Geometry, Transform

custom_preview_2 = CustomPreview(Geometry=python_3_script_8.meshes, Material=ColourSwatch(SwatchColor=RGB(41, 41, 41)))

geometry_2 = Geometry(python_3_script_8.tcp_plane)

# ----
# Simulation 1***Robot TCP plane follow the plane list
# robot base plane should not change.
# place all contextual geometries relative to the robot.
panel_17 = Panel(python_3_script_8.Info)

# ---- group: On Robot Gripper
value_list = ValueList({"out": outwards, "in": inwards}, selected="in")

# ----
# Simulation 0 ** FK joint movement
number_slider_8 = Slider(0.287, range=0..1)
xy_plane_4 = XYPlane(Origin=Point(0, 0, 0))

python_3_script_9 = Python3Script(
    program=merge_6,
    scrub=number_slider_8,
    steps=Slider(10, range=0..10),
    urdf_path=file_path_3,
    mesh_Dir=file_path_4,
    scale=Slider(1000, range=0..1000),
    base_plane=xy_plane_4,
    speed=Slider(0.57, range=0..1))  # -> meshes, tcp_plane, joint_degrees, current_move, Info; inputs program: list, scrub: Double, urdf_path: String, mesh_Dir: String, scale: Int32
# ---------- python_3_script_9: Python ----------
"""
Simulator component - hard diagnostic version v2
========================================
Takes a merged program and a scrub slider (0-1).
Shows the robot in the Rhino viewport at the scrubbed position.

INPUTS:  kept the same
    program       list of JSON strings from Merge
    scrub         float 0.0-1.0  (0 = first move, 1 = last move)
    urdf_path     path to sbot.urdf
    mesh_Dir      path to meshes/sbot/visual/
    scale         float 1000 for mm (default)
    base_plane    optional Rhino Plane for robot base

OUTPUTS: kept the same
    meshes        transformed link meshes for Custom Preview
    tcp_plane     current TCP as Rhino Plane
    joint_degrees current joint angles in degrees
    current_move  index and label of active move at scrub position
    info          status + diagnostics string; reports skipped/invalid program items
"""

# -----------------------------------------------------------------------------
# Hard default Grasshopper outputs
# -----------------------------------------------------------------------------
# These are assigned before imports and before any parsing, so the info output
# should never be <null> unless Grasshopper output names do not match these vars
# or the script has a syntax/copy-paste issue before this line.
meshes = []
tcp_plane = None
joint_degrees = []
current_move = "SCRIPT_STARTED"
info = "SCRIPT_STARTED: code reached the first executable line"
# Case aliases do not change your inputs/outputs, but help if the GH output
# parameter was accidentally named with different capitalization.
Info = info
INFO = info



import math
import os
import json
import struct
import xml.etree.ElementTree as ET
import Rhino.Geometry as rg
import scriptcontext as sc

try:
    string_types = (basestring,)
except NameError:
    string_types = (str,)

# -----------------------------------------------------------------------------
# Grasshopper inputs
# -----------------------------------------------------------------------------

def _get(name, default):
    try:
        v = globals()[name]
        return default if v is None else v
    except (KeyError, NameError):
        return default

speed      = float(_get("speed", 0.1))
program    = _get("program",    [])
scrub      = float(_get("scrub",     0.0))
urdf_path  = _get("urdf_path",  None)
mesh_dir   = _get("mesh_Dir",   None)   # keep input name exactly mesh_Dir
scale      = float(_get("scale",     1000.0))
base_plane = _get("base_plane", None)

scrub = max(0.0, min(1.0, scrub))

# This is now only the preferred root. The script will auto-detect if needed.
ROOT_LINK_PREFERRED = "base_link"

# -----------------------------------------------------------------------------
# Diagnostics helpers
# -----------------------------------------------------------------------------

diag = []

def add_diag(msg):
    try:
        diag.append(str(msg))
    except Exception:
        diag.append(repr(msg))

def preview(items, limit=12):
    try:
        vals = list(items)
    except Exception:
        vals = [items]
    vals = [str(v) for v in vals]
    if len(vals) > limit:
        vals = vals[:limit] + ["... +{} more".format(len(vals)-limit)]
    return ", ".join(vals)

def build_info(status):
    if diag:
        return status + "\n\nDIAGNOSTICS:\n- " + "\n- ".join(diag)
    return status

# -----------------------------------------------------------------------------
# Data containers
# -----------------------------------------------------------------------------

class Joint(object):
    def __init__(self, name, jtype, parent, child, xyz, rpy, axis):
        self.name=name; self.joint_type=jtype; self.parent=parent
        self.child=child; self.xyz=xyz; self.rpy=rpy; self.axis=axis

class LinkMesh(object):
    def __init__(self, link_name, mesh_name, xyz, rpy):
        self.link_name=link_name; self.mesh_name=mesh_name
        self.xyz=xyz; self.rpy=rpy

# -----------------------------------------------------------------------------
# URDF / mesh loading
# -----------------------------------------------------------------------------

def _pf(text, count, dv):
    if not text: return [dv]*count
    v=[float(x) for x in text.split()]
    while len(v)<count: v.append(dv)
    return v[:count]

def _origin(el):
    if el is None: return [0.0,0.0,0.0],[0.0,0.0,0.0]
    return _pf(el.get("xyz"),3,0.0), _pf(el.get("rpy"),3,0.0)

def strip_mesh_filename(filename):
    # Keep old behavior: use the final file name, not package:// or nested paths.
    # Diagnostics below will tell you if this is the wrong assumption.
    return filename.replace("\\","/").split("/")[-1]

def parse_urdf(path):
    root=ET.parse(path).getroot()
    joints,p2j,lms=[],{},[]
    link_names=[]

    for lel in root.findall("link"):
        ln=lel.get("name")
        if ln:
            link_names.append(ln)
        for vel in lel.findall("visual"):
            xyz,rpy=_origin(vel.find("origin"))
            mel=vel.find("geometry/mesh")
            if mel is None:
                continue
            fn=mel.get("filename")
            if fn:
                lms.append(LinkMesh(ln, strip_mesh_filename(fn), xyz, rpy))

    for jel in root.findall("joint"):
        pel=jel.find("parent"); cel=jel.find("child")
        if pel is None or cel is None:
            continue
        xyz,rpy=_origin(jel.find("origin"))
        ael=jel.find("axis")
        ax=_pf(ael.get("xyz") if ael is not None else None,3,0.0)
        if ax==[0.0,0.0,0.0]:
            ax=[0.0,0.0,1.0]
        j=Joint(jel.get("name"),jel.get("type","fixed"),
                pel.get("link"),cel.get("link"),xyz,rpy,ax)
        joints.append(j)
        p2j.setdefault(j.parent,[]).append(j)

    model={"joints":joints,"p2j":p2j,"lms":lms,"links":link_names}
    model["root_link"] = find_root_link(model)
    return model

def find_root_link(model):
    parents=set([j.parent for j in model.get("joints",[])])
    children=set([j.child for j in model.get("joints",[])])
    links=set(model.get("links",[]))
    roots=sorted(list(parents - children))

    if ROOT_LINK_PREFERRED in roots:
        return ROOT_LINK_PREFERRED
    if len(roots)==1:
        return roots[0]
    if ROOT_LINK_PREFERRED in parents:
        # Not the top URDF root, but it has child joints and can still drive the arm.
        return ROOT_LINK_PREFERRED
    if ROOT_LINK_PREFERRED in links:
        return ROOT_LINK_PREFERRED
    if roots:
        return roots[0]
    if model.get("links"):
        return model["links"][0]
    return ROOT_LINK_PREFERRED

def mesh_dir_stamp(mdir):
    count=0
    latest=0
    try:
        for root,dirs,files in os.walk(mdir):
            for f in files:
                if f.lower().endswith((".stl", ".obj", ".dae", ".ply")):
                    count += 1
                    p=os.path.join(root,f)
                    try:
                        latest=max(latest, int(os.path.getmtime(p)))
                    except Exception:
                        pass
    except Exception:
        pass
    return count, latest

def find_mesh_path(mdir, mesh_name):
    exact=os.path.join(mdir,mesh_name)
    if os.path.exists(exact):
        return exact

    # Case-insensitive / nested fallback. Useful when URDF was exported with a
    # different folder layout or file-case than Grasshopper sees.
    target=mesh_name.lower()
    try:
        for root,dirs,files in os.walk(mdir):
            for f in files:
                if f.lower()==target:
                    return os.path.join(root,f)
    except Exception:
        pass
    return exact

def read_stl(path):
    if not path.lower().endswith(".stl"):
        raise ValueError("Only STL mesh reading is supported by this script: "+path)

    with open(path,"rb") as f:
        data=f.read()
    if len(data)<84:
        raise ValueError("STL too small: "+path)

    n=struct.unpack("<I",data[80:84])[0]
    if 84+n*50==len(data):
        mesh=rg.Mesh(); off=84
        for _ in range(n):
            v=struct.unpack("<12f",data[off:off+48])
            idx=mesh.Vertices.Count
            mesh.Vertices.Add(v[3],v[4],v[5])
            mesh.Vertices.Add(v[6],v[7],v[8])
            mesh.Vertices.Add(v[9],v[10],v[11])
            mesh.Faces.AddFace(idx,idx+1,idx+2)
            off+=50
    else:
        mesh=rg.Mesh(); tri=[]
        for line in data.decode("utf-8","ignore").splitlines():
            s=line.strip()
            if not s.startswith("vertex "):
                continue
            p=s.split()
            tri.append(rg.Point3d(float(p[1]),float(p[2]),float(p[3])))
            if len(tri)==3:
                idx=mesh.Vertices.Count
                for pt in tri:
                    mesh.Vertices.Add(pt)
                mesh.Faces.AddFace(idx,idx+1,idx+2)
                tri=[]

    mesh.Normals.ComputeNormals(); mesh.Compact()
    return mesh

def get_model(urdf, mdir):
    mcount, mlatest = mesh_dir_stamp(mdir)
    try:
        umtime = int(os.path.getmtime(urdf))
    except Exception:
        umtime = 0

    # Include mtime/count in the key so updates to the URDF or mesh folder do not
    # silently reuse an old sc.sticky cache.
    key=("sbot_sim_diag_v1", os.path.abspath(urdf), umtime,
         os.path.abspath(mdir), mcount, mlatest)

    if key in sc.sticky:
        model=sc.sticky[key]
        add_diag("cache: using cached model for current URDF/mesh timestamps")
        return model

    model=parse_urdf(urdf)

    link_count=len(model.get("links",[]))
    joint_count=len(model.get("joints",[]))
    visual_count=len(model.get("lms",[]))
    rev_count=len([j for j in model["joints"] if j.joint_type in ("revolute","continuous")])

    add_diag("URDF parsed: links={}, joints={}, revolute/continuous={}, visual_mesh_refs={}, detected_root={}".format(
        link_count, joint_count, rev_count, visual_count, model.get("root_link")))

    if visual_count == 0:
        add_diag("URDF has 0 <visual><geometry><mesh> references, so no meshes can be output")

    # Warn if the preferred root is not actually the detected top root.
    parents=set([j.parent for j in model.get("joints",[])])
    children=set([j.child for j in model.get("joints",[])])
    roots=sorted(list(parents - children))
    if ROOT_LINK_PREFERRED not in roots:
        add_diag("preferred root '{}' is not a top URDF root; top root candidates: {}".format(
            ROOT_LINK_PREFERRED, preview(roots)))

    mc={}
    mesh_paths={}
    missing=[]
    unsupported=[]

    for lm in model["lms"]:
        p=find_mesh_path(mdir,lm.mesh_name)
        mesh_paths[lm.mesh_name]=p
        if not os.path.exists(p):
            missing.append(lm.mesh_name)
            continue
        if not p.lower().endswith(".stl"):
            unsupported.append(lm.mesh_name)
            continue
        if lm.mesh_name not in mc:
            mc[lm.mesh_name]=read_stl(p)

    if missing:
        add_diag("mesh files missing from mesh_Dir: {}".format(preview(missing)))
    if unsupported:
        add_diag("mesh files found but not STL, so this script cannot read them: {}".format(preview(unsupported)))

    add_diag("mesh loader: loaded_unique_stl_meshes={} from mesh_Dir file_count={}".format(
        len(mc), mcount))

    model["mc"]=mc
    model["mesh_paths"]=mesh_paths
    sc.sticky[key]=model
    return model

# -----------------------------------------------------------------------------
# Transforms / kinematics
# -----------------------------------------------------------------------------

def rpy_xf(roll,pitch,yaw):
    cr,sr=math.cos(roll),math.sin(roll)
    cp,sp=math.cos(pitch),math.sin(pitch)
    cy,sy=math.cos(yaw),math.sin(yaw)
    t=rg.Transform.Identity
    t.M00=cy*cp; t.M01=cy*sp*sr-sy*cr; t.M02=cy*sp*cr+sy*sr
    t.M10=sy*cp; t.M11=sy*sp*sr+cy*cr; t.M12=sy*sp*cr-cy*sr
    t.M20=-sp;   t.M21=cp*sr;          t.M22=cp*cr
    return t

def origin_xf(xyz, rpy, us):
    t=rpy_xf(rpy[0],rpy[1],rpy[2])
    t.M03=xyz[0]*us; t.M13=xyz[1]*us; t.M23=xyz[2]*us
    return t

def axis_rot(axis, angle):
    v=rg.Vector3d(axis[0],axis[1],axis[2])
    if not v.Unitize():
        v=rg.Vector3d(0,0,1)
    return rg.Transform.Rotation(angle, v, rg.Point3d.Origin)

def natural_key(j):
    if j.name and j.name.startswith("joint"):
        t=j.name[5:]
        if t.isdigit():
            return int(t)
    return 9999

def compute_fk(model, q, us, root_xf, emit_diag=False):
    rev=sorted([j for j in model["joints"] if j.joint_type in("revolute","continuous")],
               key=natural_key)
    jv={j.name: float(q[i]) if i<len(q) else 0.0 for i,j in enumerate(rev)}

    root_link=model.get("root_link", ROOT_LINK_PREFERRED)
    lx={root_link: root_xf}
    queue=[root_link]

    while queue:
        parent=queue.pop(0)
        px=lx[parent]
        for j in model["p2j"].get(parent,[]):
            to=origin_xf(j.xyz,j.rpy,us)
            tm=(axis_rot(j.axis,jv.get(j.name,0.0))
                if j.joint_type in("revolute","continuous")
                else rg.Transform.Identity)
            lx[j.child]=px*to*tm
            queue.append(j.child)

    if emit_diag:
        all_links=set(model.get("links",[]))
        reached=set(lx.keys())
        unreachable=sorted(list(all_links-reached))
        visual_links=sorted(list(set([lm.link_name for lm in model.get("lms",[])])))
        missing_visual=[ln for ln in visual_links if ln not in reached]

        add_diag("FK traversal: root={}, reached_links={}, total_urdf_links={}".format(
            root_link, len(reached), len(all_links)))
        if unreachable:
            add_diag("FK unreachable URDF links from selected root: {}".format(preview(unreachable)))
        if missing_visual:
            add_diag("visual mesh links missing from FK transforms: {}".format(preview(missing_visual)))
        if not model["p2j"].get(root_link,[]):
            add_diag("selected root '{}' has no child joints in p2j; check URDF root/link names".format(root_link))

    return lx, [j.name for j in rev]

def xf_to_plane(xf):
    o=rg.Point3d.Origin; xa=rg.Vector3d.XAxis; ya=rg.Vector3d.YAxis
    o.Transform(xf); xa.Transform(xf); ya.Transform(xf)
    return rg.Plane(o,xa,ya)

def get_tcp(lx):
    for name in ("tool0","wrist_3_link","flange"):
        if name in lx:
            return lx[name]
    vals=list(lx.values())
    if vals:
        return vals[-1]
    return rg.Transform.Identity

def solve_ik(model, target_pl, seed, us, root_xf, iters=300, tol=0.5):
    tx,ty,tz = target_pl.Origin.X, target_pl.Origin.Y, target_pl.Origin.Z
    rev=sorted([j for j in model["joints"] if j.joint_type in("revolute","continuous")],
               key=natural_key)
    q=list(seed[:len(rev)]) if seed else [0.0]*len(rev)
    lam=0.05

    def tcp_pos(angles):
        lx,_ = compute_fk(model, angles, us, root_xf, emit_diag=False)
        for name in ("tool0","wrist_3_link","flange"):
            if name in lx:
                pt=rg.Point3d.Origin; pt.Transform(lx[name])
                return pt.X,pt.Y,pt.Z
        vals=list(lx.values())
        if vals:
            pt=rg.Point3d.Origin; pt.Transform(vals[-1])
            return pt.X,pt.Y,pt.Z
        return 0.0,0.0,0.0

    for _ in range(iters):
        cx,cy,cz=tcp_pos(q)
        ep=[tx-cx,ty-cy,tz-cz]
        err=math.sqrt(sum(e*e for e in ep))
        if err<tol:
            return q,True,err
        J=[]
        d=1e-4
        for i in range(len(q)):
            qp=list(q); qp[i]+=d
            px,py,pz=tcp_pos(qp)
            J.append([(px-cx)/d,(py-cy)/d,(pz-cz)/d])
        JJT=[[sum(J[k][r]*J[k][c] for k in range(len(q))) for c in range(3)] for r in range(3)]
        for k in range(3):
            JJT[k][k]+=lam*lam
        M=[list(JJT[i])+[ep[i]] for i in range(3)]
        for c in range(3):
            piv=next((r for r in range(c,3) if abs(M[r][c])>1e-12),None)
            if piv is None:
                break
            M[c],M[piv]=M[piv],M[c]
            s=M[c][c]; M[c]=[v/s for v in M[c]]
            for r in range(3):
                if r!=c:
                    f=M[r][c]; M[r]=[M[r][k]-f*M[c][k] for k in range(4)]
        alpha=[M[i][3] for i in range(3)]
        for i in range(len(q)):
            q[i]+=sum(J[i][r]*alpha[r] for r in range(3))
            q[i]=max(-6.2832,min(6.2832,q[i]))
    cx,cy,cz=tcp_pos(q)
    err=math.sqrt((tx-cx)**2+(ty-cy)**2+(tz-cz)**2)
    return q,err<tol*10,err

def move_to_joints(m, prev_q, model, us, root_xf):
    kind=m.get("kind","")
    if kind=="joint_position":
        if "joint_position" not in m or "joints" not in m["joint_position"]:
            return prev_q, False, "joint_position move missing joints"
        return list(m["joint_position"]["joints"]), True, "FK"
    elif kind=="tooltip_position":
        if "tooltip_position" not in m:
            return prev_q, False, "tooltip_position move missing tooltip_position data"
        pos=m["tooltip_position"].get("position",{})
        ori=m["tooltip_position"].get("orientation",{})
        x=pos.get("x",0)*us; y=pos.get("y",0)*us; z=pos.get("z",0)*us
        q=ori.get("quaternion",{})
        qx,qy,qz,qw=q.get("x",0),q.get("y",0),q.get("z",0),q.get("w",1)
        def quat_to_axes(qx,qy,qz,qw):
            x2,y2,z2=qx*2,qy*2,qz*2
            xx,yy,zz=qx*x2,qy*y2,qz*z2
            xy,xz,yz=qx*y2,qx*z2,qy*z2
            wx,wy,wz=qw*x2,qw*y2,qw*z2
            xa=rg.Vector3d(1-(yy+zz),xy+wz,xz-wy)
            ya=rg.Vector3d(xy-wz,1-(xx+zz),yz+wx)
            return xa,ya
        xa,ya=quat_to_axes(qx,qy,qz,qw)
        plane=rg.Plane(rg.Point3d(x,y,z),xa,ya)
        joints,conv,err=solve_ik(model,plane,prev_q,us,root_xf)
        return joints,conv,"IK err={:.1f}".format(err)
    return prev_q, False, "unknown move kind '{}'".format(kind)

# -----------------------------------------------------------------------------
# Main outputs - keep names exactly the same
# -----------------------------------------------------------------------------

meshes=[]
tcp_plane=rg.Plane.WorldXY
joint_degrees=[0.0]*6
current_move="none"
info="OK"

try:
    # 1) Input checks ----------------------------------------------------------
    if not urdf_path:
        raise ValueError("connect urdf_path")
    if not mesh_dir:
        raise ValueError("connect mesh_Dir")
    if not program:
        raise ValueError("connect program from Merge")

    ru=os.path.abspath(str(urdf_path))
    rm=os.path.abspath(str(mesh_dir))

    add_diag("inputs: scrub={:.3f}, scale={}, urdf_path='{}', mesh_Dir='{}'".format(
        scrub, scale, ru, rm))

    if not os.path.exists(ru):
        raise IOError("URDF not found: "+ru)
    if not os.path.isdir(rm):
        raise IOError("mesh_Dir not found: "+rm)

    # 2) Load URDF + mesh files ----------------------------------------------
    model=get_model(ru,rm)

    root_xf=(rg.Transform.PlaneToPlane(rg.Plane.WorldXY,base_plane)
             if base_plane else rg.Transform.Identity)
    if base_plane:
        add_diag("base_plane connected: using PlaneToPlane transform")
    else:
        add_diag("base_plane empty: using WorldXY / Identity transform")

    # 3) Parse JSON program ---------------------------------------------------
    parsed=[]
    skipped_program_items=[]
    invalid_program_items=[]

    # If Grasshopper gives a single JSON string instead of a list, allow it.
    if isinstance(program, string_types):
        program=[program]

    try:
        raw_program_count = len(program)
    except Exception:
        raw_program_count = "unknown"

    add_diag("program raw input count={}".format(raw_program_count))

    def _short_text(x, limit=140):
        try:
            t = str(x)
        except Exception:
            t = repr(x)
        t = t.replace("\r", "\\r").replace("\n", "\\n")
        if len(t) > limit:
            t = t[:limit] + "..."
        return t

    def _append_move(obj, source_index):
        if isinstance(obj, dict):
            if "kind" not in obj:
                invalid_program_items.append(
                    "item {} parsed as dict but has no 'kind': {}".format(source_index, _short_text(obj))
                )
                return
            parsed.append(obj)
            return

        # Sometimes a Merge/data-tree operation may send a JSON list of moves.
        # Accept that too, but only keep dict-like move objects.
        if isinstance(obj, list) or isinstance(obj, tuple):
            kept = 0
            for sub_i, sub in enumerate(obj):
                if isinstance(sub, dict) and "kind" in sub:
                    parsed.append(sub)
                    kept += 1
                else:
                    invalid_program_items.append(
                        "item {}[{}] ignored; expected move dict, got {}: {}".format(
                            source_index, sub_i, type(sub).__name__, _short_text(sub)
                        )
                    )
            if kept == 0:
                skipped_program_items.append("item {} list contained no valid moves".format(source_index))
            return

        invalid_program_items.append(
            "item {} parsed but is not a move dict/list: {} = {}".format(
                source_index, type(obj).__name__, _short_text(obj)
            )
        )

    for i,item in enumerate(program):
        if item is None:
            skipped_program_items.append("item {} skipped: None/<null>".format(i))
            continue

        if isinstance(item, dict):
            _append_move(item, i)
            continue

        if isinstance(item, string_types):
            s = item.strip()
            if not s:
                skipped_program_items.append("item {} skipped: blank string".format(i))
                continue
            if s.lower() in ("none", "null", "<null>"):
                skipped_program_items.append("item {} skipped: {}".format(i, _short_text(s)))
                continue

            try:
                obj = json.loads(s)
                _append_move(obj, i)
            except Exception as ex:
                # Do not stop the whole simulator. Report the bad item and keep
                # using the valid moves so mesh/FK diagnostics can still run.
                invalid_program_items.append(
                    "item {} invalid JSON: {}; starts with: {}".format(
                        i, ex, _short_text(s)
                    )
                )
            continue

        # Grasshopper sometimes passes Goo-like objects. Try converting to string
        # once, but only if it looks like JSON.
        text = _short_text(item)
        if text.strip().startswith("{") or text.strip().startswith("["):
            try:
                obj = json.loads(text.strip())
                _append_move(obj, i)
            except Exception as ex:
                invalid_program_items.append(
                    "item {} unsupported object invalid as JSON: {}; type={}".format(
                        i, ex, type(item).__name__
                    )
                )
        else:
            invalid_program_items.append(
                "item {} ignored; unsupported type {}: {}".format(
                    i, type(item).__name__, text
                )
            )

    program=parsed

    if skipped_program_items:
        add_diag("program skipped items: {}".format(preview(skipped_program_items, limit=10)))
    if invalid_program_items:
        add_diag("program invalid items: {}".format(preview(invalid_program_items, limit=10)))

    n=len(program)
    if n==0:
        raise ValueError("program is empty after parsing. Check Merge input: no valid JSON move dicts were found.")

    kinds=[m.get("kind","") for m in program]
    labels=[m.get("label","") for m in program]
    add_diag("program parsed: valid_moves={}, kinds={}, labels={}".format(n, preview(kinds), preview(labels)))

    # 4) Solve every move ------------------------------------------------------
    all_q = []
    solve_notes=[]
    prev_q = [0.0]*6
    for i in range(n):
        qi, conv, note = move_to_joints(program[i], prev_q, model, scale, root_xf)
        all_q.append(qi)
        prev_q = qi
        if not conv:
            solve_notes.append("move {}: {}".format(i, note))

    if solve_notes:
        add_diag("move solve warnings: {}".format(preview(solve_notes, limit=6)))

    q_lengths=sorted(list(set([len(qi) for qi in all_q])))
    if len(q_lengths)>1:
        add_diag("joint vector lengths differ across moves: {}".format(preview(q_lengths)))
    else:
        add_diag("joint vector length={}".format(q_lengths[0] if q_lengths else 0))

    # 5) Interpolate from scrub ------------------------------------------------
    t = scrub * (n - 1)
    idx_lo = int(math.floor(t))
    idx_hi = min(idx_lo + 1, n - 1)
    frac = t - idx_lo

    q_lo = all_q[idx_lo]
    q_hi = all_q[idx_hi]
    q = [q_lo[j] + frac * (q_hi[j] - q_lo[j]) for j in range(min(len(q_lo), len(q_hi)))]

    m = program[idx_lo]
    solve_info = "interp {:.2f}".format(frac)
    current_move = "{:.0f}% [{}/{}] {}".format(
        scrub*100, idx_lo+1, n, m.get("label",""))

    # 6) FK -------------------------------------------------------------------
    lx,joint_order=compute_fk(model,q,scale,root_xf,emit_diag=True)
    joint_degrees=[round(math.degrees(a),2) for a in q]

    tcp_xf=get_tcp(lx)
    tcp_plane=xf_to_plane(tcp_xf)

    # 7) Mesh transform/output ------------------------------------------------
    visual_links=sorted(list(set([lm.link_name for lm in model.get("lms",[])])))
    fk_links=set(lx.keys())
    skipped_no_fk=[]
    skipped_no_loaded_mesh=[]
    transform_errors=[]

    mscale=rg.Transform.Scale(rg.Point3d.Origin,scale)
    for lm in model["lms"]:
        if lm.link_name not in lx:
            skipped_no_fk.append(lm.link_name)
            continue
        if lm.mesh_name not in model.get("mc",{}):
            skipped_no_loaded_mesh.append(lm.mesh_name)
            continue
        try:
            mesh=model["mc"][lm.mesh_name].DuplicateMesh()
            lt=origin_xf(lm.xyz,lm.rpy,scale)
            mesh.Transform(lx[lm.link_name]*lt*mscale)
            meshes.append(mesh)
        except Exception as ex:
            transform_errors.append("{} / {}: {}".format(lm.link_name,lm.mesh_name,ex))

    if skipped_no_fk:
        add_diag("mesh refs skipped because visual link has no FK transform: {}".format(
            preview(sorted(list(set(skipped_no_fk))))))
    if skipped_no_loaded_mesh:
        add_diag("mesh refs skipped because STL was not loaded: {}".format(
            preview(sorted(list(set(skipped_no_loaded_mesh))))))
    if transform_errors:
        add_diag("mesh transform errors: {}".format(preview(transform_errors, limit=6)))

    add_diag("mesh output: visual_links={}, visual_refs={}, loaded_unique_meshes={}, output_meshes={}".format(
        len(visual_links), len(model.get("lms",[])), len(model.get("mc",{})), len(meshes)))

    if len(meshes)==0:
        add_diag("NO MESH OUTPUT. Most likely causes: missing STL files, non-STL mesh files, visual link names not reached by FK, or wrong URDF root.")

    # Keep old internal frames generation, even though it is not an output.
    frames = [
        json.dumps({
            "kind": "joint_position",
            "label": "frame_{}".format(i),
            "joint_position": {
                "joints": [round(a, 6) for a in q_frame],
                "unit_kind": "radians",
            },
            "movement_kind": "joint",
            "speed_profile": {"scaling_factor": speed},
        })
        for i, q_frame in enumerate(all_q)
    ]

    status="Move {}/{}: {} | {} | joints={} | meshes={}".format(
        idx_lo+1,n,m.get("label",""),solve_info,
        ", ".join("{:.1f}".format(d) for d in joint_degrees),
        len(meshes))
    info=build_info(status)

except Exception as e:
    import traceback
    add_diag("exception type: {}".format(type(e)))
    info=build_info("ERROR: "+str(e)+"\n"+traceback.format_exc())


# -----------------------------------------------------------------------------
# Final output aliases / safety sync
# -----------------------------------------------------------------------------
try:
    Info = info
    INFO = info
except Exception:
    pass
# ---------- end python_3_script_9 ----------
panel_18 = Panel(python_3_script_9.current_move)
panel_19 = Panel(python_3_script_9.tcp_plane)
panel_20 = Panel(python_3_script_9.meshes)
panel_21 = Panel(python_3_script_9.joint_degrees)

custom_preview_3 = CustomPreview(Geometry=python_3_script_9.meshes, Material=ColourSwatch(SwatchColor=RGB(41, 41, 41)))

# ---- group: F frames
geometry_3 = Geometry(python_3_script_9.tcp_plane)  # disabled

# ---- group: frames to end planes
preset_rotation = Slider(0, range=0..9)  # disabled
panel_22 = Panel("0")  # disabled
python_3_script_10 = Python3Script(F=geometry_3, preset=preset_rotation, offset=panel_22)  # -> out, EndPlane, BasePlane, Axes, Info; inputs F: list; disabled
# ---------- python_3_script_10: Python ----------
"""
GhPython helper: select RO1 joint-6/end plane and generate corrected mount planes
for the OnRobot 2FG7 gripper.

This is a diagnostic + production component.
It does NOT assume the problem is only a Y/Z flip. Instead it keeps the
joint-6 origin and lets you choose one of several right-handed mounting
orientation presets.

Inputs:
    F              RO1 visualizer F output, or one already-selected joint-6 plane
    preset         Optional integer/string preset. Default 0.
                   0 = raw joint-6 plane
                   1 = rotate +90 deg about local X
                   2 = rotate -90 deg about local X
                   3 = rotate +90 deg about local Y
                   4 = rotate -90 deg about local Y
                   6 = rotate 180 deg about local X
                   6 = rotate 180 deg about local Y
                   7 = rotate 180 deg about local Z
                   8 = swap Y/Z:   X, Z, -Y
                   9 = swap Y/Z v2:X, -Z, Y
    offset         Optional local offset distance, Rhino units. Default 0.
    offset_axis    Optional "X", "Y", or "Z". Default "Z".

Outputs:
    BasePlane      Plane to connect to OnRobot 2FG7 base_plane
    EndPlane       Same as BasePlane
    RawPlane       Unmodified selected joint-6 plane
    AllCandidates  10 candidate planes for quick preview
    Axes           Axis preview curves for BasePlane
    Info           Debug info
"""

import math
import Rhino.Geometry as rg

try:
    F
except NameError:
    F = None

try:
    preset
except NameError:
    preset = 0

try:
    offset
except NameError:
    offset = 0.0

try:
    offset_axis
except NameError:
    offset_axis = "Z"

JOINT6_INDEX = 6
AXIS_LEN = 120.0


def unwrap_gh(value):
    if value is None:
        return None
    if hasattr(value, "Value"):
        try:
            return value.Value
        except Exception:
            pass
    if hasattr(value, "ScriptVariable"):
        try:
            return value.ScriptVariable()
        except Exception:
            pass
    return value


def collect_planes(value):
    planes = []

    def walk(v):
        v = unwrap_gh(v)
        if v is None:
            return

        if isinstance(v, rg.Plane):
            planes.append(rg.Plane(v.Origin, v.XAxis, v.YAxis))
            return

        if hasattr(v, "Origin") and hasattr(v, "XAxis") and hasattr(v, "YAxis"):
            try:
                planes.append(rg.Plane(v.Origin, v.XAxis, v.YAxis))
                return
            except Exception:
                pass

        if hasattr(v, "Branches"):
            try:
                for branch in v.Branches:
                    walk(branch)
                return
            except Exception:
                pass

        if hasattr(v, "Paths") and hasattr(v, "Branch"):
            try:
                for path in v.Paths:
                    walk(v.Branch(path))
                return
            except Exception:
                pass

        if not isinstance(v, str):
            try:
                for item in v:
                    walk(item)
                return
            except Exception:
                pass

    walk(value)
    return planes


def dup(p):
    return rg.Plane(p.Origin, p.XAxis, p.YAxis)


def rotate_about(p, axis_name, degrees):
    q = dup(p)
    a = axis_name.upper()
    if a == "X":
        axis = q.XAxis
    elif a == "Y":
        axis = q.YAxis
    else:
        axis = q.ZAxis
    t = rg.Transform.Rotation(math.radians(degrees), axis, q.Origin)
    q.Transform(t)
    return q


def yz_swap_1(p):
    # X, Z, -Y. Plane constructor receives X and Y; Z is computed.
    x = rg.Vector3d(p.XAxis)
    y = rg.Vector3d(p.ZAxis)
    x.Unitize(); y.Unitize()
    return rg.Plane(p.Origin, x, y)


def yz_swap_2(p):
    # X, -Z, Y. Plane constructor receives X and Y; Z is computed.
    x = rg.Vector3d(p.XAxis)
    y = -rg.Vector3d(p.ZAxis)
    x.Unitize(); y.Unitize()
    return rg.Plane(p.Origin, x, y)


def make_candidates(raw):
    return [
        dup(raw),
        rotate_about(raw, "X", 90),
        rotate_about(raw, "X", -90),
        rotate_about(raw, "Y", 90),
        rotate_about(raw, "Y", -90),
        rotate_about(raw, "X", 180),
        rotate_about(raw, "Y", 180),
        rotate_about(raw, "Z", 180),
        yz_swap_1(raw),
        yz_swap_2(raw),
    ]


def coerce_int(value, default_value):
    value = unwrap_gh(value)
    try:
        return int(value)
    except Exception:
        try:
            return int(str(value).strip())
        except Exception:
            return default_value


def apply_offset(p, distance, axis_name):
    q = dup(p)
    d = float(distance or 0.0)
    if abs(d) <= 1e-9:
        return q
    a = str(axis_name or "Z").strip().upper()
    if a == "X":
        v = q.XAxis
    elif a == "Y":
        v = q.YAxis
    else:
        v = q.ZAxis
    q.Origin = q.Origin + v * d
    return q


def make_axes(p, length):
    o = p.Origin
    return [
        rg.LineCurve(o, o + p.XAxis * length),
        rg.LineCurve(o, o + p.YAxis * length),
        rg.LineCurve(o, o + p.ZAxis * length),
    ]


def solve():
    planes = collect_planes(F)
    if not planes:
        raise ValueError("Connect RO1 visualizer F output, or connect one selected joint-6 plane.")

    if len(planes) >= JOINT6_INDEX + 1:
        raw = planes[JOINT6_INDEX]
        selection_msg = "Selected true joint 6 as F[6]."
    else:
        raw = planes[0]
        selection_msg = "Only one plane received; using that plane directly. This is OK if it is already joint 6."

    candidates = make_candidates(raw)
    idx = coerce_int(preset, 0)
    if idx < 0 or idx >= len(candidates):
        idx = 0

    selected = apply_offset(candidates[idx], offset, offset_axis)

    labels = [
        "0 raw joint-6 plane",
        "1 rot +90 local X",
        "2 rot -90 local X",
        "3 rot +90 local Y",
        "4 rot -90 local Y",
        "6 rot 180 local X",
        "6 rot 180 local Y",
        "7 rot 180 local Z",
        "8 remap X,Z,-Y",
        "9 remap X,-Z,Y",
    ]

    info = []
    info.append("Received plane count: " + str(len(planes)))
    info.append(selection_msg)
    info.append("Using preset: " + labels[idx])
    info.append("offset: " + str(offset) + " along local " + str(offset_axis or "Z"))
    info.append("Candidate labels:")
    for label in labels:
        info.append("  " + label)

    return selected, selected, raw, candidates, make_axes(selected, AXIS_LEN), "\n".join(info)


try:
    BasePlane, EndPlane, RawPlane, AllCandidates, Axes, Info = solve()
except Exception as e:
    BasePlane = None
    EndPlane = None
    RawPlane = None
    AllCandidates = []
    Axes = []
    Info = "ERROR: " + str(e)
# ---------- end python_3_script_10 ----------
geometry_4 = Geometry(python_3_script_10.EndPlane)  # disabled
geometry_5 = Geometry(python_3_script_10.Axes)  # disabled

# ----
# onrobot end effector
panel_23 = Panel("1000")

# ---- group: On Robot Gripper (continued)
python_3_script_11 = Python3Script(
    package_path=file_path_2,
    stroke_mm=Slider(0, range=0..38),
    finger_configuration=value_list,
    scale=panel_23,
    base_plane=python_3_script_8.tcp_plane)  # -> M, N, F, J, GripPlane, Info; inputs package_path: String, stroke_mm: String, open_ratio: String, finger_configuration: Double, base_plane: Plane
# ---------- python_3_script_11: Python ----------
"""GhPython helper: visualize and drive an OnRobot 2FG7 gripper from the provided description package.

Inputs expected in Grasshopper:
    package_path          Path to either:
                          1) onrobot_2FG7_gripper_description folder, or
                          2) onrobot_2FG7_gripper_description.zip
    stroke_mm             Total finger stroke/open amount in millimeters, 0..38.
                          0 = closed/reference, 38 = fully open/reference.
    open_ratio            Optional normalized open amount, 0..1. Used only if stroke_mm is None.
    finger_configuration  "outwards" or "inwards". Defaults to "outwards".
    scale                 Rhino unit scale from meters. Use 1000 for Rhino millimeters, 1 for meters.
    base_plane            Optional Rhino plane placing the gripper base_link in Rhino.
                          Connect your robot/end_effector_plane here.

Outputs:
    M          Transformed gripper meshes.
    N          Link names for each mesh.
    F          Mesh-centered link frames as Rhino planes.
    J          Joint names used by the virtual gripper.
    GripPlane  Approximate jaw-center / grasp reference plane.
    Info       Status/debug text.

Notes:
    - This is visualization/kinematic-preview only. It does not command the physical gripper.
    - The source package is Xacro, so this script uses the expanded 2FG7 link/joint values directly.
    - The STL files are authored in millimeters and referenced in Xacro with mesh scale="0.001 0.001 0.001".
      This script converts STL mm -> meters, then meters -> Rhino units through `scale`.
    - 2FG7 finger travel in the provided Xacro is 0.019 m per side, so total visual stroke is 38 mm.
    - Updated: output frames F are centered on the actual transformed mesh bounding boxes, not only the URDF link origins.
"""

import math
import os
import struct
import tempfile
import zipfile

import Rhino.Geometry as rg
import scriptcontext as sc


# -------------------------
# Grasshopper input defaults
# -------------------------
try:
    package_path
except NameError:
    package_path = None

try:
    stroke_mm
except NameError:
    stroke_mm = None

try:
    open_ratio
except NameError:
    open_ratio = None

try:
    finger_configuration
except NameError:
    finger_configuration = "outwards"

try:
    scale
except NameError:
    scale = 1000.0

try:
    base_plane
except NameError:
    base_plane = None


# -------------------------
# 2FG7 constants from Xacro
# -------------------------
ROOT_LINK = "base_link"
MAX_TRAVEL_M_PER_FINGER = 0.019
MAX_TOTAL_STROKE_MM = MAX_TRAVEL_M_PER_FINGER * 2.0 * 1000.0  # 38 mm
MESH_FILE_SCALE_TO_METERS = 0.001  # STL mm -> m, from Xacro mesh scale

# Joint origins are in meters, from onrobot_2fg7.xacro.
LEFT_JOINT_ORIGIN = [0.032239, -0.029494, 0.12005]
RIGHT_JOINT_ORIGIN = [-0.054361, -0.029494, 0.12005]
LEFT_AXIS = [-1.0, 0.0, 0.0]
RIGHT_AXIS = [1.0, 0.0, 0.0]

# Visual origins are in meters, from onrobot_2fg7.xacro.
VISUALS = [
    {
        "link": "base_link",
        "mesh_outwards": "base_link.stl",
        "mesh_inwards": "base_link.stl",
        "origin_xyz": [0.0, 0.0, 0.0],
        "origin_rpy": [0.0, 0.0, 0.0],
    },
    {
        "link": "left_finger_link",
        "mesh_outwards": "left_finger_link.stl",
        "mesh_inwards": os.path.join("inwards", "left_finger_link.stl"),
        "origin_xyz": [-0.032239, 0.029494, -0.12005],
        "origin_rpy": [0.0, 0.0, 0.0],
    },
    {
        "link": "right_finger_link",
        "mesh_outwards": "right_finger_link.stl",
        "mesh_inwards": os.path.join("inwards", "right_finger_link.stl"),
        "origin_xyz": [0.054361, 0.029494, -0.12005],
        "origin_rpy": [0.0, 0.0, 0.0],
    },
]


# -------------------------
# Math / transform helpers
# -------------------------
def clamp(value, low, high):
    return max(low, min(high, value))


def rpy_transform(roll, pitch, yaw):
    cr = math.cos(roll)
    sr = math.sin(roll)
    cp = math.cos(pitch)
    sp = math.sin(pitch)
    cy = math.cos(yaw)
    sy = math.sin(yaw)

    # URDF fixed-axis RPY: Rz(yaw) * Ry(pitch) * Rx(roll)
    t = rg.Transform.Identity
    t.M00 = cy * cp
    t.M01 = cy * sp * sr - sy * cr
    t.M02 = cy * sp * cr + sy * sr

    t.M10 = sy * cp
    t.M11 = sy * sp * sr + cy * cr
    t.M12 = sy * sp * cr - cy * sr

    t.M20 = -sp
    t.M21 = cp * sr
    t.M22 = cp * cr

    return t


def origin_transform(xyz, rpy, unit_scale):
    t = rpy_transform(rpy[0], rpy[1], rpy[2])
    t.M03 = xyz[0] * unit_scale
    t.M13 = xyz[1] * unit_scale
    t.M23 = xyz[2] * unit_scale
    return t


def prismatic_transform(axis, distance_m, unit_scale):
    return rg.Transform.Translation(
        rg.Vector3d(
            axis[0] * distance_m * unit_scale,
            axis[1] * distance_m * unit_scale,
            axis[2] * distance_m * unit_scale
        )
    )


def base_transform(plane):
    if plane is None:
        return rg.Transform.Identity
    return rg.Transform.PlaneToPlane(rg.Plane.WorldXY, plane)


def transform_to_plane(xform):
    origin = rg.Point3d.Origin
    x_axis = rg.Vector3d.XAxis
    y_axis = rg.Vector3d.YAxis

    origin.Transform(xform)
    x_axis.Transform(xform)
    y_axis.Transform(xform)

    if not x_axis.Unitize():
        x_axis = rg.Vector3d.XAxis
    if not y_axis.Unitize():
        y_axis = rg.Vector3d.YAxis

    return rg.Plane(origin, x_axis, y_axis)


def centered_mesh_plane(mesh, orientation_xform):
    """
    Plane origin = transformed mesh bounding-box center.
    Plane axes = orientation from the supplied orientation transform.

    This fixes the common URDF visual-offset issue:
    - link frame is at joint/link origin
    - visual mesh is offset by local visual origin
    - therefore the link frame does not always sit at visual mesh center
    """
    bbox = mesh.GetBoundingBox(True)
    center = bbox.Center

    x_axis = rg.Vector3d.XAxis
    y_axis = rg.Vector3d.YAxis

    x_axis.Transform(orientation_xform)
    y_axis.Transform(orientation_xform)

    if not x_axis.Unitize():
        x_axis = rg.Vector3d.XAxis
    if not y_axis.Unitize():
        y_axis = rg.Vector3d.YAxis

    return rg.Plane(center, x_axis, y_axis)


def mesh_center(mesh):
    bbox = mesh.GetBoundingBox(True)
    return bbox.Center


# -------------------------
# Package / mesh loading
# -------------------------
def resolve_package_folder(path):
    if not path:
        raise ValueError("Connect package_path to the 2FG7 folder or .zip file.")

    p = os.path.abspath(str(path))

    if os.path.isdir(p):
        # Accept either the package root or a parent containing the package root.
        if os.path.isdir(os.path.join(p, "meshes")):
            return p

        nested = os.path.join(p, "onrobot_2FG7_gripper_description")
        if os.path.isdir(os.path.join(nested, "meshes")):
            return nested

        raise IOError("Folder found, but no meshes folder was found: " + p)

    if os.path.isfile(p) and p.lower().endswith(".zip"):
        key = ("onrobot_2fg7_zip_extract", p, os.path.getmtime(p), os.path.getsize(p))

        if key in sc.sticky and os.path.isdir(sc.sticky[key]):
            return sc.sticky[key]

        extract_root = os.path.join(
            tempfile.gettempdir(),
            "onrobot_2fg7_gripper_description_extract"
        )

        if not os.path.isdir(extract_root):
            os.makedirs(extract_root)

        with zipfile.ZipFile(p, "r") as zf:
            zf.extractall(extract_root)

        candidate = os.path.join(extract_root, "onrobot_2FG7_gripper_description")

        if not os.path.isdir(os.path.join(candidate, "meshes")):
            raise IOError("Zip extracted, but package meshes folder was not found.")

        sc.sticky[key] = candidate
        return candidate

    raise IOError("package_path is not a folder or .zip file: " + p)


def read_stl_mesh(path):
    with open(path, "rb") as f:
        data = f.read()

    if len(data) < 84:
        raise ValueError("STL file is too small: " + path)

    tri_count = struct.unpack("<I", data[80:84])[0]
    expected_size = 84 + tri_count * 50

    if expected_size == len(data):
        return read_binary_stl(data)

    return read_ascii_stl(data)


def read_binary_stl(data):
    mesh = rg.Mesh()
    tri_count = struct.unpack("<I", data[80:84])[0]
    offset = 84

    for _i in range(tri_count):
        vals = struct.unpack("<12f", data[offset:offset + 48])

        p0 = rg.Point3d(vals[3], vals[4], vals[5])
        p1 = rg.Point3d(vals[6], vals[7], vals[8])
        p2 = rg.Point3d(vals[9], vals[10], vals[11])

        idx = mesh.Vertices.Count
        mesh.Vertices.Add(p0)
        mesh.Vertices.Add(p1)
        mesh.Vertices.Add(p2)
        mesh.Faces.AddFace(idx, idx + 1, idx + 2)

        offset += 50

    mesh.Normals.ComputeNormals()
    mesh.Compact()
    return mesh


def read_ascii_stl(data):
    text = data.decode("utf-8", "ignore")
    mesh = rg.Mesh()
    triangle = []

    for line in text.splitlines():
        s = line.strip()

        if not s.startswith("vertex "):
            continue

        parts = s.split()
        triangle.append(
            rg.Point3d(
                float(parts[1]),
                float(parts[2]),
                float(parts[3])
            )
        )

        if len(triangle) == 3:
            idx = mesh.Vertices.Count
            mesh.Vertices.Add(triangle[0])
            mesh.Vertices.Add(triangle[1])
            mesh.Vertices.Add(triangle[2])
            mesh.Faces.AddFace(idx, idx + 1, idx + 2)
            triangle = []

    mesh.Normals.ComputeNormals()
    mesh.Compact()
    return mesh


def cached_mesh(mesh_path):
    key = (
        "onrobot_2fg7_mesh",
        os.path.abspath(mesh_path),
        os.path.getmtime(mesh_path),
        os.path.getsize(mesh_path)
    )

    if key not in sc.sticky:
        sc.sticky[key] = read_stl_mesh(mesh_path)

    return sc.sticky[key]


# -------------------------
# Gripper reconstruction
# -------------------------
def get_stroke_distance_m():
    # Prefer stroke_mm. If it is not connected, use open_ratio.
    if stroke_mm is not None:
        total_stroke = float(stroke_mm)
    elif open_ratio is not None:
        total_stroke = float(open_ratio) * MAX_TOTAL_STROKE_MM
    else:
        total_stroke = 0.0

    total_stroke = clamp(total_stroke, 0.0, MAX_TOTAL_STROKE_MM)
    one_side_distance_m = (total_stroke * 0.5) / 1000.0

    return one_side_distance_m, total_stroke


def reconstruct():
    package_folder = resolve_package_folder(package_path)
    mesh_folder = os.path.join(package_folder, "meshes")

    if not os.path.isdir(mesh_folder):
        raise IOError("Mesh directory not found: " + mesh_folder)

    config = str(finger_configuration or "outwards").lower().strip()

    if config not in ("outwards", "inwards"):
        config = "outwards"

    unit_scale = float(scale)
    root_xform = base_transform(base_plane)
    one_side_distance_m, total_stroke = get_stroke_distance_m()

    # Base frame plus two prismatic finger frames.
    left_xform = (
        root_xform
        * origin_transform(LEFT_JOINT_ORIGIN, [0.0, 0.0, 0.0], unit_scale)
        * prismatic_transform(LEFT_AXIS, one_side_distance_m, unit_scale)
    )

    right_xform = (
        root_xform
        * origin_transform(RIGHT_JOINT_ORIGIN, [0.0, 0.0, 0.0], unit_scale)
        * prismatic_transform(RIGHT_AXIS, one_side_distance_m, unit_scale)
    )

    link_xforms = {
        "base_link": root_xform,
        "left_finger_link": left_xform,
        "right_finger_link": right_xform,
    }

    meshes = []
    names = []
    frames = []

    # The total mesh scale is: STL mm -> meters -> Rhino units.
    mesh_total_scale = MESH_FILE_SCALE_TO_METERS * unit_scale
    mesh_scale_xform = rg.Transform.Scale(rg.Point3d.Origin, mesh_total_scale)

    for visual in VISUALS:
        link_name = visual["link"]
        mesh_rel = visual["mesh_" + config]
        mesh_path = os.path.join(mesh_folder, mesh_rel)

        if not os.path.exists(mesh_path):
            raise IOError("Mesh not found: " + mesh_path)

        mesh = cached_mesh(mesh_path).DuplicateMesh()

        local_t = origin_transform(
            visual["origin_xyz"],
            visual["origin_rpy"],
            unit_scale
        )

        # Full visual transform includes:
        # link transform + URDF visual origin offset + mesh unit scale.
        mesh_xform = link_xforms[link_name] * local_t * mesh_scale_xform
        mesh.Transform(mesh_xform)

        meshes.append(mesh)
        names.append(link_name)

        # Updated:
        # Frame origin is centered on the transformed mesh.
        # Frame axes still follow the link transform orientation.
        frames.append(centered_mesh_plane(mesh, link_xforms[link_name]))

   # Updated GripPlane:
    # Center between the two transformed finger frame origins.
    # This makes GripPlane sit between left_finger_link and right_finger_link,
    # instead of using the front/min side of the mesh bounding boxes.

    left_plane = None
    right_plane = None

    for frame, name in zip(frames, names):
        if name == "left_finger_link":
            left_plane = frame
        elif name == "right_finger_link":
            right_plane = frame

    if left_plane is not None and right_plane is not None:
        grip_center = rg.Point3d(
            (left_plane.Origin.X + right_plane.Origin.X) * 0.5,
            (left_plane.Origin.Y + right_plane.Origin.Y) * 0.5,
            (left_plane.Origin.Z + right_plane.Origin.Z) * 0.5
        )

        # Keep orientation consistent with the gripper base/root.
        x_axis = rg.Vector3d.XAxis
        y_axis = rg.Vector3d.YAxis

        x_axis.Transform(root_xform)
        y_axis.Transform(root_xform)

        if not x_axis.Unitize():
            x_axis = rg.Vector3d.XAxis
        if not y_axis.Unitize():
            y_axis = rg.Vector3d.YAxis

        grip_plane = rg.Plane(grip_center, x_axis, y_axis)

    else:
        # Fallback: midpoint between the two prismatic joint origins.
        jaw_center = [
            (LEFT_JOINT_ORIGIN[0] + RIGHT_JOINT_ORIGIN[0]) * 0.5,
            (LEFT_JOINT_ORIGIN[1] + RIGHT_JOINT_ORIGIN[1]) * 0.5,
            (LEFT_JOINT_ORIGIN[2] + RIGHT_JOINT_ORIGIN[2]) * 0.5,
        ]

        grip_xform = root_xform * origin_transform(
            jaw_center,
            [0.0, 0.0, 0.0],
            unit_scale
        )

        grip_plane = transform_to_plane(grip_xform)

    info = []
    info.append("OnRobot 2FG7 gripper preview")
    info.append("Package: " + package_folder)
    info.append("Mesh dir: " + mesh_folder)
    info.append("Configuration: " + config)
    info.append("Total stroke_mm clamped: " + str(round(total_stroke, 4)) + " / " + str(MAX_TOTAL_STROKE_MM))
    info.append("Per-finger travel_m: " + str(round(one_side_distance_m, 6)) + " / " + str(MAX_TRAVEL_M_PER_FINGER))
    info.append("Joint order: left_finger_joint, right_finger_joint mimic")
    info.append("Meshes: " + str(len(meshes)))
    info.append("Frames F: mesh-centered planes using transformed mesh bounding boxes")
    info.append("GripPlane: midpoint between transformed left/right finger mesh centers")
    info.append("Connect base_plane to the robot end_effector_plane to attach this gripper to the RO1 preview.")

    return (
        meshes,
        names,
        frames,
        ["left_finger_joint", "right_finger_joint_mimic"],
        grip_plane,
        "\n".join(info)
    )


try:
    M, N, F, J, GripPlane, Info = reconstruct()

except Exception as e:
    M = []
    N = []
    F = []
    J = []
    GripPlane = None
    Info = "ERROR: " + str(e)
# ---------- end python_3_script_11 ----------
panel_24 = Panel(python_3_script_11.Info)
geometry_6 = Geometry(python_3_script_11.M)
custom_preview_4 = CustomPreview(Geometry=geometry_6, Material=ColourSwatch(SwatchColor=RGB(163, 163, 163)))

# ----
geometry_7 = Geometry(python_3_script_11.F)
geometry_8 = Geometry(python_3_script_11.GripPlane)

# ---- group: gripper tool tip
python_3_script_12 = Python3Script(M=python_3_script_11.M, N=python_3_script_11.N, base_plane=geometry_8, tip_side="minY")  # -> out, TipGripPlane, info; inputs M: list of Mesh, N: list, base_plane: Plane
# ---------- python_3_script_12: Python ----------
import Rhino.Geometry as rg

# ------------------------------------------------------------
# Finger Tip GripPlane Extractor
# ------------------------------------------------------------
# Inputs:
#   M           gripper meshes from gripper script
#   N           link names from gripper script
#   base_plane  same base_plane used by gripper script
#   tip_axis    "minX", "maxX", "minY", "maxY", "minZ", "maxZ"
#
# Outputs:
#   TipGripPlane
#   Info
# ------------------------------------------------------------


#  initialize outputs first so they never return null
TipGripPlane = rg.Plane.WorldXY
Info = "SCRIPT_STARTED"


# -------------------------
# Input defaults
# -------------------------
try:
    M
except NameError:
    M = []

try:
    N
except NameError:
    N = []

try:
    base_plane
except NameError:
    base_plane = None

try:
    tip_axis
except NameError:
    tip_axis = "maxZ"


# -------------------------
# Helpers
# -------------------------
def flatten_input(x):
    """
    Supports normal Python lists, Grasshopper DataTrees, and single items.
    """
    if x is None:
        return []

    if hasattr(x, "Branches"):
        out = []
        for branch in x.Branches:
            for item in branch:
                out.append(item)
        return out

    if isinstance(x, (list, tuple)):
        return list(x)

    try:
        if hasattr(x, "__iter__") and not isinstance(x, str):
            return list(x)
    except:
        pass

    return [x]


def unwrap_goo(x):
    """
    Some Grasshopper values are wrapped as GH_Goo.
    """
    try:
        if hasattr(x, "Value"):
            return x.Value
    except:
        pass

    return x


def clean_name(x):
    return str(unwrap_goo(x)).strip()


def base_to_world_xform(plane):
    """
    Local gripper coordinates -> world coordinates.
    """
    if plane is None:
        return rg.Transform.Identity

    return rg.Transform.PlaneToPlane(rg.Plane.WorldXY, plane)


def world_to_base_xform(plane):
    """
    World coordinates -> local gripper coordinates.
    This avoids using world bounding boxes, which are wrong when the gripper rotates.
    """
    if plane is None:
        return rg.Transform.Identity

    return rg.Transform.PlaneToPlane(plane, rg.Plane.WorldXY)


def mesh_bounds_in_base_frame(mesh, base_plane):
    """
    Measures the transformed mesh in the local coordinate system of base_plane.
    """
    localize = world_to_base_xform(base_plane)

    minx = miny = minz = 1e300
    maxx = maxy = maxz = -1e300

    if mesh.Vertices.Count == 0:
        raise ValueError("Mesh has 0 vertices.")

    for i in range(mesh.Vertices.Count):
        v = mesh.Vertices[i]
        p = rg.Point3d(v.X, v.Y, v.Z)
        p.Transform(localize)

        minx = min(minx, p.X)
        maxx = max(maxx, p.X)

        miny = min(miny, p.Y)
        maxy = max(maxy, p.Y)

        minz = min(minz, p.Z)
        maxz = max(maxz, p.Z)

    return minx, maxx, miny, maxy, minz, maxz


def point_from_bounds(bounds, axis_name):
    """
    Returns the center point of one bounding-box side in local gripper coordinates.
    """
    minx, maxx, miny, maxy, minz, maxz = bounds

    cx = (minx + maxx) * 0.5
    cy = (miny + maxy) * 0.5
    cz = (minz + maxz) * 0.5

    if axis_name == "minX":
        return rg.Point3d(minx, cy, cz)

    if axis_name == "maxX":
        return rg.Point3d(maxx, cy, cz)

    if axis_name == "minY":
        return rg.Point3d(cx, miny, cz)

    if axis_name == "maxY":
        return rg.Point3d(cx, maxy, cz)

    if axis_name == "minZ":
        return rg.Point3d(cx, cy, minz)

    if axis_name == "maxZ":
        return rg.Point3d(cx, cy, maxz)

    return rg.Point3d(cx, cy, maxz)


def local_to_world(point, base_plane):
    xf = base_to_world_xform(base_plane)
    p = rg.Point3d(point.X, point.Y, point.Z)
    p.Transform(xf)
    return p


def plane_with_base_axes(origin, base_plane):
    """
    Creates a plane at origin, but keeps orientation aligned with the gripper base.
    """
    xf = base_to_world_xform(base_plane)

    x_axis = rg.Vector3d.XAxis
    y_axis = rg.Vector3d.YAxis

    x_axis.Transform(xf)
    y_axis.Transform(xf)

    if not x_axis.Unitize():
        x_axis = rg.Vector3d.XAxis

    if not y_axis.Unitize():
        y_axis = rg.Vector3d.YAxis

    return rg.Plane(origin, x_axis, y_axis)


def center_between_points(a, b):
    return rg.Point3d(
        (a.X + b.X) * 0.5,
        (a.Y + b.Y) * 0.5,
        (a.Z + b.Z) * 0.5
    )


def candidate_center(left_bounds, right_bounds, axis_name, base_plane):
    """
    Computes the center between left and right finger candidate points
    for a given side: minX/maxX/minY/maxY/minZ/maxZ.
    """
    left_local = point_from_bounds(left_bounds, axis_name)
    right_local = point_from_bounds(right_bounds, axis_name)

    left_world = local_to_world(left_local, base_plane)
    right_world = local_to_world(right_local, base_plane)

    return center_between_points(left_world, right_world)


def dims_from_bounds(bounds):
    minx, maxx, miny, maxy, minz, maxz = bounds
    return maxx - minx, maxy - miny, maxz - minz


# -------------------------
# Main
# -------------------------
try:
    meshes = [unwrap_goo(x) for x in flatten_input(M)]
    names = [clean_name(x) for x in flatten_input(N)]

    Info = "Inputs received: M count={}, N count={}".format(len(meshes), len(names))

    if len(meshes) == 0:
        raise ValueError("M is empty. Connect gripper script output M to this script input M.")

    if len(names) == 0:
        raise ValueError("N is empty. Connect gripper script output N to this script input N.")

    if len(meshes) != len(names):
        raise ValueError("M and N count mismatch. M={}, N={}".format(len(meshes), len(names)))

    axis = str(tip_axis or "maxZ").strip()

    valid_axes = ("minX", "maxX", "minY", "maxY", "minZ", "maxZ")

    if axis not in valid_axes:
        axis = "maxZ"

    left_mesh = None
    right_mesh = None
    found_names = []

    for mesh, name in zip(meshes, names):
        found_names.append(name)

        if name == "left_finger_link":
            left_mesh = mesh

        elif name == "right_finger_link":
            right_mesh = mesh

    if left_mesh is None:
        raise ValueError("Could not find left_finger_link. Found names: {}".format(found_names))

    if right_mesh is None:
        raise ValueError("Could not find right_finger_link. Found names: {}".format(found_names))

    if not isinstance(left_mesh, rg.Mesh):
        raise ValueError("left_finger_link is not a Rhino Mesh. Type={}".format(type(left_mesh)))

    if not isinstance(right_mesh, rg.Mesh):
        raise ValueError("right_finger_link is not a Rhino Mesh. Type={}".format(type(right_mesh)))

    left_bounds = mesh_bounds_in_base_frame(left_mesh, base_plane)
    right_bounds = mesh_bounds_in_base_frame(right_mesh, base_plane)

    left_local_tip = point_from_bounds(left_bounds, axis)
    right_local_tip = point_from_bounds(right_bounds, axis)

    left_world_tip = local_to_world(left_local_tip, base_plane)
    right_world_tip = local_to_world(right_local_tip, base_plane)

    grip_center = center_between_points(left_world_tip, right_world_tip)

    TipGripPlane = plane_with_base_axes(grip_center, base_plane)

    # Candidate centers for debugging.
    c_minX = candidate_center(left_bounds, right_bounds, "minX", base_plane)
    c_maxX = candidate_center(left_bounds, right_bounds, "maxX", base_plane)
    c_minY = candidate_center(left_bounds, right_bounds, "minY", base_plane)
    c_maxY = candidate_center(left_bounds, right_bounds, "maxY", base_plane)
    c_minZ = candidate_center(left_bounds, right_bounds, "minZ", base_plane)
    c_maxZ = candidate_center(left_bounds, right_bounds, "maxZ", base_plane)

    left_dims = dims_from_bounds(left_bounds)
    right_dims = dims_from_bounds(right_bounds)

    Info = (
        "OK: TipGripPlane created from selected finger side.\n"
        "Selected tip_axis = {}\n"
        "If it is at the finger base, use the opposite side:\n"
        "minX <-> maxX, minY <-> maxY, minZ <-> maxZ\n\n"

        "Selected TipGripPlane Origin = ({:.2f}, {:.2f}, {:.2f})\n"
        "Left selected tip = ({:.2f}, {:.2f}, {:.2f})\n"
        "Right selected tip = ({:.2f}, {:.2f}, {:.2f})\n\n"

        "Candidate center positions:\n"
        "minX = ({:.2f}, {:.2f}, {:.2f})\n"
        "maxX = ({:.2f}, {:.2f}, {:.2f})\n"
        "minY = ({:.2f}, {:.2f}, {:.2f})\n"
        "maxY = ({:.2f}, {:.2f}, {:.2f})\n"
        "minZ = ({:.2f}, {:.2f}, {:.2f})\n"
        "maxZ = ({:.2f}, {:.2f}, {:.2f})\n\n"

        "LEFT bounds in gripper local frame:\n"
        "minX={:.2f}, maxX={:.2f}, minY={:.2f}, maxY={:.2f}, minZ={:.2f}, maxZ={:.2f}\n"
        "LEFT dimensions XYZ = ({:.2f}, {:.2f}, {:.2f})\n\n"

        "RIGHT bounds in gripper local frame:\n"
        "minX={:.2f}, maxX={:.2f}, minY={:.2f}, maxY={:.2f}, minZ={:.2f}, maxZ={:.2f}\n"
        "RIGHT dimensions XYZ = ({:.2f}, {:.2f}, {:.2f})"
    ).format(
        axis,

        grip_center.X, grip_center.Y, grip_center.Z,
        left_world_tip.X, left_world_tip.Y, left_world_tip.Z,
        right_world_tip.X, right_world_tip.Y, right_world_tip.Z,

        c_minX.X, c_minX.Y, c_minX.Z,
        c_maxX.X, c_maxX.Y, c_maxX.Z,
        c_minY.X, c_minY.Y, c_minY.Z,
        c_maxY.X, c_maxY.Y, c_maxY.Z,
        c_minZ.X, c_minZ.Y, c_minZ.Z,
        c_maxZ.X, c_maxZ.Y, c_maxZ.Z,

        left_bounds[0], left_bounds[1], left_bounds[2], left_bounds[3], left_bounds[4], left_bounds[5],
        left_dims[0], left_dims[1], left_dims[2],

        right_bounds[0], right_bounds[1], right_bounds[2], right_bounds[3], right_bounds[4], right_bounds[5],
        right_dims[0], right_dims[1], right_dims[2]
    )

except Exception as e:
    TipGripPlane = rg.Plane.WorldXY
    Info = "ERROR: " + str(e)
# ---------- end python_3_script_12 ----------

# ---- group: Robot TCP vs Gripper tool-tip TCP plane
geometry_9 = Geometry(python_3_script_12.TipGripPlane)
geometry_10 = Geometry(python_3_script_8.tcp_plane)
panel_25 = Panel(geometry_9)
panel_26 = Panel(geometry_10)

# ----
point_2 = Point(geometry_10)
point_3 = Point(geometry_9)
vector_2pt = Vector2Pt(PointA=point_2, PointB=point_3, Unitize=False)  # -> Vector, Length
panel_27 = Panel(vector_2pt.Length)

# ----
# Simulation 2***Tooltip TCP plane follow the plane list
number_slider_9 = Slider(0.5, range=0..1)
line_joint = Panel("line")
python_3_script_13 = Python3Script(
    target_tip_planes=perp_frame,
    robot_tcp_ref_plane=geometry_10,
    gripper_tip_ref_plane=geometry_9,
    speed=number_slider_9,
    label="felt_cut",
    movement_kind=line_joint,
    use_input_roll=Toggle(False))  # -> out, program, move, tcp_target_planes, tip_target_planes, tip_preview_planes, info; inputs target_tip_planes: list of Plane, robot_tcp_ref_plane: Plane, gripper_tip_ref_plane: Plane
# ---------- python_3_script_13: Python ----------
"""
Gripper Tool-Tip Frames → Robot TCP Program
===========================================

Purpose:
    Your path/list of planes describes where the PHYSICAL GRIPPER TOOL TIP
    should go.

    But the robot simulator/IK solves from the ROBOT TCP / flange frame.

    This script uses two reference planes:

        robot_tcp_ref_plane
        gripper_tip_ref_plane

    to compute the fixed local transform:

        robot TCP frame → gripper tool-tip frame

    Then it converts every desired gripper tool-tip target plane into the
    corresponding robot TCP target plane and outputs tooltip_position JSON moves.

INPUTS:
    target_tip_planes      Rhino Plane or list/tree of Rhino Planes.
                           These are desired PHYSICAL GRIPPER TOOL-TIP frames.

    robot_tcp_ref_plane    Rhino Plane.
                           Known robot TCP/flange plane.

    gripper_tip_ref_plane  Rhino Plane.
                           Corresponding physical gripper tool-tip plane
                           at the same robot pose.

    speed                  float 0.01-1.0

    label                  string, default "IK"

    movement_kind          "line" or "joint", default "line"

    use_input_roll         bool.
                           False = use only input plane ZAxis normal and rebuild
                                   stable X/Y axes.
                           True  = preserve full input frame orientation.

OUTPUTS:
    program                list of JSON strings. Feed this into simulator program.
    move                   list of Python move dictionaries.
    tcp_target_planes      robot TCP/flange target planes.
    tip_target_planes      desired gripper tool-tip planes used by this script.
    tip_preview_planes     reconstructed tool-tip planes.
                           These should overlap target_tip_planes.
    info                   status / diagnostics.
"""

import math
import json
import Rhino.Geometry as rg

# -----------------------------------------------------------------------------
# Grasshopper input helper
# -----------------------------------------------------------------------------

def _get(name, default):
    try:
        v = globals()[name]
        return default if v is None else v
    except (KeyError, NameError):
        return default

target_tip_planes     = _get("target_tip_planes", None)
robot_tcp_ref_plane   = _get("robot_tcp_ref_plane", None)
gripper_tip_ref_plane = _get("gripper_tip_ref_plane", None)

speed          = float(_get("speed", 0.1))
label          = str(_get("label", "IK"))
movement_kind  = str(_get("movement_kind", "line")).lower()
use_input_roll = bool(_get("use_input_roll", False))

speed = max(0.01, min(1.0, speed))

# -----------------------------------------------------------------------------
# Geometry helpers
# -----------------------------------------------------------------------------

def _flatten_planes(x):
    if x is None:
        return []

    if isinstance(x, rg.Plane):
        return [x]

    # Grasshopper DataTree support
    if hasattr(x, "Branches"):
        out = []
        for br in x.Branches:
            for item in br:
                if isinstance(item, rg.Plane):
                    out.append(item)
        return out

    try:
        out = []
        for item in list(x):
            if isinstance(item, rg.Plane):
                out.append(item)
        return out
    except Exception:
        return [x] if isinstance(x, rg.Plane) else []

def _dot(a, b):
    return a.X*b.X + a.Y*b.Y + a.Z*b.Z

def _safe_unit(v, fallback):
    vv = rg.Vector3d(v)
    if not vv.Unitize():
        vv = rg.Vector3d(fallback)
        vv.Unitize()
    return vv

def _plane_to_xf(p):
    return rg.Transform.PlaneToPlane(rg.Plane.WorldXY, p)

def _xf_to_plane(xf):
    o = rg.Point3d.Origin
    x = rg.Vector3d.XAxis
    y = rg.Vector3d.YAxis

    o.Transform(xf)
    x.Transform(xf)
    y.Transform(xf)

    return rg.Plane(o, x, y)

def _inverse_xf(xf):
    """
    Robust inverse helper for different Rhino/IronPython versions.
    """
    try:
        ok, inv = xf.TryGetInverse()
        if ok:
            return inv
    except Exception:
        pass

    try:
        inv = rg.Transform(xf)
        ok = inv.TryGetInverse(inv)
        if ok:
            return inv
    except Exception:
        pass

    inv = rg.Transform(xf)
    inv.Invert()
    return inv

# -----------------------------------------------------------------------------
# Frame construction
# -----------------------------------------------------------------------------

def _rebuild_plane_from_z_normal(p):
    """
    Keeps input origin and ZAxis.
    Rebuilds X/Y in a stable way to prevent random roll flipping.

    Use this when the normal direction is the important part.
    """
    z_axis = _safe_unit(p.ZAxis, rg.Vector3d.ZAxis)

    up = rg.Vector3d.ZAxis
    up.Unitize()

    # If normal is almost parallel to world Z, use world X as roll reference.
    if abs(_dot(z_axis, up)) > 0.98:
        up = rg.Vector3d.XAxis
        up.Unitize()

    x_axis = rg.Vector3d.CrossProduct(up, z_axis)
    x_axis = _safe_unit(x_axis, rg.Vector3d.XAxis)

    y_axis = rg.Vector3d.CrossProduct(z_axis, x_axis)
    y_axis = _safe_unit(y_axis, rg.Vector3d.YAxis)

    return rg.Plane(p.Origin, x_axis, y_axis)

def _get_tcp_to_tip_transform():
    """
    Computes local transform:

        robot TCP frame → physical gripper tool-tip frame

    using:

        robot_tcp_ref_plane
        gripper_tip_ref_plane
    """
    if not isinstance(robot_tcp_ref_plane, rg.Plane):
        return None, "robot_tcp_ref_plane is missing or not a Plane"

    if not isinstance(gripper_tip_ref_plane, rg.Plane):
        return None, "gripper_tip_ref_plane is missing or not a Plane"

    world_tcp_xf = _plane_to_xf(robot_tcp_ref_plane)
    world_tip_xf = _plane_to_xf(gripper_tip_ref_plane)

    # Relationship:
    #
    #     W_T_tip = W_T_tcp * tcp_T_tip
    #
    # therefore:
    #
    #     tcp_T_tip = inverse(W_T_tcp) * W_T_tip
    #
    tcp_to_tip_xf = _inverse_xf(world_tcp_xf) * world_tip_xf

    return tcp_to_tip_xf, "reference planes"

# -----------------------------------------------------------------------------
# Quaternion helpers
# -----------------------------------------------------------------------------

def _quat_from_plane(p):
    xa = _safe_unit(p.XAxis, rg.Vector3d.XAxis)
    ya = _safe_unit(p.YAxis, rg.Vector3d.YAxis)
    za = rg.Vector3d.CrossProduct(xa, ya)
    za = _safe_unit(za, rg.Vector3d.ZAxis)

    m00, m01, m02 = xa.X, ya.X, za.X
    m10, m11, m12 = xa.Y, ya.Y, za.Y
    m20, m21, m22 = xa.Z, ya.Z, za.Z

    tr = m00 + m11 + m22

    if tr > 0.0:
        s = 0.5 / math.sqrt(tr + 1.0)
        w = 0.25 / s
        x = (m21 - m12) * s
        y = (m02 - m20) * s
        z = (m10 - m01) * s

    elif m00 > m11 and m00 > m22:
        s = 2.0 * math.sqrt(1.0 + m00 - m11 - m22)
        x = 0.25 * s
        y = (m01 + m10) / s
        z = (m02 + m20) / s
        w = (m21 - m12) / s

    elif m11 > m22:
        s = 2.0 * math.sqrt(1.0 + m11 - m00 - m22)
        x = (m01 + m10) / s
        y = 0.25 * s
        z = (m12 + m21) / s
        w = (m02 - m20) / s

    else:
        s = 2.0 * math.sqrt(1.0 + m22 - m00 - m11)
        x = (m02 + m20) / s
        y = (m12 + m21) / s
        z = 0.25 * s
        w = (m10 - m01) / s

    mag = math.sqrt(x*x + y*y + z*z + w*w)
    if mag > 1e-9:
        x, y, z, w = x/mag, y/mag, z/mag, w/mag

    return [x, y, z, w]

def _quat_dot(a, b):
    return a[0]*b[0] + a[1]*b[1] + a[2]*b[2] + a[3]*b[3]

def _same_quaternion_hemisphere(q, prev_q):
    """
    q and -q are the same rotation, but sudden sign changes can cause
    interpolation flips. This keeps quaternion signs continuous.
    """
    if prev_q is not None and _quat_dot(q, prev_q) < 0.0:
        return [-q[0], -q[1], -q[2], -q[3]]
    return q

# -----------------------------------------------------------------------------
# Move builder
# -----------------------------------------------------------------------------

def _plane_to_tooltip_move(robot_tcp_target_plane, move_label, quat):
    MM = 1000.0

    return {
        "kind": "tooltip_position",
        "label": move_label,
        "tooltip_position": {
            "position": {
                "unit_kind": "meters",
                "x": round(robot_tcp_target_plane.Origin.X / MM, 6),
                "y": round(robot_tcp_target_plane.Origin.Y / MM, 6),
                "z": round(robot_tcp_target_plane.Origin.Z / MM, 6)
            },
            "orientation": {
                "kind": "quaternion",
                "quaternion": {
                    "x": round(quat[0], 6),
                    "y": round(quat[1], 6),
                    "z": round(quat[2], 6),
                    "w": round(quat[3], 6)
                }
            },
            "reference_frame": "base",
            "axis_alignment": "base"
        },
        "movement_kind": movement_kind,
        "speed_profile": {
            "scaling_factor": round(speed, 4),
            "max_tooltip_speed": round(speed, 4)
        }
    }

# -----------------------------------------------------------------------------
# Main
# -----------------------------------------------------------------------------

program = []
move = []
tcp_target_planes = []
tip_target_planes = []
tip_preview_planes = []
info = ""

input_tip_planes = _flatten_planes(target_tip_planes)
tcp_to_tip_xf, offset_msg = _get_tcp_to_tip_transform()

if not input_tip_planes:
    info = "ERROR: connect target_tip_planes."

elif tcp_to_tip_xf is None:
    info = "ERROR: " + offset_msg

else:
    tip_to_tcp_xf = _inverse_xf(tcp_to_tip_xf)

    prev_q = None

    for i, raw_tip_plane in enumerate(input_tip_planes):

        # Desired PHYSICAL gripper tool-tip target plane.
        if use_input_roll:
            desired_tip_plane = raw_tip_plane
        else:
            desired_tip_plane = _rebuild_plane_from_z_normal(raw_tip_plane)

        desired_tip_xf = _plane_to_xf(desired_tip_plane)

        # Main relationship:
        #
        #     desired_tip = robot_tcp_target * tcp_to_tip
        #
        # therefore:
        #
        #     robot_tcp_target = desired_tip * inverse(tcp_to_tip)
        #
        robot_tcp_target_xf = desired_tip_xf * tip_to_tcp_xf
        robot_tcp_target_plane = _xf_to_plane(robot_tcp_target_xf)

        # Reconstruct tip plane for preview / debugging.
        reconstructed_tip_xf = robot_tcp_target_xf * tcp_to_tip_xf
        reconstructed_tip_plane = _xf_to_plane(reconstructed_tip_xf)

        q = _quat_from_plane(robot_tcp_target_plane)
        q = _same_quaternion_hemisphere(q, prev_q)
        prev_q = q

        move_label = "{}_{}".format(label, i)
        m = _plane_to_tooltip_move(robot_tcp_target_plane, move_label, q)

        tip_target_planes.append(desired_tip_plane)
        tcp_target_planes.append(robot_tcp_target_plane)
        tip_preview_planes.append(reconstructed_tip_plane)

        move.append(m)
        program.append(json.dumps(m, indent=2))

    info = (
        "OK: built {} simulator moves.\n"
        "Offset source: reference planes only.\n"
        "Feed `program` into the simulator `program` input.\n"
        "`tip_preview_planes` should overlap your original desired gripper tool-tip planes."
    ).format(len(program))
# ---------- end python_3_script_13 ----------
panel_28 = Panel(python_3_script_13.program)
geometry_11 = Geometry(python_3_script_13.tip_preview_planes)
python_3_script_14 = Python3Script(
    program=python_3_script_13.program,
    scrub=Slider(1, range=0..1),
    steps=number_slider_6,
    urdf_path=file_path_3,
    mesh_Dir=file_path_4,
    scale=number_slider_5,
    base_plane=xy_plane_3,
    speed=number_slider_7)  # -> meshes, tcp_plane, joint_degrees, current_move, Info; inputs program: list, scrub: Double, urdf_path: String, mesh_Dir: String, scale: Int32; same code as python_3_script_8
value_list_2 = ValueList({"out": outwards, "in": inwards}, selected="in")
python_3_script_15 = Python3Script(
    package_path=file_path_2,
    stroke_mm=Slider(0, range=0..38),
    finger_configuration=value_list_2,
    scale="1000",
    base_plane=python_3_script_14.tcp_plane)  # -> M, N, F, J, GripPlane, Info; inputs package_path: String, stroke_mm: String, open_ratio: String, finger_configuration: Double, base_plane: Plane; same code as python_3_script_11
geometry_12 = Geometry(python_3_script_15.M)
geometry_13 = Geometry(python_3_script_15.F)
geometry_14 = Geometry(python_3_script_15.GripPlane)

# ---- group: gripper tool tip
python_3_script_16 = Python3Script(M=python_3_script_15.M, N=python_3_script_15.N, base_plane=geometry_14, tip_side="minY")  # -> out, TipGripPlane, info; inputs M: list of Mesh, N: list, base_plane: Plane; same code as python_3_script_12

# ----
custom_preview_5 = CustomPreview(Geometry=python_3_script_14.meshes, Material=ColourSwatch(SwatchColor=RGB(41, 41, 41)))
custom_preview_6 = CustomPreview(Geometry=geometry_12, Material=ColourSwatch(SwatchColor=RGB(163, 163, 163)))

# ---- group: +/- <1mm
panel_29 = Panel(python_3_script_16.TipGripPlane)
panel_30 = Panel(perp_frame)

# ----
panel_31 = Panel("1000")  # disabled

# ---- group: On Robot Gripper
number_slider_10 = Slider(0, range=0..38)  # disabled
value_list_3 = ValueList({"out": outwards, "in": inwards}, selected="in")  # disabled
python_3_script_17 = Python3Script(
    package_path=file_path_2,
    stroke_mm=number_slider_10,
    finger_configuration=value_list_3,
    scale=panel_31,
    base_plane=geometry_3)  # -> M, N, F, J, GripPlane, Info; inputs package_path: String, stroke_mm: String, open_ratio: String, finger_configuration: Double, base_plane: Plane; disabled; same code as python_3_script_11
panel_32 = Panel(python_3_script_17.Info)  # disabled
geometry_15 = Geometry(python_3_script_17.M)  # disabled
colour_swatch_2 = ColourSwatch(SwatchColor=RGB(163, 163, 163))  # disabled
custom_preview_7 = CustomPreview(Geometry=geometry_15, Material=colour_swatch_2)  # disabled

# ----
geometry_16 = Geometry(python_3_script_17.F)  # disabled
geometry_17 = Geometry(python_3_script_17.GripPlane)  # disabled

# ----
# GRIPPER REPLAY
panel_33 = Panel("""kind
onrobot_2fg7""")
create_json_value_7 = CreateJSONValue(Value="onrobot_2fg7")
create_json_value_8 = CreateJSONValue(Value=integer)
create_json_value_9 = CreateJSONValue(Value="millimeters")
merge_8 = Merge(Data1=create_json_value_9, Data2=create_json_value_8)
panel_34 = Panel("""unit_kind
value""")
panel_35 = Panel("""control_kind
target_grip_width
grip_direction""")  # disabled
create_json_object_5 = CreateJSONObject(Keys=panel_34, Values=merge_8)  # disabled
create_json_value_10 = CreateJSONValue(Value="move")  # disabled
create_json_value_11 = CreateJSONValue(Value="internal")  # disabled
merge_9 = Merge(Data1=create_json_value_10, Data2=create_json_object_5, Data3=create_json_value_11)  # disabled
create_json_object_6 = CreateJSONObject(Keys=panel_35, Values=merge_9)  # disabled
merge_10 = Merge(Data1=create_json_value_7, Data2=create_json_object_6)  # disabled
panel_36 = Panel("https://cb2347.sb.app/api/v1/equipment/end-effector/control")  # disabled
create_json_object_7 = CreateJSONObject(Keys=panel_33, Values=merge_10)  # disabled
stringify_json_token_5 = StringifyJSONToken(JToken=create_json_object_7)  # disabled
gate_and = GateAnd(A=python_3_script_5, B=replay)  # disabled
panel_37 = Panel(stringify_json_token_5)  # disabled
dispatch_3 = Dispatch(List=panel_36, DispatchPattern=gate_and)  # -> ListA, ListB; disabled
create_text_body_2 = CreateTextBody(
    Content=stringify_json_token_5,
    IsHtmlChecked=False,
    IsJavascriptChecked=False,
    IsJsonChecked=True,
    IsTextChecked=False,
    IsXmlChecked=False)  # disabled
number_slider_11 = Slider(0.05, range=0..2)  # disabled
post_request_2 = POSTRequest(URL=dispatch_3.ListA, Body=create_text_body_2, TimeoutSeconds=100)  # -> Status, Content, Response; disabled
panel_38 = Panel(post_request_2.Content)  # disabled

# ---- group: Delay
python_3_script_18 = Python3Script(x=post_request_2.Status, delay=number_slider_11)  # -> a; inputs delay: Double; disabled; same code as python_3_script_5

# ----
panel_39 = Panel(python_3_script_18)  # disabled
